# Grasshopper definition 20161018_01_intro.gh (Grasshopper 0.9.76)
# Copyright: Co-de-iT

number_slider = Slider(214, range=2..1000)
# < doppio click su canvas + digitare "
# test-o
panel = Panel("""point component

contiene punti""")
# GH intro 20161018
# 
# © a3 2016 _ Creative Commons Attribution-NonCommercial-ShareAlike3.0 UnportedLicense.
# < sketch
pt = Point()
pt_2 = Point(<point referenced from the Rhino model>)
pt_3 = Point(<point referenced from the Rhino model>)
pt_4 = Point([<point referenced from the Rhino model> x5])
pt_5 = Point([<point referenced from the Rhino model> x3])

srf = Surface(reparameterize(<surface referenced from the Rhino model>))
sdivide = DivideSurface(Surface=srf, UCount=Slider(100, range=2..100), VCount=Slider(100, range=2..100))  # -> Points, Normals, Parameters

# ----
# component
num = Number(1)
# panel
panel_2 = Panel("""0
0.1
0.4
0.6
0.8
1""")
# slider
number_slider_2 = Slider(0.154, range=0..1)
crv = Curve(reparameterize(<curve referenced from the Rhino model>))
crv_2 = Curve(reparameterize(<curve referenced from the Rhino model>))
# O
# reparametrize
crv_3 = Curve(reparameterize(<curve referenced from the Rhino model>))
# < doppio click su canvas + digitare scr
# linea da coppia di punti
ln = Line(StartPoint=pt_2, EndPoint=pt_3)
# linee da coppie di punti
# criterio della longest list
ln_2 = Line(StartPoint=pt_4, EndPoint=pt_5)
multiplication = Multiplication(A=Slider(0.463, range=0..1), B=number_slider)
divide = DivideCurve(Curve=crv_2, Count=number_slider, Kinks=False)  # -> Points, Tangents, Parameters
divide_2 = DivideCurve(Curve=crv, Count=number_slider, Kinks=False)  # -> Points, Tangents, Parameters
int = Integer(multiplication)
# evaluate curve
eval = EvaluateCurve(Curve=crv_3, Parameter=number_slider_2)  # -> Point, Tangent, Angle
# curve domain
domain = Domain(crv_3)
item = ListItem(List=divide.Points, Index=int, Wrap=True)
item_2 = ListItem(List=divide_2.Points, Index=int, Wrap=True)
# longest list
panel_3 = Panel(domain)

number_slider_3 = Slider(16.739, range=1..50)
# attractor logic - base
crv_4 = Curve(reparameterize(<curve referenced from the Rhino model>))
crv_cp = CurveClosestPoint(Point=sdivide.Points, Curve=crv_4)  # -> Point, Parameter, Distance
larger = LargerThan(FirstNumber=crv_cp.Distance, SecondNumber=number_slider_3)  # -> LargerThan, OrEqualTo

punto_x_y_z = Panel(eval.Point)
avr = Average(Input=[item, item_2])
vettore_tangente = Panel(eval.Tangent)
pt_6 = Point(<point referenced from the Rhino model>)

# ----
# 0<5<10
# 4
# 15
# 0<<10
# 0<10
# 0<<1
number_slider_4 = Slider(5, range=0..10)
number_slider_5 = Slider(15, range=0..100)
number_slider_6 = Slider(10, range=0..10)
number_slider_7 = Slider(0, range=0..10)
# < doppio click su canvas + digitare testo a fianco degli sliders
number_slider_8 = Slider(4, range=0..10)
number_slider_9 = Slider(0.25, range=0..1)

number_slider_10 = Slider(0.324, range=0..1)
vec2pt = Vector2Pt(PointA=divide.Points, PointB=avr, Unitize=False)  # -> Vector, Length
vec2pt_2 = Vector2Pt(PointA=divide_2.Points, PointB=avr, Unitize=False)  # -> Vector, Length
number_slider_11 = Slider(45.744, range=0..500)
vdisex = VectorDisplayEx(Point=divide.Points, Vector=vec2pt.Vector, Colour=RGB(0, 0, 0), Width=2)
multiplication_2 = Multiplication(A=vec2pt.Length, B=number_slider_10)
multiplication_3 = Multiplication(A=vec2pt_2.Length, B=number_slider_10)
ln_3 = Line(StartPoint=divide.Points, EndPoint=divide_2.Points)
len = Length(Curve=ln_3)
line = LineSDL(Start=divide.Points, Direction=divide.Tangents, Length=number_slider_11)
line_2 = LineSDL(Start=divide_2.Points, Direction=divide_2.Tangents, Length=number_slider_11)
line_3 = LineSDL(Start=divide.Points, Direction=vec2pt.Vector, Length=multiplication_2)
line_4 = LineSDL(Start=divide_2.Points, Direction=vec2pt_2.Vector, Length=multiplication_3)
panel_4 = Panel(multiplication_3)
ma = MassAddition(Input=len)  # -> Result, PartialResults
lunghezza_totale = Panel(ma.Result)

neg = Negative(Value=number_slider_3)
offset = Offset(Curve=crv_4, Distance=[number_slider_3, neg], Plane=PlaneXY(0, 0, 0), Corners=1)
dispatch = Dispatch(List=sdivide.Points, DispatchPattern=larger.LargerThan)  # -> ListA, ListB
dispatch_2 = Dispatch(List=crv_cp.Distance, DispatchPattern=larger.LargerThan)  # -> ListA, ListB
pt_7 = Point(dispatch.ListA)
Z = UnitZ(Factor=1)

# ----
# normalize
# dai dati originali
# al dominio (0,1)
panel_5 = Panel("0 to 1")
bnd = Bounds(Numbers=flatten(dispatch_2.ListA))
remap = RemapNumbers(Value=dispatch_2.ListA, Source=bnd, Target=panel_5)  # -> Mapped, Clipped

graph = GraphMapper(
    remap.Mapped,
    x0=0,
    x1=1,
    y0=0,
    y1=1,
    container_name="Bezier",
    cpx=[0, 0.3276592195, 1, 1],
    cpy=[0, 0.008406937122, 0.4350727201, 1])
# progression
# cambia l'andamento
# dei dati nel dominio (0,1)
frequency = Slider(48.952, range=1..1000)
multiplication_4 = Multiplication(A=graph, B=frequency)
sin = Sine(Value=multiplication_4)

# ----
# dai dati nel dominio (0,1)
# a quello di destinazione
number_slider_12 = Slider(17.37, range=0..100)
# remap
dom = ConstructDomain(DomainStart=Slider(9.626, range=0..100), DomainEnd=number_slider_12)
remap_2 = RemapNumbers(Value=sin, Source="0 to 1", Target=dom)  # -> Mapped, Clipped

line_5 = LineSDL(Start=pt_7, Direction=Z, Length=remap_2.Mapped)
