# Grasshopper definition 20161025_00_in class.gh (Grasshopper 0.9.76)
# Copyright: Co-de-iT

number_slider = Slider(15, range=2..100)
number_slider_2 = Slider(61, range=2..100)
srf = Surface(reparameterize(<surface referenced from the Rhino model>))
sdivide = DivideSurface(Surface=srf, UCount=number_slider, VCount=number_slider)  # -> Points, Normals, Parameters

number_slider_3 = Slider(16.728, range=0..100)
number_slider_4 = Slider(29, range=2..300)
crv = Curve(<curve referenced from the Rhino model>)
mesh = Mesh(<mesh referenced from the Rhino model>)
pt = Point(<point referenced from the Rhino model>)
neg = Negative(Value=number_slider_3)
rows = Slider(3, range=2..10)
series = Series(Start=0, Step=Slider(3, range=0..10), Count=number_slider_4)
# File template
# 
# © a3 2016 _ Creative Commons Attribution-NonCommercial-ShareAlike3.0 UnportedLicense.
panel = Panel(sdivide.Points)
offset = Offset(Curve=crv, Distance=[number_slider_3, neg], Plane=PlaneXY(0, 0, 0), Corners=1)
pline = PolyLine(Vertices=sdivide.Points, Closed=False)
Z = UnitZ(Factor=series)
series_2 = Series(Start=0, Step=Slider(50, range=0..50), Count=number_slider_4)
integer_division = IntegerDivision(A=number_slider_4, B=expr("x-1", rows))
crv_cp = CurveClosestPoint(Point=sdivide.Points, Curve=crv)  # -> Point, Parameter, Distance
move = Move(Geometry=pt, Motion=Z)  # -> Geometry, Transform
viewer = ParamViewer(pline)
Y = UnitY(Factor=series_2)
pt_2 = Point(<point referenced from the Rhino model>)
larger = LargerThan(FirstNumber=crv_cp.Distance, SecondNumber=number_slider_3)  # -> LargerThan, OrEqualTo
xy = XYPlane(Origin=move.Geometry)
move_2 = Move(Geometry=pt_2, Motion=Y)  # -> Geometry, Transform
dispatch = Dispatch(List=sdivide.Points, DispatchPattern=larger.LargerThan)  # -> ListA, ListB
recgrid = Rectangular(Plane=pt_2, SizeX=Slider(80.08, range=0..100), SizeY=Slider(54.48, range=0..100), ExtentX=integer_division, ExtentY=rows)  # -> Cells, Points
dispatch_2 = Dispatch(List=crv_cp.Distance, DispatchPattern=larger.LargerThan)  # -> ListA, ListB
sec = MeshPlane(Mesh=mesh, Plane=xy)
subtraction = Subtraction(A=number_slider_4, B="1")
number_slider_5 = Slider(52.25, range=0..100)
tag = TextTag3D(Location=dispatch.ListA, Text=dispatch_2.ListA, Size=Slider(1.287, range=0..20), Justification=7)
bnd = Bounds(Numbers=flatten(dispatch_2.ListA))
subset = SubList(List=flatten(recgrid.Points), Domain=subtraction, Wrap=True)  # -> List, Index
bnd_2 = Bounds(Numbers=flatten(dispatch_2.ListA))
panel_2 = Panel(bnd)
viewer_2 = ParamViewer(dispatch_2.ListA)
data = Data(dispatch_2.ListA)
pt_3 = Point(dispatch.ListA)
dom = ConstructDomain(DomainStart=Slider(21.12, range=0..100), DomainEnd=Slider(80.89, range=0..100))
remap = RemapNumbers(Value=dispatch_2.ListA, Source=bnd, Target=Domain(0, 1))  # -> Mapped, Clipped
viewer_3 = ParamViewer(data)
remap_2 = RemapNumbers(Value=dispatch_2.ListA, Source=bnd_2, Target=dom)  # -> Mapped, Clipped
orient = Orient(Geometry=sec, Source=graft(xy), Target=graft(subset.List))  # -> Geometry, Transform
graph = GraphMapper(
    remap.Mapped,
    x0=0,
    x1=1,
    y0=0,
    y1=1,
    container_name="Bezier",
    cpx=[0, 0.3043478131, 0.4383561611, 1],
    cpy=[0, 0, 0.5724637508, 1])
random = Random(Range=Domain(0, 1), Number="10", Seed=2)
bnd_3 = Bounds(Numbers=random)
number_slider_6 = Slider(5, range=0..20)
pt_4 = ConstructPoint(XCoordinate=random, YCoordinate=0, ZCoordinate=0)
panel_3 = Panel(bnd_3)
dom_2 = ConstructDomain(DomainStart=Slider(8, range=0..100), DomainEnd=Slider(49.69, range=0..100))
panel_4 = Panel(random)
remap_3 = RemapNumbers(Value=graph, Source=Domain(0, 1), Target=dom_2)  # -> Mapped, Clipped
series_3 = Series(Start=0, Step=1, Count=10)  # -> graft(Series)
cone = Cone(Base=PlaneXY(0, 0, 0), Radius=number_slider_6, Length=1)  # -> Cone, Tip
line = LineSDL(Start=pt_3, Direction=Vector(0, 0, 1), Length=remap_3.Mapped)
cyl = Cylinder(Base=pt_3, Radius=number_slider_6, Length=remap_3.Mapped)
gradient = Gradient(
    LowerLimit=0,
    UpperLimit=1,
    Parameter=graph,
    stops=[0: RGB(0, 98, 0), 0.25: RGB(81, 175, 17), 0.5: RGB(159, 198, 146), 0.75: RGB(170, 235, 41), 1: RGB(221, 255, 53)])
cap = CapHoles(Brep=cyl)
viewer_4 = ParamViewer(series_3)
panel_5 = Panel(series_3)
pipe = Pipe(Radius=1, Caps=0)
preview = CustomPreview(Geometry=cap, Shader=gradient)
