# Grasshopper definition 20161025_a3_02_path example.gh (Grasshopper 0.9.76)
# Copyright: Co-de-iT
# plug-ins: Noise 4D

divisions = Slider(12, range=2..30)

# ----
# File template
# 
# © a3 2016 _ Creative Commons Attribution-NonCommercial-ShareAlike3.0 UnportedLicense.
srf = Surface(reparameterize(<surface referenced from the Rhino model>))
sdivide = DivideSurface(Surface=srf, UCount=Slider(100, range=2..100), VCount=Slider(100, range=2..100))  # -> Points, Normals, Parameters

srf_2 = Surface(reparameterize(<surface referenced from the Rhino model>))
crv = Curve(reparameterize(<curve referenced from the Rhino model>))
divide = DivideDomain²(Domain=srf_2, UCount=divisions, VCount=divisions)
# subdivision
subsrf = Isotrim(Surface=srf_2, Domain=divide)

# ----
# random criteria
lng = ListLength(List=subsrf)
random_threshold = Slider(0.25, range=0..1)
random = Random(Range=Domain(0, 1), Number=lng, Seed=2)
smaller = SmallerThan(FirstNumber=random, SecondNumber=random_threshold)  # -> SmallerThan, OrEqualTo

# ----
# threshold criteria
area = Area(Geometry=subsrf)  # -> Area, Centroid
subdiv_threshold = Slider(50, range=1..50)
crv_cp = CurveClosestPoint(Point=area.Centroid, Curve=crv)  # -> Point, Parameter, Distance
smaller_2 = SmallerThan(FirstNumber=crv_cp.Distance, SecondNumber=subdiv_threshold)  # -> SmallerThan, OrEqualTo

# ----
# noise criteria
number_slider = Slider(0.01, range=0..0.05)
noise_threshold = Slider(0.25, range=-1..1)
perlin = PerlinNoise(Values=area.Centroid, Time=Slider(0.451, range=0..10), Scale=number_slider)
neg = Negative(Value="1")
gradient = Gradient(LowerLimit=neg, UpperLimit="1", Parameter=perlin, stops=[0: RGB(255, 255, 255), 1: RGB(0, 0, 0)])
smaller_3 = SmallerThan(FirstNumber=perlin, SecondNumber=noise_threshold)  # -> SmallerThan, OrEqualTo
preview = CustomPreview(Geometry=area.Centroid, Shader=gradient)

number_slider_2 = Slider(16.739, range=1..50)
# non fatto in aula
crv_2 = Curve(reparameterize(<curve referenced from the Rhino model>))
crv_cp_2 = CurveClosestPoint(Point=sdivide.Points, Curve=crv_2)  # -> Point, Parameter, Distance
larger = LargerThan(FirstNumber=crv_cp_2.Distance, SecondNumber=number_slider_2)  # -> LargerThan, OrEqualTo

divisions_2 = Slider(2, range=2..3)
dispatch = Dispatch(List=subsrf, DispatchPattern=smaller_2.SmallerThan)  # -> ListA, ListB
srf_3 = Surface(dispatch.ListA)
srf_4 = Surface(dispatch.ListB)
divide_2 = DivideDomain²(Domain=srf_3, UCount=divisions_2, VCount=divisions_2)
subsrf_2 = Isotrim(Surface=graft(srf_3), Domain=divide_2)  # -> flatten(Surface)
merge = Merge(Data1=subsrf_2, Data2=srf_4)  # -> flatten(Result)

threshold = Slider(15.582, range=1..50)
compensation = Slider(4.65, range=0..10)
area_2 = Area(Geometry=merge)  # -> Area, Centroid
neg_2 = Negative(Value=threshold)
addition = Addition(A=threshold, B=compensation)
crv_cp_3 = CurveClosestPoint(Point=area_2.Centroid, Curve=crv)  # -> Point, Parameter, Distance
larger_2 = LargerThan(FirstNumber=crv_cp_3.Distance, SecondNumber=addition)  # -> LargerThan, OrEqualTo
offset = Offset(Curve=crv, Distance=[threshold, neg_2], Plane=PlaneXY(0, 0, 0), Corners=1)
dispatch_2 = Dispatch(List=merge, DispatchPattern=larger_2.LargerThan)  # -> ListA, ListB
dispatch_3 = Dispatch(List=crv_cp_3.Distance, DispatchPattern=larger_2.LargerThan)  # -> ListA, ListB
preview_2 = CustomPreview(Geometry=offset, Shader=ColourSwatch(SwatchColor=RGB(255, 255, 255)))
srf_5 = Surface(dispatch_2.ListA)
bnd = Bounds(Numbers=flatten(dispatch_3.ListA))
edges = BrepEdges(Brep=srf_5)  # -> Naked, Interior, NonManifold
remap = RemapNumbers(Value=dispatch_3.ListA, Source=bnd, Target=Domain(0, 1))  # -> Mapped, Clipped
graph = GraphMapper(
    remap.Mapped,
    x0=0,
    x1=1,
    y0=0,
    y1=1,
    container_name="Bezier",
    cpx=[0, 0.3276592195, 1, 1],
    cpy=[0, 0.008406937122, 0.4350727201, 1])
join = JoinCurves(Curves=edges.Naked, Preserve=False)  # -> flatten(Curves)
pcen = PolygonCenter(Polyline=join)  # -> CenterV, CenterE, CenterA
dom = ConstructDomain(DomainStart=Slider(10, range=0..100), DomainEnd=Slider(100, range=0..100))
scale = Scale(Geometry=join, Center=pcen.CenterV, Factor=0.5)  # -> Geometry, Transform
remap_2 = RemapNumbers(Value=graph, Source=Domain(0, 1), Target=dom)  # -> Mapped, Clipped
Z = UnitZ(Factor=remap_2.Mapped)
extr = Extrude(Base=scale.Geometry, Direction=Z)
cap = CapHoles(Brep=extr)

neg_3 = Negative(Value=number_slider_2)
offset_2 = Offset(Curve=crv_2, Distance=[number_slider_2, neg_3], Plane=PlaneXY(0, 0, 0), Corners=1)
dispatch_4 = Dispatch(List=sdivide.Points, DispatchPattern=larger.LargerThan)  # -> ListA, ListB
dispatch_5 = Dispatch(List=crv_cp_2.Distance, DispatchPattern=larger.LargerThan)  # -> ListA, ListB
bnd_2 = Bounds(Numbers=flatten(dispatch_5.ListA))
pt = Point(dispatch_4.ListA)
remap_3 = RemapNumbers(Value=dispatch_5.ListA, Source=bnd_2, Target=Domain(0, 1))  # -> Mapped, Clipped
graph_2 = GraphMapper(
    remap_3.Mapped,
    x0=0,
    x1=1,
    y0=0,
    y1=1,
    container_name="Bezier",
    cpx=[0, 0.3276592195, 1, 1],
    cpy=[0, 0.008406937122, 0.4350727201, 1])
ramp = ValueList({"graph": 0, "sine": 1, "noise": 2}, selected="noise")
number_slider_3 = Slider(9.626, range=0..100)
number_slider_4 = Slider(30, range=0..100)
dom_2 = ConstructDomain(DomainStart=number_slider_3, DomainEnd=number_slider_4)
Z_2 = UnitZ(Factor=1)

preview_3 = CustomPreview(Geometry=offset_2, Shader=ColourSwatch(SwatchColor=RGB(255, 255, 255)))
perlin_2 = PerlinNoise(Values=pt, Time=Slider(0.451, range=0..10), Scale=Slider(0.01, range=0..0.05))
multiplication = Multiplication(A=graph_2, B=Slider(37.658, range=1..50))
bnd_3 = Bounds(Numbers=flatten(perlin_2))
remap_4 = RemapNumbers(Value=perlin_2, Source=bnd_3, Target=Domain(0, 1))  # -> Mapped, Clipped
sin = Sine(Value=multiplication)

filter = StreamFilter(Gate=ramp, Stream0=graph_2, Stream1=sin, Stream2=remap_4.Mapped)
remap_5 = RemapNumbers(Value=filter, Source=Domain(0, 1), Target=dom_2)  # -> Mapped, Clipped
line = LineSDL(Start=pt, Direction=Z_2, Length=remap_5.Mapped)

gradient_2 = Gradient(
    LowerLimit=number_slider_3,
    UpperLimit=number_slider_4,
    Parameter=remap_5.Mapped,
    stops=[0.0345: RGB(137, 205, 240), 0.98: RGB(14, 26, 76)])
end = EndPoints(Curve=line)  # -> Start, End
preview_4 = CustomPreview(Geometry=end.End, Shader=gradient_2)
