# Grasshopper definition 20161027_a300_mesh basics.gh (Grasshopper 0.9.76)
# Copyright: Co-de-iT
# plug-ins: MeshEdit Components, Human, Weaverbird, Noise 4D, Mesh Pipe

mesh = Mesh(<mesh referenced from the Rhino model>)
# voxelizer
mesh_2 = Mesh(<mesh referenced from the Rhino model>)
cell_y = Slider(12, range=1..50)
cell_x = Slider(27, range=1..50)
cell_z = Slider(10, range=1..50)
pt = Point([<point referenced from the Rhino model> x3])
mesh_3 = Mesh(<mesh referenced from the Rhino model>)
merge = Merge(
    Data1=ColourSwatch(SwatchColor=RGB(0, 0, 0)),
    Data2=ColourSwatch(SwatchColor=RGB(255, 0, 0)),
    Data3=ColourSwatch(SwatchColor=RGB(255, 234, 0)))
wbcatmullclark = WeaverbirdsCatmullClarkSubdivision(MeshCurves=mesh_3, Level=Slider(3, range=1..3), SmoothNakedEdges=1)
# deconstruct and reconstruct
mesh_4 = ValueList({"original": 0, "subdivided": 1}, selected="subdivided")
# mesh structure
mspray = MeshSpray(Mesh=mesh, Points=pt, Colours=merge, SprayMode=11)
Y = UnitY(Factor="-150")
xy = XYPlane(Origin=Point(0, 0, 0))
move = Move(Geometry=mesh_2, Motion=Y)  # -> Geometry, Transform
demesh = DeconstructMesh(Mesh=mspray)  # -> Vertices, Faces, Colours, Normals
# value list
# . to edit title right click and edit the first line in the context menu
# . to edit values double click on the right side
# stream filter
# (see component help)
filter = StreamFilter(Gate=mesh_4, Stream0=mesh_3, Stream1=wbcatmullclark)
prot = RotatePlane(Plane=xy, Angle=Slider(0, range=0..1.571))
# try both slider and knob
# (to edit values double click
# on the components)
X = UnitX(Factor=Slider(50, range=0..100))
multiplication = Multiplication(A=demesh.Normals, B=Slider(3.667, range=0..10))
# File template
# 
# © a3 2016 _ Creative Commons Attribution-NonCommercial-ShareAlike3.0 UnportedLicense.
number_slider = Slider(2.265, range=0..10)
bbox = BoundingBox(Content=move.Geometry, Plane=prot)  # -> Box, Box_2
move_2 = Move(Geometry=filter, Motion=X)  # -> Geometry, Transform
vdisex = VectorDisplayEx(Point=demesh.Vertices, Vector=multiplication, Colour=RGB(0, 0, 0), Width=2)
vertices = Panel(demesh.Vertices)
faces = Panel(demesh.Faces)
# naked edges
nakededge = MeshNakedEdge(Mesh=mesh)  # -> V, A, B
vertex_colors = Panel(demesh.Colours)
normals = Panel(demesh.Normals)

# ----
# compact form
demesh_2 = DeconstructMesh(Mesh=mspray)  # -> Vertices, Faces, Colours, Normals
deface = DeconstructFace(Face=graft(demesh_2.Faces))  # -> CornerA, CornerB, CornerC, CornerD
merge_2 = Merge(Data1=deface.CornerA, Data2=deface.CornerB, Data3=deface.CornerC, Data4=deface.CornerD)
item = ListItem(List=demesh_2.Vertices, Index=merge_2, Wrap=True)

# ----
# sort vertices by face
# extended form
demesh_3 = DeconstructMesh(Mesh=mspray)  # -> Vertices, Faces, Colours, Normals
deface_2 = DeconstructFace(Face=graft(demesh_3.Faces))  # -> CornerA, CornerB, CornerC, CornerD
item_2 = ListItem(List=demesh_3.Vertices, Index=deface_2.CornerA, Wrap=True)
item_3 = ListItem(List=demesh_3.Vertices, Index=deface_2.CornerB, Wrap=True)
item_4 = ListItem(List=demesh_3.Vertices, Index=deface_2.CornerC, Wrap=True)
item_5 = ListItem(List=demesh_3.Vertices, Index=deface_2.CornerD, Wrap=True)
merge_3 = Merge(Data1=item_2, Data2=item_3, Data3=item_4, Data4=item_5)

box_corners = BoxCorners(Box=bbox.Box)  # -> CornerA, CornerB, CornerC, CornerD, CornerE, CornerF, CornerG, CornerH
deplane = DeconstructPlane(Plane=prot)  # -> Origin, XAxis, YAxis, ZAxis
face = MeshFace(demesh.Faces)
demesh_4 = DeconstructMesh(Mesh=move_2.Geometry)  # -> Vertices, Faces, Colours, Normals
points = PointList(Points=demesh.Vertices, Size=number_slider)
item_6 = ListItem(List=nakededge.V, Index=nakededge.A, Wrap=True)
item_7 = ListItem(List=nakededge.V, Index=nakededge.B, Wrap=True)
ln = Line(StartPoint=box_corners.CornerA, EndPoint=box_corners.CornerD)
ln_2 = Line(StartPoint=box_corners.CornerA, EndPoint=box_corners.CornerE)
panel = Panel("""T{6;2;0} - triangular face

Q{6;13;1;2} - quadrangular face""")
ln_3 = Line(StartPoint=box_corners.CornerA, EndPoint=box_corners.CornerB)
pl_origin = PlaneOrigin(Base=prot, Origin=box_corners.CornerA)

# ----
# modify vertices position
number_slider_2 = Slider(0, range=0..2)
amplitude = Slider(3.119, range=0..10)
knob = ControlKnob(Decimals=2, Limit=True, Maximum=10, Minimum=0, Range=1, Value=0)
perlin = PerlinNoise(Values=demesh_4.Vertices, Time=knob, Scale=Slider(0.043, range=0..1))
multiplication_2 = Multiplication(A=perlin, B=amplitude)
amp = Amplitude(Vector=demesh_4.Normals, Amplitude=multiplication_2)
move_3 = Move(Geometry=demesh_4.Vertices, Motion=amp)  # -> Geometry, Transform

len = Length(Curve=ln_2)
len_2 = Length(Curve=ln_3)
len_3 = Length(Curve=ln)
ln_4 = Line(StartPoint=item_6, EndPoint=item_7)
# same story for the normals or colors...
item_8 = ListItem(List=demesh_2.Normals, Index=merge_2, Wrap=True)
division = Division(A=len, B=cell_z)
division_2 = Division(A=len_2, B=cell_x)
division_3 = Division(A=len_3, B=cell_y)
previewlw = CustomPreviewLineweights(Geometry=ln_4, Shader=ColourSwatch(SwatchColor=RGB(255, 255, 255)), Thickness="3", Absolute=False)
item_9 = ListItem(List=face, Index="0", Wrap=True)
item_10 = ListItem(List=face, Index="10", Wrap=True)
series = Series(Start=0, Step=division_2, Count=cell_x)
series_2 = Series(Start=0, Step=division_3, Count=cell_y)
series_3 = Series(Start=0, Step=division, Count=cell_z)
previewlw_2 = CustomPreviewLineweights(Geometry=[ln_3, ln, ln_2], Shader=ColourSwatch(SwatchColor=RGB(255, 255, 255)), Absolute=False)
amp_2 = Amplitude(Vector=deplane.XAxis, Amplitude=series)
deface_3 = DeconstructFace(Face=item_9)  # -> CornerA, CornerB, CornerC, CornerD
deface_4 = DeconstructFace(Face=item_10)  # -> CornerA, CornerB, CornerC, CornerD
move_4 = Move(Geometry=box_corners.CornerA, Motion=amp_2)  # -> Geometry, Transform
panel_2 = Panel(merge_3)
amp_3 = Amplitude(Vector=deplane.YAxis, Amplitude=series_2)
panel_3 = Panel(item)
merge_4 = Merge(Data1=deface_4.CornerA, Data2=deface_4.CornerB, Data3=deface_4.CornerC, Data4=deface_4.CornerD)
# actually getting the vertices
panel_4 = Panel(item_10)
# in triangular faces, vertex D index assumes the same value of C
vertices_indexes = Panel([deface_3.CornerA, deface_3.CornerB, deface_3.CornerC, deface_3.CornerD])
vertices_indexes_2 = Panel([deface_4.CornerA, deface_4.CornerB, deface_4.CornerC, deface_4.CornerD])
amp_4 = Amplitude(Vector=deplane.ZAxis, Amplitude=series_3)
move_5 = Move(Geometry=graft(move_4.Geometry), Motion=amp_3)  # -> Geometry, Transform

# ----
# base voxel
pt_2 = Point(Point(0, 0, 0))
voxel = Voxel(Points=pt_2, X=division_2, Y=division_3, Z=division)

item_11 = ListItem(List=demesh.Vertices, Index=merge_4, Wrap=True)
move_6 = Move(Geometry=graft(move_5.Geometry), Motion=amp_4)  # -> simplify(Geometry), Transform

# ----
# color gradient by noise value
panel_5 = Panel("1")
neg = Negative(Value=panel_5)
gradient = Gradient(
    LowerLimit=neg,
    UpperLimit=panel_5,
    Parameter=perlin,
    stops=[0: RGB(0, 128, 0), 0.5: RGB(255, 255, 0), 1: RGB(255, 0, 0)])

# ----
# show displacement from original position
ln_5 = Line(StartPoint=demesh_4.Vertices, EndPoint=move_3.Geometry)
# topology preservation: è possibile trasformare la mesh modificando la posizione dei vertici. Si modifica la geometria ma si preserva la topologia (numero di vertici e lista delle facce)
previewlw_3 = CustomPreviewLineweights(Geometry=ln_5, Shader=ColourSwatch(SwatchColor=RGB(255, 255, 255)), Absolute=False)

dots = DotDisplay(Point=item_11, Colour=RGB(0, 0, 0), Size=1)
pl_origin_2 = PlaneOrigin(Base=prot, Origin=move_6.Geometry)
orient = Orient(Geometry=voxel, Source=PlaneXY(0, 0, 0), Target=pl_origin_2)  # -> flatten(Geometry), Transform
colom = CollisionOneMany(Collider=orient.Geometry, Obstacles=move.Geometry)  # -> Collision, Index
conmesh = ConstructMesh(Vertices=move_3.Geometry, Faces=demesh_4.Faces, Colours=gradient)
dispatch = Dispatch(List=orient.Geometry, DispatchPattern=colom.Collision)  # -> ListA, ListB
mesh_5 = Mesh(dispatch.ListA)
mjoin = MeshJoin(Meshes=mesh_5)
previewlw_4 = CustomPreviewLineweights(Geometry=mjoin, Shader=ColourSwatch(SwatchColor=RGBA(0, 0, 0, 0)), Absolute=False)
previewmat = CustomPreviewMaterials(Geometry=mjoin, DiffuseColor=RGB(255, 255, 255))
mesh_6 = Mesh(<mesh referenced from the Rhino model>)
Y_2 = UnitY(Factor="-50")
# WeaverBird - Loop + Quad Split subdivision
move_7 = Move(Geometry=mesh_6, Motion=Y_2)  # -> Geometry, Transform
naked_edges = ValueList({"Fixed": 0, "Smooth": 1, "Corner fixed": 2}, selected="Smooth")
naked_edges_2 = ValueList({"Fixed": 0, "Smooth": 1, "Corner fixed": 2}, selected="Fixed")
naked_edges_3 = ValueList({"Fixed": 0, "Smooth": 1, "Corner fixed": 2}, selected="Smooth")
naked_edges_4 = ValueList({"Fixed": 0, "Smooth": 1, "Corner fixed": 2}, selected="Fixed")
naked_edges_5 = ValueList({"Fixed": 0, "Smooth": 1, "Corner fixed": 2}, selected="Smooth")
naked_edges_6 = ValueList({"Fixed": 0, "Smooth": 1, "Corner fixed": 2}, selected="Fixed")
naked_edges_7 = ValueList({"Fixed": 0, "Smooth": 1, "Corner fixed": 2}, selected="Smooth")
naked_edges_8 = ValueList({"Fixed": 0, "Smooth": 1, "Corner fixed": 2}, selected="Smooth")
# subdivision modeling
# insert your coarse mesh here and keep
# modeling in Rhino using the Gumball
# techniques to extrude edges, faces and modify them
pt_3 = Point(<point referenced from the Rhino model>)
# WeaverBird - Catmull-Clark + Quad Split subdivision
naked_edges_9 = ValueList({"Fixed": 0, "Smooth": 1, "Corner fixed": 2}, selected="Smooth")
# WeaverBird - Catmull-Clark subdivision
number_slider_3 = Slider(3, range=1..3)
naked_edges_10 = ValueList({"Fixed": 0, "Smooth": 1, "Corner fixed": 2}, selected="Fixed")
naked_edges_11 = ValueList({"Fixed": 0, "Smooth": 1, "Corner fixed": 2}, selected="Smooth")
naked_edges_12 = ValueList({"Fixed": 0, "Smooth": 1, "Corner fixed": 2}, selected="Fixed")
naked_edges_13 = ValueList({"Fixed": 0, "Smooth": 1, "Corner fixed": 2}, selected="Smooth")
mesh_7 = Mesh(<mesh referenced from the Rhino model>)
yz = YZPlane(Origin=pt_3)
xz = XZPlane(Origin=pt_3)
mesh_8 = Mesh(<mesh referenced from the Rhino model>)
X_2 = UnitX(Factor=Slider(50, range=0..100))
mesh_9 = Mesh(<mesh referenced from the Rhino model>)
move_8 = Move(Geometry=mesh_7, Motion=X_2)  # -> Geometry, Transform
# bake
number_slider_4 = Slider(50, range=0..100)
wbsplitquads = WeaverbirdsConstantQuadsSplitSubdivision(MeshCurves=move_7.Geometry, Level=Slider(1, range=1..3), SmoothNakedEdges=naked_edges_6)
wbloop = WeaverbirdsLoopSubdivision(MeshCurves=move_7.Geometry, Level=Slider(3, range=1..3), SmoothNakedEdges=naked_edges)
wbsplitquads_2 = WeaverbirdsConstantQuadsSplitSubdivision(MeshCurves=move_7.Geometry, Level=Slider(1, range=1..3), SmoothNakedEdges=naked_edges_2)
wbsplitquads_3 = WeaverbirdsConstantQuadsSplitSubdivision(MeshCurves=move_7.Geometry, Level=Slider(2, range=1..3), SmoothNakedEdges=naked_edges_4)
mirror = Mirror(Geometry=mesh_8, Plane=xz)  # -> Geometry, Transform
wbcatmullclark_2 = WeaverbirdsCatmullClarkSubdivision(MeshCurves=mesh_9, Level=number_slider_3, SmoothNakedEdges=naked_edges_9)
wbsplitquads_4 = WeaverbirdsConstantQuadsSplitSubdivision(MeshCurves=mesh_9, Level=Slider(1, range=1..3), SmoothNakedEdges=naked_edges_10)
wbsplitquads_5 = WeaverbirdsConstantQuadsSplitSubdivision(MeshCurves=mesh_9, Level=Slider(2, range=1..3), SmoothNakedEdges=naked_edges_12)
naked_edges_14 = ValueList({"Fixed": 0, "Smooth": 1, "Corner fixed": 2}, selected="Corner fixed")
multiplication_3 = Multiplication(A="50", B="2")
wbjoin = WeaverbirdsJoinMeshesAndWeld(Mesh=[mesh_8, mirror.Geometry], Weld=Toggle(True))
X_3 = UnitX(Factor=number_slider_4)
wbloop_2 = WeaverbirdsLoopSubdivision(MeshCurves=wbsplitquads, Level=Slider(1, range=1..3), SmoothNakedEdges=naked_edges_7)
previewmat_2 = CustomPreviewMaterials(Geometry=mirror.Geometry, DiffuseColor=RGB(255, 255, 255))
multiplication_4 = Multiplication(A="50", B="3")
multiplication_5 = Multiplication(A="50", B="4")
multiplication_6 = Multiplication(A="50", B="2")
multiplication_7 = Multiplication(A="50", B="5")
multiplication_8 = Multiplication(A="50", B="3")
multiplication_9 = Multiplication(A="50", B="4")
X_4 = UnitX(Factor=multiplication_3)
wbloop_3 = WeaverbirdsLoopSubdivision(MeshCurves=wbsplitquads_3, Level=Slider(1, range=1..3), SmoothNakedEdges=naked_edges_5)
wbloop_4 = WeaverbirdsLoopSubdivision(MeshCurves=wbsplitquads_2, Level=Slider(2, range=1..3), SmoothNakedEdges=naked_edges_3)
move_9 = Move(Geometry=wbjoin, Motion=X_3)  # -> Geometry, Transform
wbcatmullclark_3 = WeaverbirdsCatmullClarkSubdivision(MeshCurves=wbloop_2, Level=Slider(1, range=1..3), SmoothNakedEdges=naked_edges_8)
wbcatmullclark_4 = WeaverbirdsCatmullClarkSubdivision(MeshCurves=wbsplitquads_4, Level=Slider(2, range=1..3), SmoothNakedEdges=naked_edges_11)
wbcatmullclark_5 = WeaverbirdsCatmullClarkSubdivision(MeshCurves=wbsplitquads_5, Level=Slider(1, range=1..3), SmoothNakedEdges=naked_edges_13)
wbcatmullclark_6 = WeaverbirdsCatmullClarkSubdivision(MeshCurves=move_8.Geometry, Level=Slider(3, range=1..3), SmoothNakedEdges=naked_edges_14)
X_5 = UnitX(Factor=multiplication_4)
X_6 = UnitX(Factor=multiplication_5)
X_7 = UnitX(Factor=multiplication_7)
X_8 = UnitX(Factor=multiplication_6)
X_9 = UnitX(Factor=multiplication_8)
X_10 = UnitX(Factor=multiplication_9)

# ----
# sometimes WeaverBird's welding isn't enough,
# this makes sure vertices are welded (increase
# tolerance to weld also non coincident vertices),
# the following component unifies normals direction
weldvertices = MeshWeldVertices(Mesh=move_9.Geometry, Tolerance=0.01)  # -> RuntimeMessage, Mesh
unifynormals = MeshUnifyNormals(Mesh=weldvertices.Mesh)

move_10 = Move(Geometry=wbloop, Motion=X_4)  # -> Geometry, Transform
move_11 = Move(Geometry=wbloop_4, Motion=X_5)  # -> Geometry, Transform
move_12 = Move(Geometry=wbloop_3, Motion=X_6)  # -> Geometry, Transform
move_13 = Move(Geometry=wbcatmullclark_3, Motion=X_7)  # -> Geometry, Transform
move_14 = Move(Geometry=wbcatmullclark_2, Motion=X_8)  # -> Geometry, Transform
move_15 = Move(Geometry=wbcatmullclark_4, Motion=X_9)  # -> Geometry, Transform
move_16 = Move(Geometry=wbcatmullclark_5, Motion=X_10)  # -> Geometry, Transform
wbthicken = WeaverbirdsMeshThicken(MeshCurves=wbcatmullclark_6, Distance=Slider(0.127, range=0..1), OffsetType=0)
# < dual mesh
wbdual = WeaverbirdsDualGraph(MeshCurves=move_10.Geometry, DualMode=0)
previewlw_5 = CustomPreviewLineweights(
    Geometry=[move_10.Geometry, move_11.Geometry, move_12.Geometry, move_13.Geometry],
    Shader=ColourSwatch(SwatchColor=RGBA(56, 88, 92, 0)),
    Absolute=False)
previewmat_3 = CustomPreviewMaterials(Geometry=[move_10.Geometry, move_11.Geometry, move_12.Geometry, move_13.Geometry], DiffuseColor=RGB(255, 255, 255))
previewlw_6 = CustomPreviewLineweights(
    Geometry=[move_14.Geometry, move_15.Geometry, move_16.Geometry],
    Shader=ColourSwatch(SwatchColor=RGBA(56, 88, 92, 0)),
    Absolute=False)
previewmat_4 = CustomPreviewMaterials(Geometry=[move_14.Geometry, move_15.Geometry, move_16.Geometry], DiffuseColor=RGB(255, 255, 255))
pt_4 = Point([<point referenced from the Rhino model> x7])
# mesh patterning
panel_6 = Panel("100")
Y_3 = UnitY(Factor="50")
Y_4 = UnitY(Factor=panel_6)
move_17 = Move(Geometry=pt_4, Motion=Y_3)  # -> Geometry, Transform
move_18 = Move(Geometry=move_14.Geometry, Motion=Y_4)  # -> Geometry, Transform
lng = ListLength(List=move_17.Geometry)
demesh_5 = DeconstructMesh(Mesh=move_18.Geometry)  # -> Vertices, Faces, Colours, Normals
previewmat_5 = CustomPreviewMaterials(Geometry=move_18.Geometry, DiffuseColor=RGB(255, 255, 255))
random = Random(Range="-1 to 1", Number=lng, Seed=2)
multiplication_10 = Multiplication(A=demesh_5.Normals, B=Slider(0.297, range=0..10))
pcharge = PointCharge(Point=move_17.Geometry, Charge=Slider(0.138, range=0..1), Decay=2)
fspin = SpinForce(Plane=move_17.Geometry, Strength=random, Radius=Slider(10, range=1..10), Decay=2)
deface_5 = DeconstructFace(Face=graft(demesh_5.Faces))  # -> CornerA, CornerB, CornerC, CornerD
vdisex_2 = VectorDisplayEx(Point=demesh_5.Vertices, Vector=multiplication_10, Colour=RGB(0, 0, 0), Width=2)
mergef = MergeFields(Fields=flatten([fspin, pcharge]))
item_12 = ListItem(List=demesh_5.Vertices, Index=deface_5.CornerA, Wrap=True)
item_13 = ListItem(List=demesh_5.Vertices, Index=deface_5.CornerB, Wrap=True)
item_14 = ListItem(List=demesh_5.Vertices, Index=deface_5.CornerC, Wrap=True)
item_15 = ListItem(List=demesh_5.Vertices, Index=deface_5.CornerD, Wrap=True)
merge_5 = Merge(Data1=item_12, Data2=item_13, Data3=item_14, Data4=item_15)

evf = EvaluateField(Field=mergef, Point=merge_5)  # -> Tensor, Strength
# field based pattern
ln_6 = Line(StartPoint=item_12, EndPoint=item_14)
ln_7 = Line(StartPoint=item_13, EndPoint=item_15)
avr = Average(Input=evf.Tensor)
avr_2 = Average(Input=merge_5)
merge_6 = Merge(Data1=ln_6, Data2=ln_7)
amp_5 = Amplitude(Vector=avr, Amplitude=Slider(0.36, range=0..10))
angle = Angle(VectorA=merge_6, VectorB=amp_5)  # -> Angle, Reflex
vdisex_3 = VectorDisplayEx(Point=avr_2, Vector=amp_5, Colour=RGB(0, 0, 0), Width=2)
sort = SortList(Keys=angle.Angle, ValuesA=merge_6)  # -> Keys, ValuesA
item_16 = ListItem(List=sort.ValuesA, Index=0, Wrap=True)
previewlw_7 = CustomPreviewLineweights(Geometry=item_16, Shader=ColourSwatch(SwatchColor=RGB(196, 125, 255)), Thickness="2", Absolute=False)

# ----
# descent pattern
pdecon = Deconstruct(Point=merge_5)  # -> XComponent, YComponent, ZComponent
sort_2 = SortList(Keys=pdecon.ZComponent, ValuesA=merge_5)  # -> Keys, ValuesA
item_17 = ListItem(List=sort_2.ValuesA, Index=0, Wrap=True)  # -> Item1, Item
ln_8 = Line(StartPoint=item_17.Item1, EndPoint=item_17.Item)
previewlw_8 = CustomPreviewLineweights(Geometry=ln_8, Shader=ColourSwatch(SwatchColor=RGB(7, 11, 240)), Thickness="2", Absolute=False)
