# Grasshopper definition 20161027_a300_powercopy_mereology.gh (Grasshopper 0.9.76)
# Copyright: Co-de-iT
# plug-ins: Human, Weaverbird, Noise 4D

loft_types = Panel("""normal (closed)
normal
loose
tight
straight sections
developable
uniform""")
adjust_seams = BooleanToggle(False)
closed = BooleanToggle(True)
closed_2 = Panel("""true
false
false
false
false
false
false""")
# mesh components
loft_types_2 = Panel("""0
0
1
2
3
4
5""")
# loft types
crv = Curve([<curve referenced from the Rhino model> x7])
crv_2 = Curve([<curve referenced from the Rhino model> x5])
# File template
# 
# © a3 2015 _ Creative Commons Attribution-NonCommercial-ShareAlike3.0 UnportedLicense.
# powercopy on NURBS
crv_3 = Curve([<curve referenced from the Rhino model> x7])
loft_opt = LoftOptions(Closed=closed, Adjust=adjust_seams, Rebuild=0, Refit=0, Type=Slider(2, range=0..5))
loft_opt_2 = LoftOptions(Closed=False, Adjust=False, Rebuild=0, Refit=0, Type=Slider(2, range=0..5))
loft_opt_3 = LoftOptions(Closed=closed_2, Adjust=False, Rebuild=0, Refit=0, Type=loft_types_2)  # -> graft(Options)
lng = ListLength(List=loft_types_2)
loft = Loft(Curves=crv_3, Options=loft_opt_2)
loft_2 = Loft(Curves=crv_2, Options=loft_opt)
loft_3 = Loft(Curves=crv, Options=loft_opt_3)
brep = Brep(loft)
srf = Surface(loft_2)
series = Series(Start=0, Step="150", Count=lng)
brep_2 = Brep(loft_2)
debrep = DeconstructBrep(Brep=brep)  # -> Faces, Edges, Vertices
neg = Negative(Value="150")
debrep_2 = DeconstructBrep(Brep=brep_2)  # -> Faces, Edges, Vertices
Y = UnitY(Factor=series)
X = UnitX(Factor=neg)
srf_2 = Surface(reparameterize(debrep.Faces))
srf_3 = Surface(reparameterize(debrep_2.Faces))
divide = DivideDomain²(Domain=srf_2, UCount=Slider(42, range=2..50), VCount=Slider(25, range=1..50))
addition = Addition(A=Y, B=X)  # -> graft(Result)
subsrf = Isotrim(Surface=graft(srf_2), Domain=divide)  # -> reparameterize(Surface)
move = Move(Geometry=loft_3, Motion=addition)  # -> flatten(Geometry), Transform
pt = Point(Point(0.5, 0.5, 0))
pt_2 = Point(<point referenced from the Rhino model>)
evalsrf = EvaluateSurface(Surface=subsrf, Point=pt)  # -> Point, Normal, Frame
number_slider = Slider(28, range=2..50)
X_2 = UnitX(Factor="300")
item = ListItem(List=move.Geometry, Index="1", Wrap=True)
vec2pt = Vector2Pt(PointA=evalsrf.Point, PointB=pt_2, Unitize=False)  # -> Vector, Length
equalize_length = Panel("""true
false""")
move_2 = Move(Geometry=srf_3, Motion=X_2)  # -> Geometry, Transform
mesh_uv = MeshSurface(Surface=srf_3, UCount=Slider(20, range=2..50), VCount=Slider(15, range=2..50), Overhang=True, Equalize=Toggle(False))
smaller = SmallerThan(FirstNumber=vec2pt.Length, SecondNumber=Slider(63.65, range=0..100))  # -> SmallerThan, OrEqualTo
mesh_uv_2 = MeshSurface(Surface=item, UCount=number_slider, VCount=number_slider, Overhang=True, Equalize=equalize_length)
# lamellae
number_slider_2 = Slider(50, range=2..50)
lng_2 = ListLength(List=equalize_length)
bool = Boolean(closed)
dispatch = Dispatch(List=subsrf, DispatchPattern=smaller.SmallerThan)  # -> ListA, ListB
# vecs
dispatch_2 = Dispatch(List=vec2pt.Vector, DispatchPattern=smaller.SmallerThan)  # -> ListA, ListB
# lenghts
dispatch_3 = Dispatch(List=vec2pt.Length, DispatchPattern=smaller.SmallerThan)  # -> ListA, ListB
crv_4 = Curve(<curve referenced from the Rhino model>)
series_2 = Series(Start="150", Step="150", Count=lng_2)
sdivide = DivideSurface(Surface=move_2.Geometry, UCount=number_slider_2, VCount=Slider(30, range=2..50))  # -> Points, Normals, Parameters
demesh = DeconstructMesh(Mesh=mesh_uv)  # -> Vertices, Faces, Colours, Normals
neg_2 = Negative(Value=series_2)
preview = CustomPreview(Geometry=crv_4, Shader=ColourSwatch(SwatchColor=RGB(255, 255, 255)))
flip = FlipMatrix(Data=sdivide.Points)
X_3 = UnitX(Factor=neg_2)
move_3 = Move(Geometry=mesh_uv_2, Motion=X_3)  # -> Geometry, Transform
crv_cp = CurveClosestPoint(Point=demesh.Vertices, Curve=crv_4)  # -> Point, Parameter, Distance
# attractor point (unused)
pt_3 = Point(<point referenced from the Rhino model>)
intcrv = Interpolate(Vertices=sdivide.Points, Degree=3, Periodic=False, KnotStyle=1)  # -> Curve, Length, Domain
intcrv_2 = Interpolate(Vertices=flip, Degree=3, Periodic=False, KnotStyle=1)  # -> Curve, Length, Domain

viewer = ParamViewer(intcrv.Curve)
# adjust curve count in case of
# closed surface (cull last)
neg_3 = Negative(Value=bool)
cull_i = CullIndex(List=viewer, Indices=neg_3, Wrap=True)
branch = TreeBranch(Tree=intcrv.Curve, Path=cull_i, MaintainPaths=True)

# ----
# mesh displace
number_slider_3 = Slider(100, range=2..100)
bnd = Bounds(Numbers=crv_cp.Distance)
srf_4 = Surface(dispatch.ListA)
# attractor curve
crv_5 = Curve(<curve referenced from the Rhino model>)
bnd_2 = Bounds(Numbers=dispatch_3.ListA)
remap = RemapNumbers(Value=crv_cp.Distance, Source=bnd, Target=Domain(0, 1))  # -> Mapped, Clipped
pt_4 = Point(Point(0.5, 0.5, 0))
vec2pt_2 = Vector2Pt(PointA=sdivide.Points, PointB=pt_3, Unitize=False)  # -> Vector, Length
sdivide_2 = DivideSurface(Surface=srf_4, UCount="1", VCount="1")  # -> Points, Normals, Parameters
graph = GraphMapper(
    remap.Mapped,
    x0=0,
    x1=1,
    y0=0,
    y1=1,
    container_name="Bezier",
    cpx=[0, 0.6869577765, 0.4736239612, 1],
    cpy=[1, 0.7687473297, 0.1137485504, 0.07642745972])
filter = StreamFilter(Gate=bool, Stream0=intcrv.Curve, Stream1=branch)
remap_2 = RemapNumbers(Value=dispatch_3.ListA, Source=bnd_2, Target=Domain(0, 1))  # -> graft(Mapped), Clipped
evalsrf_2 = EvaluateSurface(Surface=srf_4, Point=pt_4)  # -> graft(Point), Normal, Frame
Y_2 = UnitY(Factor=Slider(0, range=-150..150))
X_4 = UnitX(Factor=Slider(0, range=-150..150))
mesh_uv_3 = MeshSurface(Surface=srf_3, UCount=number_slider_3, VCount=Slider(100, range=2..100), Overhang=True, Equalize=Toggle(False))
smaller_2 = SmallerThan(FirstNumber=vec2pt_2.Length, SecondNumber=Slider(61.25, range=0..100))  # -> SmallerThan, OrEqualTo
X_5 = UnitX(Factor="450")
pshift = ShiftPaths(Data=sdivide_2.Points, Offset=-1)
addition_2 = Addition(A=X_4, B=Y_2)
multiplication = Multiplication(A=graph, B=Slider(22.15, range=0..50))
move_4 = Move(Geometry=mesh_uv_3, Motion=X_5)  # -> Geometry, Transform
graph_2 = GraphMapper(
    remap_2.Mapped,
    x0=0,
    x1=1,
    y0=0,
    y1=1,
    container_name="Bezier",
    cpx=[0, 0, 0.7126197219, 1],
    cpy=[0.853589952, 0.2423080206, 0.535230577, 0.01666653156])
graph_3 = GraphMapper(
    remap_2.Mapped,
    x0=0,
    x1=1,
    y0=0,
    y1=1,
    container_name="Bezier",
    cpx=[0, 0.4887708426, 0.7112299204, 1],
    cpy=[1, 0.9782049656, 0.3474355936, 0.03974330425])
divide_2 = DivideCurve(Curve=filter, Count=Slider(20, range=2..100), Kinks=False)  # -> Points, Tangents, Parameters
move_5 = Move(Geometry=crv_5, Motion=addition_2)  # -> Geometry, Transform

srf_5 = Surface(dispatch.ListA)  # disabled
panel = Panel("1")  # disabled
sdivide_3 = DivideSurface(Surface=srf_5, UCount=panel, VCount=panel)  # -> Points, Normals, Parameters; disabled
pshift_2 = ShiftPaths(Data=sdivide_3.Points, Offset=-1)  # disabled
panel_2 = Panel("0")  # disabled
panel_3 = Panel("1")  # disabled
panel_4 = Panel("2")  # disabled
panel_5 = Panel("3")  # disabled
item_2 = ListItem(List=pshift_2, Index=panel_2, Wrap=True)  # disabled
item_3 = ListItem(List=pshift_2, Index=panel_3, Wrap=True)  # disabled
item_4 = ListItem(List=pshift_2, Index=panel_4, Wrap=True)  # disabled
item_5 = ListItem(List=pshift_2, Index=panel_5, Wrap=True)  # disabled
pl_3pt = Plane3Pt(PointA=item_2, PointB=item_3, PointC=item_4)  # disabled
cp = PlaneClosestPoint(Point=item_5, Plane=pl_3pt)  # -> Point, UVPoint, Distance; disabled
srf4pt = _4PointSurface(CornerA=item_2, CornerB=item_3, CornerC=cp.Point, CornerD=item_4)  # disabled
srf4pt_2 = _4PointSurface(CornerA=item_5, CornerB=cp.Point, CornerC=item_3)  # disabled
srf4pt_3 = _4PointSurface(CornerA=item_5, CornerB=cp.Point, CornerC=item_4)  # disabled
srf_6 = Surface(dispatch.ListB)  # disabled
swatch = ColourSwatch(SwatchColor=RGB(28, 28, 28))  # disabled
swatch_2 = ColourSwatch(SwatchColor=RGB(255, 0, 0))  # disabled
preview_2 = CustomPreview(Geometry=[srf4pt, srf_6], Shader=swatch)  # disabled
preview_3 = CustomPreview(Geometry=[srf4pt_2, srf4pt_3], Shader=swatch_2)  # disabled

item_6 = ListItem(List=pshift, Index="0", Wrap=True)
item_7 = ListItem(List=pshift, Index="1", Wrap=True)
item_8 = ListItem(List=pshift, Index="2", Wrap=True)
item_9 = ListItem(List=pshift, Index="3", Wrap=True)
amp = Amplitude(Vector=demesh.Normals, Amplitude=multiplication)
demesh_2 = DeconstructMesh(Mesh=move_4.Geometry)  # -> Vertices, Faces, Colours, Normals
# attractor curve
crv_6 = Curve(<curve referenced from the Rhino model>)
preview_4 = CustomPreview(Geometry=move_5.Geometry, Shader=ColourSwatch(SwatchColor=RGB(255, 255, 255)))
preview_5 = CustomPreview(Geometry=crv_6, Shader=ColourSwatch(SwatchColor=RGB(255, 15, 127)))
flip_2 = FlipMatrix(Data=divide_2.Points)
merge = Merge(Data1=item_6, Data2=item_7, Data3=item_9, Data4=item_8)
move_6 = Move(Geometry=demesh.Vertices, Motion=amp)  # -> Geometry, Transform
deface = DeconstructFace(Face=demesh.Faces)  # -> CornerA, CornerB, CornerC, CornerD
deface_2 = DeconstructFace(Face=demesh.Faces)  # -> graft(CornerA), graft(CornerB), graft(CornerC), graft(CornerD)
crv_cp_2 = CurveClosestPoint(Point=demesh_2.Vertices, Curve=move_5.Geometry)  # -> Point, Parameter, Distance
crv_cp_3 = CurveClosestPoint(Point=flip_2, Curve=crv_6)  # -> Point, Parameter, Distance
ln = Line(StartPoint=item_6, EndPoint=item_9)
multiplication_2 = Multiplication(A=graph_3, B=Slider(10.25, range=0..100))
shift = ShiftList(List=flip_2, Shift=1, Wrap=True)

# ----
# state A
mesh = Mesh(<mesh referenced from the Rhino model>)
# state B
mesh_2 = Mesh(<mesh referenced from the Rhino model>)

bnd_3 = Bounds(Numbers=crv_cp_2.Distance)
pline = PolyLine(Vertices=merge, Closed=Toggle(True))
# second mesh
conmesh = ConstructMesh(Vertices=move_6.Geometry, Faces=demesh.Faces)
remap_3 = RemapNumbers(Value=crv_cp_2.Distance, Source=bnd_3, Target=Domain(0, 1))  # -> Mapped, Clipped
demesh_3 = DeconstructMesh(Mesh=mesh)  # -> Vertices, Faces, Colours, Normals
demesh_4 = DeconstructMesh(Mesh=mesh_2)  # -> Vertices, Faces, Colours, Normals
amp_2 = Amplitude(Vector=graft(dispatch_2.ListA), Amplitude=multiplication_2)
item_10 = ListItem(List=demesh.Vertices, Index=deface.CornerA, Wrap=True)
item_11 = ListItem(List=demesh.Vertices, Index=deface.CornerB, Wrap=True)
item_12 = ListItem(List=demesh.Vertices, Index=deface.CornerC, Wrap=True)
item_13 = ListItem(List=demesh.Vertices, Index=deface.CornerD, Wrap=True)
item_14 = ListItem(List=move_6.Geometry, Index=deface.CornerA, Wrap=True)
item_15 = ListItem(List=move_6.Geometry, Index=deface.CornerB, Wrap=True)
item_16 = ListItem(List=move_6.Geometry, Index=deface.CornerC, Wrap=True)
item_17 = ListItem(List=move_6.Geometry, Index=deface.CornerD, Wrap=True)
frequency = Slider(5, range=0..100)
item_18 = ListItem(List=demesh.Vertices, Index=deface_2.CornerA, Wrap=True)
item_19 = ListItem(List=demesh.Vertices, Index=deface_2.CornerB, Wrap=True)
item_20 = ListItem(List=demesh.Vertices, Index=deface_2.CornerC, Wrap=True)
item_21 = ListItem(List=demesh.Vertices, Index=deface_2.CornerD, Wrap=True)
amplitude = Slider(1.5, range=0..50)
exponent = Slider(2, range=1..3)
vec2pt_3 = Vector2Pt(PointA=flip_2, PointB=shift, Unitize=False)  # -> Vector, Length
graph_4 = GraphMapper(
    remap_3.Mapped,
    x0=0,
    x1=1,
    y0=0,
    y1=1,
    container_name="Bezier",
    cpx=[0, 0.5434782505, 0.289855063, 1],
    cpy=[1, 0.59375, 0.171875, 0.07642745972])
# max
vdisex = VectorDisplayEx(Point=flip_2, Vector=vec2pt_3.Vector, Colour=RGB(0, 0, 0), Width=2)
scale = Scale(Geometry=pline, Center=evalsrf_2.Point, Factor=graph_2)  # -> Geometry, Transform
range = Range(Domain=Domain(0, 1), Steps=Slider(9, range=1..20))  # -> graft(Range)
avr = Average(Input=[item_18, item_19, item_20, item_21])
ln_2 = Line(StartPoint=demesh_3.Vertices, EndPoint=demesh_4.Vertices)
move_7 = Move(Geometry=scale.Geometry, Motion=amp_2)  # -> Geometry, Transform
crv_cp_4 = CurveClosestPoint(Point=avr, Curve=crv_4)  # -> Point, Parameter, Distance
multiplication_3 = Multiplication(A=graph_4, B=frequency)
# morphed box cage
tbox = TwistedBox(
    CornerA=item_10,
    CornerB=item_11,
    CornerC=item_12,
    CornerD=item_13,
    CornerE=item_14,
    CornerF=item_15,
    CornerG=item_16,
    CornerH=item_17)
pow = Power(A=multiplication_3, B=exponent)
eval = EvaluateCurve(Curve=reparameterize(ln_2), Parameter=range)  # -> Point, Tangent, Angle
bnd_4 = Bounds(Numbers=flatten(crv_cp_4.Distance))
merge_2 = Merge(Data1=pline, Data2=move_7.Geometry)
gradient = Gradient(LowerLimit=0, UpperLimit=1, Parameter=flatten(range), stops=[0.0345: RGB(237, 249, 255), 0.98: RGB(14, 26, 76)])
remap_4 = RemapNumbers(Value=crv_cp_4.Distance, Source=bnd_4, Target=Domain(0, 1))  # -> Mapped, Clipped
sin = Sine(Value=pow)
abs = Absolute(Value=sin)
previewlw = CustomPreviewLineweights(Geometry=tbox, Shader=ColourSwatch(SwatchColor=RGB(255, 255, 255)), Absolute=False)
conmesh_2 = ConstructMesh(Vertices=eval.Point, Faces=demesh_3.Faces)
srf_7 = Surface(dispatch.ListB)
graph_5 = GraphMapper(
    remap_4.Mapped,
    x0=0,
    x1=1,
    y0=0,
    y1=1,
    container_name="Bezier",
    cpx=[0, 0.6869577765, 0.4736239612, 1],
    cpy=[1, 0.7687473297, 0.1137485504, 0.07642745972])
loft_4 = Loft(Curves=merge_2, Options={Adjust=False, Closed=False, LoftEnds=0, LoftSimp=0, LoftType=3, Rebuild=10, Refit=0.01})

# ----
# mesh components
mesh_3 = Mesh(<mesh referenced from the Rhino model>)
mesh_4 = Mesh(<mesh referenced from the Rhino model>)

Z = UnitZ(Factor=1)
preview_6 = CustomPreview(Geometry=srf_7, Shader=ColourSwatch(SwatchColor=RGB(28, 28, 28)))
multiplication_4 = Multiplication(A=sin, B=amplitude)
amp_3 = Amplitude(Vector=demesh_2.Normals, Amplitude=multiplication_4)
move_8 = Move(Geometry=demesh_2.Vertices, Motion=amp_3)  # -> Geometry, Transform
Z_2 = UnitZ(Factor=1)
previewmat = CustomPreviewMaterials(Geometry=flatten(conmesh_2), DiffuseColor=gradient)
preview_7 = CustomPreview(Geometry=loft_4, Shader=ColourSwatch(SwatchColor=RGB(92, 108, 130)))
eval_2 = EvaluateCurve(Curve=ln_2, Parameter=graph_5)  # -> Point, Tangent, Angle
swatch_3 = ColourSwatch(SwatchColor=RGB(119, 137, 153))
conmesh_3 = ConstructMesh(Vertices=move_8.Geometry, Faces=demesh_2.Faces)
bbox = BoundingBox(Content=mesh_3, Plane=PlaneXY(0, 0, 0))  # -> Box, Box_2
bbox_2 = BoundingBox(Content=mesh_4, Plane=PlaneXY(0, 0, 0))  # -> Box, Box_2

# ----
# section
crv_7 = Curve(<curve referenced from the Rhino model>)
pt_5 = Point(<point referenced from the Rhino model>)
xy = XYPlane(Origin=pt_5)
preview_8 = CustomPreview(
    Geometry=crv_7,
    Shader={ambient=RGB(0, 0, 0), diffuse=RGB(255, 105, 180), emission=RGB(76, 32, 54), shine=0.5, specular=RGB(255, 255, 255), transparency=0})

conmesh_4 = ConstructMesh(Vertices=eval_2.Point, Faces=demesh_3.Faces)  # -> flatten(Mesh)
morph = BoxMorph(Geometry=mesh_3, Reference=bbox.Box, Target=tbox)
morph_2 = BoxMorph(Geometry=mesh_4, Reference=bbox_2.Box, Target=tbox)
previewmat_2 = CustomPreviewMaterials(Geometry=conmesh_3, DiffuseColor=swatch_3)
preview_9 = CustomPreview(Geometry=conmesh_3, Shader=swatch_3)
bbox_3 = BoundingBox(Content=conmesh_4, Plane=PlaneXY(0, 0, 0))  # -> Box, Box_2
wbjoin = WeaverbirdsJoinMeshesAndWeld(Mesh=morph, Weld=Toggle(True))
wbjoin_2 = WeaverbirdsJoinMeshesAndWeld(Mesh=morph_2, Weld=Toggle(True))
Y_3 = UnitY(Factor="150")
Y_4 = UnitY(Factor="300")
morph_3 = BoxMorph(Geometry=conmesh_4, Reference=bbox_3.Box, Target=tbox)
move_9 = Move(Geometry=wbjoin, Motion=Y_3)  # -> Geometry, Transform
move_10 = Move(Geometry=wbjoin_2, Motion=Y_4)  # -> Geometry, Transform
wbjoin_3 = WeaverbirdsJoinMeshesAndWeld(Mesh=morph_3, Weld=Toggle(True))
gradient_2 = Gradient(LowerLimit=0, UpperLimit=1, Parameter=flatten(graph_5), stops=[0.0345: RGB(237, 249, 255), 0.98: RGB(14, 26, 76)])
Y_5 = UnitY(Factor="450")
move_11 = Move(Geometry=morph_3, Motion=Y_5)  # -> Geometry, Transform
previewmat_3 = CustomPreviewMaterials(Geometry=move_9.Geometry, DiffuseColor=RGB(255, 255, 255))
previewmat_4 = CustomPreviewMaterials(Geometry=move_10.Geometry, DiffuseColor=RGB(255, 255, 255))
move_12 = Move(Geometry=wbjoin_3, Motion=Y_5)  # -> Geometry, Transform
previewmat_5 = CustomPreviewMaterials(Geometry=move_12.Geometry, DiffuseColor=RGB(255, 255, 255))
wbcatmullclark = WeaverbirdsCatmullClarkSubdivision(Level=Slider(2, range=1..3), SmoothNakedEdges=1)  # disabled
previewmat_6 = CustomPreviewMaterials(Geometry=move_11.Geometry, DiffuseColor=gradient_2)
# Truchet tiles pattern
crv_8 = Curve([<curve referenced from the Rhino model> x7])
loft_5 = Loft(Curves=crv_8, Options={Adjust=False, Closed=False, LoftEnds=0, LoftSimp=0, LoftType=0, Rebuild=10, Refit=0.01})
wbcatmullclark_2 = WeaverbirdsCatmullClarkSubdivision(Level=Slider(2, range=1..3), SmoothNakedEdges=1)  # disabled
srf_8 = Surface(reparameterize(loft_5))
mesh_uv_4 = MeshSurface(Surface=srf_8, UCount=Slider(50, range=5..100), VCount=Slider(50, range=5..100), Overhang=True, Equalize=Toggle(True))
Y_6 = UnitY(Factor="150")
move_13 = Move(Geometry=mesh_uv_4, Motion=Y_6)  # -> Geometry, Transform
wbfacepolys = WeaverbirdsFacePolylines(Mesh=move_13.Geometry)
explode = Explode(Curve=wbfacepolys, Recursive=True)  # -> Segments, Vertices
curvepoint = PointOnCurve(explode.Segments, parameter=0.5)
item_22 = ListItem(List=curvepoint, Index="0", Wrap=True)
item_23 = ListItem(List=curvepoint, Index="1", Wrap=True)
item_24 = ListItem(List=curvepoint, Index="2", Wrap=True)
item_25 = ListItem(List=curvepoint, Index="3", Wrap=True)
avr_2 = Average(Input=curvepoint)
ln_3 = Line(StartPoint=item_22, EndPoint=item_23)
ln_4 = Line(StartPoint=item_23, EndPoint=item_24)
ln_5 = Line(StartPoint=item_24, EndPoint=item_25)
threshold = Slider(0, range=-1..1)
ln_6 = Line(StartPoint=item_22, EndPoint=item_25)
merge_3 = Merge(Data1=ln_6, Data2=ln_4)
merge_4 = Merge(Data1=ln_3, Data2=ln_5)
perlin = PerlinNoise(Values=avr_2, Time=Slider(6.445, range=0..10), Scale=Slider(0.02, range=0..0.1))
gradient_3 = Gradient(LowerLimit="-1", UpperLimit=1, Parameter=perlin, stops=[0: RGB(0, 0, 0), 1: RGB(255, 255, 255)])
smaller_3 = SmallerThan(FirstNumber=perlin, SecondNumber=threshold)  # -> SmallerThan, OrEqualTo
dispatch_4 = Dispatch(DispatchPattern=[True, False])  # -> ListA, ListB
weave = Weave(Pattern=smaller_3.SmallerThan, Stream0=merge_4, Stream1=merge_3, NullGaps=False)
weave_2 = Weave(Pattern=smaller_3.SmallerThan, Stream0=merge_3, Stream1=merge_4, NullGaps=False)
dots = DotDisplay(Point=avr_2, Colour=gradient_3, Size=Slider(2.2, range=1..10))
previewlw_2 = CustomPreviewLineweights(Geometry=weave, Shader=ColourSwatch(SwatchColor=RGB(255, 255, 255)), Absolute=False)
previewlw_3 = CustomPreviewLineweights(Geometry=weave_2, Shader=ColourSwatch(SwatchColor=RGB(79, 79, 79)), Absolute=False)

max_rad = Slider(84.25, range=0..100)
# rotation by attractor curve, with min and max clamp values
min_rad = Slider(12.949, range=0..100)
number_slider_4 = Slider(0.553, range=0..3.142)
number_slider_5 = Slider(2.104, range=0..3.142)
dom = ConstructDomain(DomainStart=number_slider_4, DomainEnd=number_slider_5)

min = Minimum(A=crv_cp_3.Distance, B=max_rad)
# min
max = Maximum(A=min, B=min_rad)

bnd_5 = Bounds(Numbers=flatten(max))
# max
# min
remap_5 = RemapNumbers(Value=max, Source=bnd_5, Target=dom)  # -> Mapped, Clipped
neg_4 = Negative(Value=remap_5.Mapped)
gradient_4 = Gradient(
    LowerLimit=number_slider_4,
    UpperLimit=number_slider_5,
    Parameter=remap_5.Mapped,
    stops=[0: RGB(0, 0, 0), 1: RGB(255, 255, 255)])

# ----
# rotate planes
vrot = Rotate(Vector=vec2pt_3.Vector, Axis=Z, Angle=neg_4)
vrot_2 = Rotate(Vector=vrot, Axis=Z_2, Angle="PI*.5")
pl = ConstructPlane(Origin=flip_2, XAxis=vrot_2, YAxis=vrot)
# check rotation direction
vdisex_2 = VectorDisplayEx(Point=flip_2, Vector=vrot, Colour=gradient_4, Width=2)
# orient section
orient = Orient(Geometry=crv_7, Source=xy, Target=pl)  # -> simplify(Geometry), Transform
flip_3 = FlipMatrix(Data=orient.Geometry)
loft_6 = Loft(Curves=flip_3, Options={Adjust=False, Closed=False, LoftEnds=0, LoftSimp=0, LoftType=0, Rebuild=10, Refit=0.01})
cap = CapHoles(Brep=loft_6)
previewmat_7 = CustomPreviewMaterials(Geometry=cap, DiffuseColor=RGB(255, 255, 255))
previewlw_4 = CustomPreviewLineweights(Geometry=cap, Shader=ColourSwatch(SwatchColor=RGBA(36, 36, 36, 0)), Absolute=False)
