# Grasshopper definition 20161103_a300_cage edit.gh (Grasshopper 0.9.76)
# Copyright: Co-de-iT

crv = Curve(<curve referenced from the Rhino model>)
crv_2 = Curve(<curve referenced from the Rhino model>)
fixed_sections = Slider(7, range=2..100)
variable_sections = Slider(21, range=2..100)
number_slider = Slider(1, range=0..1)
addition = Addition(A=fixed_sections, B=variable_sections)
dom = ConstructDomain(DomainStart=number_slider, DomainEnd=Slider(0.362, range=0..1))
area = Area(Geometry=crv_2)  # -> Area, Centroid
repeat = RepeatData(Data=number_slider, Length=fixed_sections)
pframes = PerpFrames(Curve=crv, Count=addition, Align=True)  # -> Frames, Parameters
range = Range(Domain=dom, Steps=variable_sections)
# Cage Edit - shape generation
# 
# © a3 2016 _ Creative Commons Attribution-NonCommercial-ShareAlike3.0 UnportedLicense.
lng = ListLength(List=pframes.Frames)
merge = Merge(Data1=repeat, Data2=range)
panel = Panel(lng)
scale = Scale(Geometry=crv_2, Center=area.Centroid, Factor=range)  # -> Geometry, Transform
scale_nu = ScaleNU(Geometry=crv_2, Plane=area.Centroid, ScaleX=1, ScaleY=merge, ScaleZ=1)  # -> Geometry, Transform
orient = Orient(Geometry=scale_nu.Geometry, Source=area.Centroid, Target=pframes.Frames)  # -> Geometry, Transform
loft = Loft(Curves=orient.Geometry, Options={Adjust=False, Closed=False, LoftEnds=0, LoftSimp=0, LoftType=0, Rebuild=10, Refit=0.01})
