# Grasshopper definition 20161103_a301_transitions.gh (Grasshopper 0.9.76)
# Copyright: Co-de-iT
# plug-ins: Human, Weaverbird

crv = Curve([<curve referenced from the Rhino model> x4])
crv_2 = Curve([<curve referenced from the Rhino model> x4])

crv_3 = Curve(<curve referenced from the Rhino model>)
crv_4 = Curve(<curve referenced from the Rhino model>)

thickness = Slider(5, range=0..20)
spacing = Slider(1, range=0..10)
items = Slider(50, range=2..50)
# tween curve
crv_5 = Curve(<curve referenced from the Rhino model>)
crv_6 = Curve(<curve referenced from the Rhino model>)
# tween mesh
mesh = Mesh(<mesh referenced from the Rhino model>)
mesh_2 = Mesh(<mesh referenced from the Rhino model>)
number_slider = Slider(5, range=2..20)
cp = ControlPoints(Curve=crv)  # -> Points, Weights, Knots
cp_2 = ControlPoints(Curve=crv_2)  # -> Points, Weights, Knots
move = Move(Geometry=crv_5, Motion="-250,0")  # -> Geometry, Transform
move_2 = Move(Geometry=crv_6, Motion="-50,0")  # -> Geometry, Transform
# File template
# 
# © a3 2016 _ Creative Commons Attribution-NonCommercial-ShareAlike3.0 UnportedLicense.
demesh = DeconstructMesh(Mesh=mesh)  # -> Vertices, Faces, Colours, Normals
demesh_2 = DeconstructMesh(Mesh=mesh_2)  # -> Vertices, Faces, Colours, Normals
addition = Addition(A=thickness, B=spacing)
multiplication = Multiplication(A=addition, B=items)
X = UnitX(Factor=thickness)
X_2 = UnitX(Factor=multiplication)
ln = Line(StartPoint=cp.Points, EndPoint=cp_2.Points)
cp_3 = ControlPoints(Curve=move.Geometry)  # -> Points, Weights, Knots
cp_4 = ControlPoints(Curve=move_2.Geometry)  # -> Points, Weights, Knots
move_3 = Move(Geometry=crv_4, Motion=X)  # -> Geometry, Transform
previewlw = CustomPreviewLineweights(Geometry=move.Geometry, Shader=ColourSwatch(SwatchColor=RGB(255, 255, 255)), Absolute=False)
previewlw_2 = CustomPreviewLineweights(Geometry=move_2.Geometry, Shader=ColourSwatch(SwatchColor=RGB(0, 0, 0)), Absolute=False)
move_4 = Move(Geometry=crv_3, Motion=X_2)  # -> Geometry, Transform
range = Range(Domain=Domain(0, 1), Steps=number_slider)

item = ListItem(List=demesh_2.Vertices, Index="5", Wrap=True)
item_2 = ListItem(List=demesh.Vertices, Index="5", Wrap=True)
avr = Average(Input=demesh.Vertices)
dist = Distance(PointA=item_2, PointB=item)
project = Project(Geometry=avr, Plane=PlaneXY(0, 0, 0))  # -> Geometry, Transform
range_2 = Range(Domain=dist, Steps=number_slider)
Y = UnitY(Factor="-50")
X_3 = UnitX(Factor=range_2)
addition_2 = Addition(A=X_3, B=Y)
move_5 = Move(Geometry=project.Geometry, Motion=addition_2)  # -> Geometry, Transform
# text tag
tag = TextTag3D(
    Location=move_5.Geometry,
    Text=range,
    Size=Slider(2.067, range=1..5),
    Colour=ColourSwatch(SwatchColor=RGB(255, 255, 255)),
    Justification=8)

ln_2 = Line(StartPoint=demesh.Vertices, EndPoint=demesh_2.Vertices)
# variation control curve
crv_7 = Curve(reparameterize(ln))
# transition curves
end = EndPoints(Curve=crv)  # -> Start, End
cp_5 = ControlPoints(Curve=crv_4)  # -> Points, Weights, Knots
cp_6 = ControlPoints(Curve=move_4.Geometry)  # -> Points, Weights, Knots
end_2 = EndPoints(Curve=crv_2)  # -> Start, End
number_slider_2 = Slider(2.681, range=0..10)
loft = Loft(
    Curves=[crv_4, move_3.Geometry],
    Options={Adjust=False, Closed=False, LoftEnds=0, LoftSimp=0, LoftType=0, Rebuild=10, Refit=0.01})
eval = EvaluateCurve(Curve=ln_2, Parameter=graft(range))  # -> Point, Tangent, Angle
divide = DivideCurve(Curve=crv_7, Count=Slider(20, range=2..20), Kinks=False)  # -> simplify(Points), Tangents, Parameters
eval_2 = EvaluateCurve(Curve=ln_2, Parameter=Slider(0.51, range=0..1))  # -> Point, Tangent, Angle
ln_3 = Line(StartPoint=cp_5.Points, EndPoint=cp_6.Points)
number_slider_3 = Slider(0.16, range=0..1)
Y_2 = UnitY(Factor=-1)
conmesh = ConstructMesh(Vertices=eval.Point, Faces=demesh.Faces)
project_2 = Project(Geometry=divide.Points, Plane=PlaneXY(0, 0, 0))  # -> Geometry, Transform
ln_4 = Line(StartPoint=cp_3.Points, EndPoint=cp_4.Points)
crv_8 = Curve(<curve referenced from the Rhino model>)
conmesh_2 = ConstructMesh(Vertices=eval_2.Point, Faces=demesh.Faces)
divide_2 = DivideCurve(Curve=ln_3, Count=items, Kinks=False)  # -> simplify(Points), Tangents, Parameters

pdecon = Deconstruct(Point=divide_2.Points)  # -> XComponent, YComponent, ZComponent
bnd = Bounds(Numbers=pdecon.ZComponent)
remap = RemapNumbers(Value=pdecon.ZComponent, Source=bnd, Target=Domain(0, 1))  # -> Mapped, Clipped
graph = GraphMapper(remap.Mapped, x0=0, x1=1, y0=0, y1=1, container_name="Sine", Equation_px=[0, 1], Equation_py=[0, 1])
remap_2 = RemapNumbers(Value=graph, Source=Domain(0, 1), Target=bnd)  # -> Mapped, Clipped
# custom Z variation
pt = ConstructPoint(XCoordinate=pdecon.XComponent, YCoordinate=pdecon.YComponent, ZCoordinate=remap_2.Mapped)

points = PointList(Points=end.End, Size=number_slider_2)
# < remember curve order!!!
points_2 = PointList(Points=end_2.End, Size=number_slider_2)
project_3 = ProjectPoint(Point=project_2.Geometry, Direction=Y_2, Geometry=crv_8)  # -> Point, Index
move_6 = Move(Geometry=conmesh, Motion="0,-30")  # -> Geometry, Transform
number_slider_4 = Slider(0, range=0..10)
number_slider_5 = Slider(10, range=0..10)
vec2pt = Vector2Pt(PointA=project_2.Geometry, PointB=project_3.Point, Unitize=False)  # -> Vector, Length
gradient = Gradient(LowerLimit=0, UpperLimit=1, Parameter=number_slider_3, stops=[0: RGB(255, 255, 255), 1: RGB(0, 0, 0)])
previewmat = CustomPreviewMaterials(Geometry=conmesh_2, DiffuseColor=RGB(255, 255, 255))
eval_3 = EvaluateCurve(Curve=ln_4, Parameter=number_slider_3)  # -> Point, Tangent, Angle
previewlw_3 = CustomPreviewLineweights(Geometry=ln_4, Shader=ColourSwatch(SwatchColor=RGB(102, 102, 102)), Absolute=False)
wbcatmullclark = WeaverbirdsCatmullClarkSubdivision(MeshCurves=move_6.Geometry, Level=Slider(3, range=1..3), SmoothNakedEdges="2")
bnd_2 = Bounds(Numbers=flatten(vec2pt.Length))
nurbs = NurbsCurve(Vertices=eval_3.Point, Degree=3, Periodic=False)  # -> Curve, Length, Domain
dom = ConstructDomain(DomainStart=number_slider_5, DomainEnd=number_slider_4)
custom_z_variation = BooleanToggle(True)
wbthicken = WeaverbirdsMeshThicken(MeshCurves=wbcatmullclark, Distance="-0.5", OffsetType=0)
remap_3 = RemapNumbers(Value=vec2pt.Length, Source=bnd_2, Target=dom)  # -> Mapped, Clipped
previewlw_4 = CustomPreviewLineweights(Geometry=nurbs.Curve, Shader=gradient, Absolute=False)
amp = Amplitude(Vector=vec2pt.Vector, Amplitude=remap_3.Mapped)
filter = StreamFilter(Gate=custom_z_variation, Stream0=divide_2.Points, Stream1=pt)
move_7 = Move(Geometry=divide.Points, Motion=amp)  # -> Geometry, Transform
previewmat_2 = CustomPreviewMaterials(Geometry=wbthicken, DiffuseColor=RGB(255, 255, 255))
gradient_2 = Gradient(
    LowerLimit=number_slider_5,
    UpperLimit=number_slider_4,
    Parameter=remap_3.Mapped,
    stops=[0.0345: RGB(137, 205, 240), 0.98: RGB(14, 26, 76)])
path_mapper = PathMapper(move_7.Geometry, source="{A;B}(i)", target="{A;i}(B)")
flip = FlipMatrix(Data=filter)
pline = PolyLine(Vertices=flip, Closed=False)
nurbs_2 = NurbsCurve(Vertices=flip, Degree=3, Periodic=False)  # -> graft(Curve), Length, Domain
nurbs_3 = NurbsCurve(Vertices=path_mapper, Degree=3, Periodic=False)  # -> Curve, Length, Domain
vdisex = VectorDisplayEx(Point=divide.Points, Vector=amp, Colour=gradient_2, Width=2)
crv_9 = Curve(nurbs_2.Curve)
pshift = ShiftPaths(Data=nurbs_3.Curve, Offset="1")
move_8 = Move(Geometry=crv_9, Motion=X)  # -> Geometry, Transform
loft_2 = Loft(Curves=pshift, Options={Adjust=True, Closed=True, LoftEnds=0, LoftSimp=0, LoftType=3, Rebuild=10, Refit=0.01})
loft_3 = Loft(
    Curves=[crv_9, move_8.Geometry],
    Options={Adjust=False, Closed=False, LoftEnds=0, LoftSimp=0, LoftType=0, Rebuild=10, Refit=0.01})
cap = CapHoles(Brep=loft_2)  # -> flatten(Brep)
previewmat_3 = CustomPreviewMaterials(Geometry=loft_3, DiffuseColor=RGB(255, 255, 255))
previewmat_4 = CustomPreviewMaterials(Geometry=cap, DiffuseColor=RGB(255, 255, 255))
