# Grasshopper definition 20161103_a302_LunchBox.gh (Grasshopper 0.9.76)
# plug-ins: Human, Kangaroo Components, LunchBox, Weaverbird, Mesh Pipe

# sezioni
swatch = ColourSwatch(SwatchColor=RGB(255, 255, 255))
# tessellations
panel = Panel("500")
crv = Curve([<curve referenced from the Rhino model> x5])
# surface generation
# curva direttrice (rail)
crv_2 = Curve(<curve referenced from the Rhino model>)
Y = UnitY(Factor="2500")
Y_2 = UnitY(Factor=panel)
X = UnitX(Factor="-500")
Y_3 = UnitY(Factor="1000")
Y_4 = UnitY(Factor="1500")
Y_5 = UnitY(Factor="2000")
X_2 = UnitX(Factor="-500")
swp1 = Sweep1(Rail=crv_2, Sections=crv, Miter=1)
# LunchBox
# 
# alcune funzioni interessanti di LunchBox
# 
# © a3 2014 _ Creative Commons Attribution-NonCommercial-ShareAlike3.0 UnportedLicense.
preview = CustomPreview(Geometry=crv_2, Shader=swatch)
addition = Addition(A=Y_3, B=X)
addition_2 = Addition(A=X_2, B=Y)
srf = Surface(reparameterize(swp1))
move = Move(Geometry=srf, Motion=Y)  # -> Geometry, Transform
move_2 = Move(Geometry=srf, Motion=Y_2)  # -> Geometry, Transform
move_3 = Move(Geometry=srf, Motion=Y_4)  # -> Geometry, Transform
move_4 = Move(Geometry=srf, Motion=Y_5)  # -> Geometry, Transform
move_5 = Move(Geometry=move_4.Geometry, Motion="-500,0")  # -> Geometry, Transform
hex = HexagonCells(
    Surface=move.Geometry,
    UDivisions=Slider(40, range=2..50),
    VDivisions=Slider(5, range=2..50),
    TParameter=Slider(0.311, range=0..1))  # -> HexagonCells, Centers

# ---- group: swap UV
swapuv = CSharpScript(S=move_5.Geometry)  # -> out, A; inputs S: Surface
# ---------- swapuv: C# ----------
    A = S.Transpose();
# ---------- end swapuv ----------

# ----
move_6 = Move(Geometry=srf, Motion=addition)  # -> Geometry, Transform
pcen = PolygonCenter(Polyline=hex.HexagonCells)  # -> CenterV, CenterE, CenterA
number_slider = Slider(280, range=20..400)
move_7 = Move(Geometry=srf, Motion=addition_2)  # -> Geometry, Transform
previewmat = CustomPreviewMaterials(Geometry=srf, DiffuseColor=ColourSwatch(SwatchColor=RGB(123, 165, 166)))
dgrid = DiamondGrid(Surface=move_6.Geometry, UDivisions=Slider(40, range=2..50), VDivisions=Slider(20, range=2..50))  # -> graft(CornerPoint1), graft(CornerPoint2), graft(CornerPoint3), graft(CornerPoint4), MidPoint, Normals
qgrid = QuadGrid(Surface=move_2.Geometry, UDivisions=Slider(33, range=2..50), VDivisions=Slider(8, range=2..50))  # -> graft(CornerPoint1), graft(CornerPoint2), graft(CornerPoint3), graft(CornerPoint4), MidPoint, Normals
srf_cp = SurfaceClosestPoint(Point=pcen.CenterV, Surface=move.Geometry)  # -> Point, UVPoint, Distance
quadrand = RandomQuadPanels(Surface=swapuv.A, UDivisions=Slider(16, range=2..50), VDivisions=Slider(50, range=2..50), RandomSeed=10)
quadrand_2 = RandomQuadPanels(Surface=move_4.Geometry, UDivisions=Slider(29, range=2..50), VDivisions=Slider(21, range=2..50), RandomSeed=10)
diamond = DiamondPanels(Surface=move_3.Geometry, UDivisions=Slider(31, range=2..50), VDivisions=Slider(10, range=2..50))  # -> DiamondPanels, TriPanels
# < questi non sono i centri reali delle celle (vedi celle di bordo)
pt = Point(hex.Centers)
# < questi già ci somigliano di più... :)
pt_2 = Point(srf_cp.Point)
merge = Merge(Data1=qgrid.CornerPoint1, Data2=qgrid.CornerPoint2, Data3=qgrid.CornerPoint3, Data4=qgrid.CornerPoint4)
merge_2 = Merge(Data1=dgrid.CornerPoint1, Data2=dgrid.CornerPoint2, Data3=dgrid.CornerPoint3, Data4=dgrid.CornerPoint4)
multiplication = Multiplication(A=dgrid.Normals, B=Slider(-10, range=-10..10))
pt_3 = Point(dgrid.MidPoint)
previewmat_2 = CustomPreviewMaterials(Geometry=quadrand_2, DiffuseColor=RGB(255, 255, 255))
previewmat_3 = CustomPreviewMaterials(Geometry=quadrand, DiffuseColor=RGB(255, 255, 255))
hex_2 = HexagonalStructure(
    Surface=move_7.Geometry,
    UDivisions=Slider(40, range=2..50),
    VDivisions=Slider(5, range=2..50),
    AdjustShape=0.3,
    Type=Toggle(False))  # -> StructureLines, StructureNodes
previewmat_4 = CustomPreviewMaterials(Geometry=diamond.DiamondPanels, DiffuseColor=RGB(255, 255, 255))
previewmat_5 = CustomPreviewMaterials(Geometry=diamond.TriPanels, DiffuseColor=ColourSwatch(SwatchColor=RGB(0, 0, 0)))

# ---- group: da Kangaroo
duppt = RemoveDuplicatePts(Points=merge_2, Tolerance=0.01)

# ----
vdisex = VectorDisplayEx(Point=pt_3, Vector=multiplication, Colour=multiplication, Width=2)
panel_2 = Panel("restituisce superfici NURBS")
conmesh = ConstructMesh(Vertices=merge, Faces={A=0, B=1, C=2, D=3})
pline = PolyLine(Vertices=merge, Closed=Toggle(True))
crv_3 = Curve(hex_2.StructureLines)
# clean tree: ripulisce il data tree dai componenti nulli e non validi
clean = CleanTree(RemoveNulls=True, RemoveInvalid=True, RemoveEmpty=False, Tree=duppt)

face_indexes = Panel("""Q{0;1;2;3}
T{0;1;2}""")
lng = ListLength(List=clean)
equals = Equality(FirstNumber=lng, SecondNumber="3")  # -> Equality, Inequality
item = ListItem(List=face_indexes, Index=equals.Equality, Wrap=True)

wbjoin = WeaverbirdsJoinMeshesAndWeld(Mesh=flatten(conmesh), Weld=Toggle(True))
# bar graph: il bar graph permette di visualizzare la distribuzione dei dati
dom = ConstructDomain(DomainStart=Slider(0.78, range=0.1..0.9), DomainEnd=Slider(0.1, range=0.1..0.9))
X_3 = UnitX(Factor="500")
move_8 = Move(Geometry=clean, Motion=X_3)  # -> Geometry, Transform
# poiché alcune facce hanno 3 lati (la facce di bordo) occorre dire al componente che crea la mesh che quelle facce sono triangolari (T) anzichè quadrangolari (Q).
# 
# Se il numero di punti è uguale a 3 il componente Equality resituisce True (che equivale a 1 - ricordare che false=0 e true=1) e quindi passa l'elemento 1 della lista face indexes (T{0;1;2}), altrimenti passa l'elemento 0 (Q{0;1;2;3}).
conmesh_2 = ConstructMesh(Vertices=move_8.Geometry, Faces=item)
wbjoin_2 = WeaverbirdsJoinMeshesAndWeld(Mesh=flatten(conmesh_2), Weld=Toggle(True))
pline_2 = PolyLine(Vertices=clean, Closed=Toggle(True))
# structures
previewmat_6 = CustomPreviewMaterials(Geometry=wbjoin, DiffuseColor=RGB(255, 255, 255))
previewmat_7 = CustomPreviewMaterials(Geometry=wbjoin_2, DiffuseColor=RGB(255, 255, 255))
number_slider_2 = Slider(32, range=2..50)
number_slider_3 = Slider(5, range=2..50)
move_9 = Move(Geometry=srf, Motion="500,0")  # -> Geometry, Transform
move_10 = Move(Geometry=move_9.Geometry, Motion="500,0")  # -> Geometry, Transform
move_11 = Move(Geometry=srf, Motion="1500,0")  # -> Geometry, Transform
crv_4 = Curve(graft([<curve referenced from the Rhino model> x2]))
crv_5 = Curve(graft([<curve referenced from the Rhino model> x2]))
srf_2 = Surface(<surface referenced from the Rhino model>)
srf_3 = Surface(<surface referenced from the Rhino model>)
gridbraced1d = BracedGrid1DStructure(Surface=move_9.Geometry, UDivisions=number_slider_2, VDivisions=number_slider_3)  # -> PrimaryLines, BraceLines, StructureNodes
gridbraced2d = BracedGrid2DStructure(Surface=move_10.Geometry, UDivisions=number_slider_2, VDivisions=number_slider_3)  # -> PrimaryLines, BraceLines, StructureNodes
spacetruss_1 = SpaceTrussStructure1(
    Surface=move_11.Geometry,
    UDivisions=Slider(32, range=2..50),
    VDivisions=Slider(8, range=2..50),
    TrussDepth=Slider(10, range=0..10))  # -> LinesA, LinesB, Web, Nodes
truss = _2DTruss(CurveA=crv_4, CurveB=crv_5, Divisions=Slider(31, range=1..50), TrussToggle=Slider(2, range=0..2))  # -> PrimaryLines, BraceLines, VerticalLines, StructureNodes
spacetruss_2 = SpaceTrussStructure2(SurfaceA=srf_2, SurfaceB=srf_3, UDivisions=Slider(24, range=2..50), VDivisions=Slider(11, range=2..50))  # -> LinesA, LinesB, Web, Nodes
pt_4 = Point(truss.StructureNodes)
flip = FlipMatrix(Data=pt_4)
crv_6 = Curve(spacetruss_2.LinesA)
crv_7 = Curve(spacetruss_2.LinesB)
crv_8 = Curve(spacetruss_2.Web)
crv_9 = Curve([gridbraced1d.BraceLines, gridbraced2d.BraceLines])
crv_10 = Curve([gridbraced1d.PrimaryLines, gridbraced2d.PrimaryLines])
pline_3 = PolyLine(Vertices=flip, Closed=False)
previewlw = CustomPreviewLineweights(Geometry=crv_10, Shader=ColourSwatch(SwatchColor=RGB(255, 255, 255)), Absolute=False)
previewlw_2 = CustomPreviewLineweights(Geometry=crv_9, Shader=ColourSwatch(SwatchColor=RGB(120, 120, 120)), Absolute=False)
previewlw_3 = CustomPreviewLineweights(Geometry=[crv_6, crv_7], Shader=ColourSwatch(SwatchColor=RGB(255, 255, 255)), Absolute=False)
previewlw_4 = CustomPreviewLineweights(Geometry=crv_8, Shader=ColourSwatch(SwatchColor=RGB(120, 120, 120)), Absolute=False)
mpipe = MeshPipe(Curve=spacetruss_1.LinesA, Radius=Slider(1, range=0..1), Accuracy=0.2, Rotation=0, Segments="4", Caps="1")
mpipe_2 = MeshPipe(Curve=spacetruss_1.LinesB, Radius=Slider(0.623, range=0..1), Accuracy=0.2, Rotation=0, Segments="4", Caps="1")
mpipe_3 = MeshPipe(Curve=spacetruss_1.Web, Radius=Slider(0.25, range=0..1), Accuracy=0.2, Rotation=0, Segments="4", Caps="1")
mpipe_4 = MeshPipe(Curve=truss.PrimaryLines, Radius=Slider(1, range=0..1), Accuracy=0.2, Rotation=0, Segments="4", Caps="1")
mpipe_5 = MeshPipe(Curve=truss.VerticalLines, Radius=Slider(0.5, range=0..1), Accuracy=0.2, Rotation=0, Segments="4", Caps="1")
mpipe_6 = MeshPipe(Curve=truss.BraceLines, Radius=Slider(0.15, range=0..1), Accuracy=0.2, Rotation=0, Segments="4", Caps="1")
mjoin = MeshJoin(Meshes=flatten([mpipe, mpipe_2, mpipe_3]))
previewlw_5 = CustomPreviewLineweights(Geometry=[mpipe_4, mpipe_6], Shader=ColourSwatch(SwatchColor=RGB(255, 255, 255)), Absolute=False)
previewlw_6 = CustomPreviewLineweights(Geometry=[pline_3, mpipe_5], Shader=ColourSwatch(SwatchColor=RGB(120, 120, 120)), Absolute=False)
previewmat_8 = CustomPreviewMaterials(Geometry=mjoin, DiffuseColor=RGB(255, 255, 255))

# ---- group: attractor
crv_11 = Curve(reparameterize(<curve referenced from the Rhino model>))

# ----
move_12 = Move(Geometry=crv_11, Motion=Y)  # -> Geometry, Transform

# ---- group: attractor (continued)
eval = EvaluateCurve(Curve=move_12.Geometry, Parameter=Slider(0.456, range=0..1))  # -> Point, Tangent, Angle

# ----
msphere = MeshSphere(Base=eval.Point, Radius=number_slider, UCount=10, VCount=20)
dist = Distance(PointA=srf_cp.Point, PointB=eval.Point)
preview_2 = CustomPreview(Geometry=msphere, Shader=ColourSwatch(SwatchColor=RGBA(99, 99, 99, 42)))
smaller = SmallerThan(FirstNumber=dist, SecondNumber=number_slider)  # -> SmallerThan, OrEqualTo
bar_graph = BarGraph(dist, BarColor=RGB(255, 0, 90))

# ---- group: dispatch
dispatch = Dispatch(List=hex.HexagonCells, DispatchPattern=smaller.SmallerThan)  # -> ListA, ListB
dispatch_2 = Dispatch(List=srf_cp.Point, DispatchPattern=smaller.SmallerThan)  # -> ListA, ListB
dispatch_3 = Dispatch(List=dist, DispatchPattern=smaller.SmallerThan)  # -> ListA, ListB

# ----
crv_12 = Curve(dispatch.ListA)
pt_5 = Point(dispatch_2.ListA)
bnd = Bounds(Numbers=dispatch_3.ListA)
remap = RemapNumbers(Value=dispatch_3.ListA, Source=bnd, Target=dom)  # -> Mapped, Clipped
scale = Scale(Geometry=dispatch.ListA, Center=dispatch_2.ListA, Factor=remap.Mapped)  # -> Geometry, Transform
graft = GraftTree(Tree=dispatch.ListA, IncludeEmptyLists=True, IncludeNullItems=True)
graft_2 = GraftTree(Tree=scale.Geometry, IncludeEmptyLists=True, IncludeNullItems=True)
loft = Loft(
    Curves=[graft, graft_2],
    Options={Adjust=False, Closed=False, LoftEnds=0, LoftSimp=0, LoftType=0, Rebuild=10, Refit=0.01})
extr = ExtrudePoint(Base=dispatch.ListB, Point=dispatch_2.ListB)
previewmat_9 = CustomPreviewMaterials(Geometry=[loft, extr], DiffuseColor=RGB(255, 255, 255))
