# Grasshopper definition Mesh Brep with options.gh (Grasshopper 0.9.76)
# Copyright: Co-de-iT
# plug-ins: Human

non_jagged_seams = BooleanToggle(True)
simple_planes = BooleanToggle(True)
refine = BooleanToggle(True)
max_quad_count = Slider(0, range=0..1000)
max_dist = Slider(0.095, range=0..1)
max_angle = Slider(0, range=0..90)
threshold = Panel("5")
max_edge_length = Slider(1, range=1..100)
min_quad_count = Slider(0, range=0..200)
max_aspect_ratio = Slider(1, range=1..20)
threshold_2 = Panel("0.01")
min_edge_length = Slider(1, range=1..100)
threshold_3 = Panel("2")
threshold_4 = Panel("2")
# Mesh Brep with options
# 
# A meshing with options. Use to export in .obj for Unreal Engine.
# 
# © a3 2016 _ Creative Commons Attribution-NonCommercial-ShareAlike3.0 UnportedLicense.
brep = Brep([<brep referenced from the Rhino model> x3])
num = Number(threshold_2)
num_2 = Number(threshold_3)
num_3 = Number(threshold_4)
num_4 = Number(threshold)

expression = Expression(x=max_dist, y=num, Expression="if(x<y,0,x)")
expression_2 = Expression(x=max_angle, y=num_4, Expression="if(x<y,0,x)")
expression_3 = Expression(x=min_edge_length, y=num_2, Expression="if(x<y,0,x)")
# threshold
# 
# if (x<threshold)
# then pass 0
# else pass x
expression_4 = Expression(x=max_edge_length, y=num_3, Expression="if(x<y,0,x)")

custom_mesh_settings = SettingsCustom(
    StitchSeams=non_jagged_seams,
    SimplePlanes=simple_planes,
    Refine=refine,
    MinCount=min_quad_count,
    MaxCount=max_quad_count,
    AspectRatio=max_aspect_ratio,
    MaxDistance=expression,
    MaxAngle=expression_2,
    MinEdge=expression_3,
    MaxEdge=expression_4)
mesh = MeshBrep(Brep=brep, Settings=custom_mesh_settings)
X = UnitX(Factor=Slider(-75, range=-1000..0))
move = Move(Geometry=mesh, Motion=X)  # -> Geometry, Transform
previewmat = CustomPreviewMaterials(Geometry=move.Geometry, DiffuseColor=RGB(255, 255, 255))
export_layer = Panel("mesh_export")
obj_file_name = Panel("test_mesh")
dir_type = ValueList({"desktop": 0, "documents": 1, "C:": 2}, selected="desktop")
custom_subdir = Panel("OBJexport")
arc = CircularArc()
dir = CSharpScript(type=dir_type, dir=custom_subdir)  # -> out, A; inputs type: Int32, dir: String
# ---------- dir: C# ----------
    String S = "";
    String root = "";
    String end = "\\";
    switch(type){
      case 0:
        root = Environment.GetFolderPath(Environment.SpecialFolder.Desktop);
        S = "Desktop";
        break;
      case 1:
        root = Environment.GetFolderPath(Environment.SpecialFolder.MyDocuments);
        S = "Documents";
        break;
      case 2:
        root = "C:";
        S = root + end;
        break;
    }
    A = root + end + (dir != null ? (dir + end) : "");
    Component.Message = S;
# ---------- end dir ----------
circle = Circle()
pt = Point()
destination_directory = Panel(dir.A)
mesh_2 = Mesh(move.Geometry)
concat = Concatenate(FragmentA=dir.A, FragmentB=obj_file_name)
save = Button()
panel = Panel(concat)
c_script = CSharpScript(meshes=mesh_2, series="0", layername=export_layer, filepath=dir.A, filename=obj_file_name, execute=save)  # -> out; inputs meshes: list of Mesh, series: Int32, layername: String, filepath: String, filename: String, execute: Boolean
# ---------- c_script: C# ----------
    #region Authorship
    //[Aytomated AI Export] was written by Marios Tsiliakos on 06 / 11 / 2014 in grasshopper 0.9.0076
    //This definition is for the pubic domain feel free to use it , share it and modify it, by providing proper citing. The author, Marios Tsiliakos of digitalsubstance.wordpress.com , makes no warranty, expressed or implied, as to the usefulness of the software and documentation for any purpose.If this tool is used for commercial purposes please notify the author. This work is licensed under a Creative Commons Attribution-Share Alike 3.0
    //for more information visit digitalsubstance.wordpress.com.
    #endregion

    //where to save
    string save_directory = filepath + filename + series.ToString("0000") + ".obj";
    Print(save_directory);
    if (!execute)return;

    else
    {
      //check
      for (int i = 0; i < meshes.Count;i++){
        if ((meshes.Count == 0) || (meshes[i] == null))
        {
          Print("No meshes or valid meshes provided");
          return;
        }
      }
      //create alist of guids
      List<Guid> myMeshes = new List<Guid>();
      // layer to bake the objects to
      create_layer(layername);
      //create a directory to store the ai files
      create_dir(filepath);

      for(int i = 0; i < meshes.Count; i++){
        //declare the objects attributes
        Rhino.DocObjects.ObjectAttributes attr = new Rhino.DocObjects.ObjectAttributes();
        //set attributes
        attr.LayerIndex = doc.Layers.Find(layername, true);

        Guid id = Guid.Empty;

        //bake the curves
        if(meshes[i].ObjectType == Rhino.DocObjects.ObjectType.Mesh)
        {
          id = doc.Objects.AddMesh((Mesh) meshes[i], attr);
        }

        // add the curves to the mycurve_guid list
        if(id.ToString().Length > 0) myMeshes.Add(id);
      }
      // select the curves in Rhino to successfully export them
      for(int i = 0; i < myMeshes.Count; i++)
      {
        doc.Objects.Select(myMeshes[i], true);
      }

      //and export them
      //Rhino.RhinoApp.RunScript("-_Export\n\"" + save_directory + "\"\n _Enter", false); // verify options here
      Rhino.RhinoApp.RunScript("-_Export " + save_directory + " y=n _Enter _Enter", false);
      //delete the curves after exporting them
      for(int i = 0; i < myMeshes.Count; i++) doc.Objects.Delete(myMeshes[i], true);
    }
# ---------- c_script: C# additional code ----------
  /// <summary>new random number.</summary>
  private readonly Random rand = new Random();
  /// <summary>check if the specified layer exists and if not crete it.</summary>
  private void create_layer(string l)
  {
    int layerslist = doc.Layers.Find(l, true);

    if(layerslist < 0){
      Rhino.DocObjects.Layer l0 = new Rhino.DocObjects.Layer();
      System.Drawing.Color m_color = RandomColour();
      l0.Color = m_color;
      l0.Name = l;
      layerslist = doc.Layers.Add(l0);
    }
  }
  /// <summary>assign new random color</summary>
  private Color RandomColour()
  {
    return Color.FromArgb(this.rand.Next(256), this.rand.Next(256), this.rand.Next(256));
  }
  /// <summary>create a new directory in your system</summary>
  public void create_dir(string path)
  {
    string directoryName = Path.GetDirectoryName(path);
    if ((directoryName.Length > 0) && (!Directory.Exists(directoryName)))
    {
      Directory.CreateDirectory(directoryName);
    }
  }
# ---------- end c_script ----------
c_script_2 = CSharpScript(meshes=mesh_2, series="0", name=obj_file_name, layername=export_layer, filepath=dir.A, execute=save)  # -> out; inputs meshes: list of Mesh, series: Int32, name: String, layername: String, filepath: String, execute: Boolean; disabled
# ---------- c_script_2: C# ----------
    #region Authorship
    //[Aytomated AI Export] was written by Marios Tsiliakos on 06 / 11 / 2014 in grasshopper 0.9.0076
    //This definition is for the pubic domain feel free to use it , share it and modify it, by providing proper citing. The author, Marios Tsiliakos of digitalsubstance.wordpress.com , makes no warranty, expressed or implied, as to the usefulness of the software and documentation for any purpose.If this tool is used for commercial purposes please notify the author. This work is licensed under a Creative Commons Attribution-Share Alike 3.0
    //for more information visit digitalsubstance.wordpress.com.
    #endregion

    //where to save
    string save_directory = filepath + name + series.ToString("0000") + ".obj";
    Print(save_directory);
    if (!execute)return;

    else
    {
      //check
      for (int i = 0; i < meshes.Count;i++){
        if ((meshes.Count == 0) || (meshes[i] == null))
        {
          Print("No meshes or valid meshes provided");
          return;
        }
      }
      //create alist of guids
      List<Guid> myMeshes = new List<Guid>();
      // layer to bake the objects to
      create_layer(layername);
      //create a directory to store the ai files
      create_dir(filepath);

      for(int i = 0; i < meshes.Count; i++){
        //declare the objects attributes
        Rhino.DocObjects.ObjectAttributes attr = new Rhino.DocObjects.ObjectAttributes();
        //set attributes
        attr.LayerIndex = doc.Layers.Find(layername, true);

        Guid id = Guid.Empty;

        //bake the curves
        if(meshes[i].ObjectType == Rhino.DocObjects.ObjectType.Mesh)
        {
          id = doc.Objects.AddMesh((Mesh) meshes[i], attr);
        }

        // add the curves to the mycurve_guid list
        if(id.ToString().Length > 0) myMeshes.Add(id);
      }
      // select the curves in Rhino to successfully export them
      for(int i = 0; i < myMeshes.Count; i++)
      {
        doc.Objects.Select(myMeshes[i], true);
      }

      //and export them
      //Rhino.RhinoApp.RunScript("-_Export\n\"" + save_directory + "\"\n _Enter", false); // verify options here
      Rhino.RhinoApp.RunScript("-_Export " + save_directory + " y=n _Enter _Enter", false);
      //delete the curves after exporting them
      for(int i = 0; i < myMeshes.Count; i++) doc.Objects.Delete(myMeshes[i], true);
    }
# ---------- c_script_2: C# additional code ----------
  /// <summary>new random number.</summary>
  private readonly Random rand = new Random();
  /// <summary>check if the specified layer exists and if not crete it.</summary>
  private void create_layer(string l)
  {
    int layerslist = doc.Layers.Find(l, true);

    if(layerslist < 0){
      Rhino.DocObjects.Layer l0 = new Rhino.DocObjects.Layer();
      System.Drawing.Color m_color = RandomColour();
      l0.Color = m_color;
      l0.Name = l;
      layerslist = doc.Layers.Add(l0);
    }
  }
  /// <summary>assign new random color</summary>
  private Color RandomColour()
  {
    return Color.FromArgb(this.rand.Next(256), this.rand.Next(256), this.rand.Next(256));
  }
  /// <summary>create a new directory in your system</summary>
  public void create_dir(string path)
  {
    string directoryName = Path.GetDirectoryName(path);
    if ((directoryName.Length > 0) && (!Directory.Exists(directoryName)))
    {
      Directory.CreateDirectory(directoryName);
    }
  }
# ---------- end c_script_2 ----------
runtime_errors = Panel(c_script)
