# Grasshopper definition 20161025_a3_XX_curve interpolation.gh (Grasshopper 0.9.76)
# Copyright: Co-de-iT
# plug-ins: LunchBox

resolution = Slider(200, range=1..200)
interpolated_curves = Slider(18, range=1..50)
# list: double click to edit
interpolation = ValueList({"polyline": 0, "NURBS curve": 1, "interpolated curve": 2}, selected="interpolated curve")
diagram_scale = Slider(200, range=0..200)
# divide curve by curvature
resolution_2 = Slider(500, range=1..500)
subdivision = Slider(70, range=1..500)
crv = Curve(reparameterize(<curve referenced from the Rhino model>))
# Curve interpolation
# 
# © a3 2014 _ Creative Commons Attribution-NonCommercial-ShareAlike3.0 UnportedLicense.
# tween
crv_2 = Curve(<curve referenced from the Rhino model>)
crv_3 = Curve(<curve referenced from the Rhino model>)
crv_4 = Curve(<curve referenced from the Rhino model>)
# interpolation by curves (better option)
merge = Merge(Data1=crv_2, Data2=crv_3, Data3=crv_4)
divide = DivideCurve(Curve=merge, Count=resolution, Kinks=False)  # -> Points, Tangents, Parameters
flip = FlipMatrix(Data=divide.Points)

divide_2 = DivideCurve(Curve=crv, Count=resolution_2, Kinks=False)  # -> Points, Tangents, Parameters
curvature = Curvature(Curve=crv, Parameter=divide_2.Parameters)  # -> P, K, C
multiplication = Multiplication(A=curvature.K, B=diagram_scale)
move = Move(Geometry=divide_2.Points, Motion=multiplication)  # -> Geometry, Transform
intcrv = Interpolate(Vertices=move.Geometry, Degree=3, Periodic=False, KnotStyle=1)  # -> reparameterize(Curve), Length, Domain
divide_3 = DivideCurve(Curve=intcrv.Curve, Count=subdivision, Kinks=False)  # -> Points, Tangents, Parameters
eval = EvaluateCurve(Curve=crv, Parameter=divide_3.Parameters)  # -> Point, Tangent, Angle

range = Range(Domain=Domain(0, 1), Steps=Slider(40, range=1..50))
lng = ListLength(List=merge)
# gate
gate = StreamGate(Stream=flip, Gate=interpolation)  # -> Target0, Target1, Target2
# directs stream S in channels
number_slider = Slider(1, range=0..2)
# il cluster contiene i componenti qui sotto. Per vedere e modificare il cluster fare doppio click sul cluster stesso
divide_curve_by_curvature = DivideCurveByCurvature(curve=crv, resolution=resolution_2, scale=diagram_scale, n_of_points=subdivision)  # -> P, T, A, t
subtraction = Subtraction(A=lng, B=1)
pline = PolyLine(Vertices=gate.Target0, Closed=False)
intcrv_2 = Interpolate(Vertices=gate.Target2, Degree=3, Periodic=False, KnotStyle=number_slider)  # -> Curve, Length, Domain
nurbs = NurbsCurve(Vertices=gate.Target1, Degree=subtraction, Periodic=False)  # -> Curve, Length, Domain
tweencrv = TweenCurve(CurveA=crv_2, CurveB=crv_3, Factor=range, BlendType=0)
# filter
# chooses which channel to
# stream through
filter = StreamFilter(Gate=interpolation, Stream0=pline, Stream1=nurbs.Curve, Stream2=intcrv_2.Curve)
# < tween è possibile solo e soltanto
# tra 2 curve; inoltre può provocare
# problemi di intersezione
preview = CustomPreview(Geometry=tweencrv, Shader=ColourSwatch(SwatchColor=RGB(204, 204, 204)))
divide_4 = DivideCurve(Curve=filter, Count=interpolated_curves, Kinks=False)  # -> Points, Tangents, Parameters
viewer = ParamViewer(divide_4.Points)
toggle = BooleanToggle(True)
# flip matrix
flip_2 = FlipMatrix(Data=divide_4.Points)
viewer_2 = ParamViewer(flip_2)
number_slider_2 = Slider(70, range=0..100)
surfacing = ValueList({"no loft": 0, "NURBS Loft": 1, "interp. loft": 2}, selected="no loft")
nurbs_2 = NurbsCurve(Vertices=flip_2, Degree=3, Periodic=toggle)  # -> Curve, Length, Domain
intcrv_3 = Interpolate(Vertices=flip_2, Degree=3, Periodic=toggle, KnotStyle=1)  # -> Curve, Length, Domain
multiplication_2 = Multiplication(A=number_slider_2, B="2")
X = UnitX(Factor=multiplication_2)
X_2 = UnitX(Factor=number_slider_2)
move_2 = Move(Geometry=nurbs_2.Curve, Motion=X)  # -> Geometry, Transform
filter_2 = StreamFilter(Gate=surfacing, Stream1=flatten(nurbs_2.Curve), Stream2=flatten(intcrv_3.Curve))
move_3 = Move(Geometry=intcrv_3.Curve, Motion=X_2)  # -> Geometry, Transform
# NURBS
preview_2 = CustomPreview(Geometry=move_2.Geometry, Shader=ColourSwatch(SwatchColor=RGB(58, 197, 252)))
# interpolate
preview_3 = CustomPreview(Geometry=move_3.Geometry, Shader=ColourSwatch(SwatchColor=RGB(201, 97, 6)))
toggle_2 = BooleanToggle(False)
shift = ShiftList(List=filter_2, Shift="1", Wrap=toggle_2)  # -> graft(List)
shift_2 = ShiftList(List=filter_2, Shift="-1", Wrap=toggle_2)  # -> graft(List)
loft = Loft(
    Curves=[shift, shift_2],
    Options={Adjust=False, Closed=False, LoftEnds=0, LoftSimp=0, LoftType=0, Rebuild=10, Refit=0.01})  # -> flatten(Loft)
# color by area
area = Area(Geometry=loft)  # -> Area, Centroid
bnd = Bounds(Numbers=area.Area)
dedomain = DeconstructDomain(Domain=bnd)  # -> Start, End
gradient = Gradient(
    LowerLimit=dedomain.Start,
    UpperLimit=dedomain.End,
    Parameter=area.Area,
    stops=[0.0345: RGB(137, 205, 240), 0.98: RGB(14, 26, 76)])

pt = Point(Point(70, 0, 0))
move_4 = Move(Geometry=loft, Motion=pt)  # -> Geometry, Transform
bake = Button()
# bake objects with attributes (color, specific layers, etc.)
# 
# LunchBox component
bake_2 = ObjectBake(
    BakeToggle=bake,
    GeometryObjects=move_4.Geometry,
    Layer="surfaces",
    ObjectName="GH_Obj",
    ObjectColor=gradient,
    LayerColor=RGB(255, 255, 255))

preview_4 = CustomPreview(Geometry=loft, Shader=gradient)

# ==== cluster DivideCurveByCurvature
# per tornare alla finestra principale di Grasshopper cliccare sul box aperto in alto a sx e scegliere "save and close" o "discard and close"
curve = ClusterInput()  # curve to subdivide
resolution = ClusterInput()  # n. of sampling points for curvature
scale = ClusterInput()  # scale of the curvature diagram
n_of_points = ClusterInput()  # n. o f points for subdivision
crv = Curve(reparameterize(curve))
divide = DivideCurve(Curve=crv, Count=resolution, Kinks=False)  # -> Points, Tangents, Parameters
curvature = Curvature(Curve=crv, Parameter=divide.Parameters)  # -> P, K, C
multiplication = Multiplication(A=curvature.K, B=scale)
move = Move(Geometry=divide.Points, Motion=multiplication)  # -> Geometry, Transform
intcrv = Interpolate(Vertices=move.Geometry, Degree=3, Periodic=False, KnotStyle=1)  # -> reparameterize(Curve), Length, Domain
divide_2 = DivideCurve(Curve=intcrv.Curve, Count=n_of_points, Kinks=False)  # -> Points, Tangents, Parameters
eval = EvaluateCurve(Curve=crv, Parameter=divide_2.Parameters)  # -> Point, Tangent, Angle
P = ClusterOutput(eval.Point)
T = ClusterOutput(eval.Tangent)
A = ClusterOutput(eval.Angle)
t = ClusterOutput(divide_2.Parameters)
