# Grasshopper definition 20161025_a3_XX_iterations.gh (Grasshopper 0.9.76)
# Copyright: Co-de-iT
# plug-ins: Anemone

number_slider = Slider(100, range=2..1000)
# ...e se provassimo a ripetere il processo più volte?
crv = Curve(reparameterize([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]))
number_slider_2 = Slider(100, range=2..1000)
initial_length = Slider(45, range=0..500)
variation = Slider(0.95, range=0.5..2)
crv_2 = Curve(reparameterize(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))
# iterations
# 
# © a3 2016 _ Creative Commons Attribution-NonCommercial-ShareAlike3.0 UnportedLicense.
crv_3 = Curve(reparameterize(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))

# ----
# Anemone plug-in
number_slider_3 = Slider(20, range=0..20)
resolution = Slider(100, range=2..1000)
offset = Slider(45, range=0..500)
step_variation = Slider(0.77, range=0.5..2)
# curve in D0
# no input in D1
button = Button()
crv_4 = Curve([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])
crv_5 = Curve([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])
loop_start = LoopStart(N=number_slider_3, T=button, D0=crv_5, D2=offset)  # -> port, Counter, Data, Data_2, Data_3
divide = DivideCurve(Curve=loop_start.Data, Count=resolution, Kinks=False)  # -> Points, Tangents, Parameters
multiplication = Multiplication(A=loop_start.Data_3, B=step_variation)
line = LineSDL(Start=divide.Points, Direction=divide.Tangents, Length=multiplication)
end = EndPoints(Curve=line)  # -> Start, End
nurbs = NurbsCurve(Vertices=end.End, Degree=3, Periodic=False)  # -> Curve, Length, Domain
loop_end = LoopEnd(
    port=loop_start.port,
    Exit=False,
    Data=flatten(nurbs.Curve),
    Data_2=simplify(line),
    Data_3=multiplication,
    pausedState=False,
    state="Constant & Record",
    TimeOutVal=0)  # -> D0, D1, D2

divide_2 = DivideCurve(Curve=crv_3, Count=number_slider, Kinks=False)  # -> Points, Tangents, Parameters
divide_3 = DivideCurve(Curve=crv_2, Count=number_slider, Kinks=False)  # -> Points, Tangents, Parameters

divide_4 = DivideCurve(Curve=crv, Count=number_slider_2, Kinks=False)  # -> Points, Tangents, Parameters
# iterazione 0
line_2 = LineSDL(Start=divide_4.Points, Direction=divide_4.Tangents, Length=initial_length)
end_2 = EndPoints(Curve=line_2)  # -> Start, End
intcrv = Interpolate(Vertices=end_2.End, Degree=3, Periodic=False, KnotStyle=1)  # -> Curve, Length, Domain
nurbs_2 = NurbsCurve(Vertices=end_2.End, Degree=3, Periodic=False)  # -> Curve, Length, Domain

number_slider_4 = Slider(45, range=0..500)
ln = Line(StartPoint=divide_2.Points, EndPoint=divide_3.Points)
len = Length(Curve=ln)
line_3 = LineSDL(Start=divide_2.Points, Direction=divide_2.Tangents, Length=number_slider_4)
line_4 = LineSDL(Start=divide_3.Points, Direction=divide_3.Tangents, Length=number_slider_4)
ma = MassAddition(Input=len)  # -> Result, PartialResults

divide_5 = DivideCurve(Curve=nurbs_2.Curve, Count=number_slider_2, Kinks=False)  # -> Points, Tangents, Parameters
multiplication_2 = Multiplication(A=initial_length, B=variation)
# iterazione 1
line_5 = LineSDL(Start=divide_5.Points, Direction=divide_5.Tangents, Length=multiplication_2)
end_3 = EndPoints(Curve=line_5)  # -> Start, End
intcrv_2 = Interpolate(Vertices=end_3.End, Degree=3, Periodic=False, KnotStyle=1)  # -> Curve, Length, Domain
nurbs_3 = NurbsCurve(Vertices=end_3.End, Degree=3, Periodic=False)  # -> Curve, Length, Domain

end_4 = EndPoints(Curve=line_3)  # -> Start, End
end_5 = EndPoints(Curve=line_4)  # -> Start, End
lunghezza_totale = Panel(ma.Result)
intcrv_3 = Interpolate(Vertices=end_4.End, Degree=3, Periodic=False, KnotStyle=1)  # -> Curve, Length, Domain
# curve da direzione tangente
intcrv_4 = Interpolate(Vertices=end_5.End, Degree=3, Periodic=False, KnotStyle=1)  # -> Curve, Length, Domain
nurbs_4 = NurbsCurve(Vertices=end_5.End, Degree=3, Periodic=False)  # -> Curve, Length, Domain
nurbs_5 = NurbsCurve(Vertices=end_4.End, Degree=3, Periodic=False)  # -> Curve, Length, Domain
range = Range(Domain=Domain(0, 1), Steps=expr("x-1", number_slider_3))  # -> graft(Range)
crv_6 = Curve(loop_end.D0)
gradient = Gradient(LowerLimit=0, UpperLimit=1, Parameter=range, stops=[0.0345: RGB(137, 205, 240), 0.98: RGB(14, 26, 76)])
panel = Panel(loop_end.D1)

divide_6 = DivideCurve(Curve=nurbs_3.Curve, Count=number_slider_2, Kinks=False)  # -> Points, Tangents, Parameters
multiplication_3 = Multiplication(A=multiplication_2, B=variation)
# iterazione 2
line_6 = LineSDL(Start=divide_6.Points, Direction=divide_6.Tangents, Length=multiplication_3)
end_6 = EndPoints(Curve=line_6)  # -> Start, End
intcrv_5 = Interpolate(Vertices=end_6.End, Degree=3, Periodic=False, KnotStyle=1)  # -> Curve, Length, Domain
nurbs_6 = NurbsCurve(Vertices=end_6.End, Degree=3, Periodic=False)  # -> Curve, Length, Domain

panel_2 = Panel(loop_end.D0)
preview = CustomPreview(Geometry=crv_6, Shader=gradient)
preview_2 = CustomPreview(Geometry=loop_end.D1, Shader=ColourSwatch(SwatchColor=RGB(84, 84, 84)))

divide_7 = DivideCurve(Curve=nurbs_6.Curve, Count=number_slider_2, Kinks=False)  # -> Points, Tangents, Parameters
multiplication_4 = Multiplication(A=multiplication_3, B=variation)
# iterazione 3
line_7 = LineSDL(Start=divide_7.Points, Direction=divide_7.Tangents, Length=multiplication_4)
end_7 = EndPoints(Curve=line_7)  # -> Start, End
nurbs_7 = NurbsCurve(Vertices=end_7.End, Degree=3, Periodic=False)  # -> Curve, Length, Domain
intcrv_6 = Interpolate(Vertices=end_7.End, Degree=3, Periodic=False, KnotStyle=1)  # -> Curve, Length, Domain
