# Grasshopper definition 20161027_a3_XX_curve deformer.gh (Grasshopper 0.9.76)
# plug-ins: Human

x_size = Slider(18.25, range=0..100)
y_size = Slider(45.25, range=0..500)
x_cells = Slider(13, range=1..50)
y_cells = Slider(6, range=1..50)
_0_thres = Slider(3.5, range=0..50)
_1_thres = Slider(8.2, range=0..50)
_2_thres = Slider(4.125, range=0..50)
_3_thres = Slider(8.375, range=0..50)
_4_thres = Slider(7.75, range=0..50)
pt = Point([<point referenced from the Rhino model> x5])
division = Division(A=y_size, B=y_cells)
division_2 = Division(A=x_size, B=x_cells)
recgrid = Rectangular(Plane=PlaneXY(0, 0, 0), SizeX=division_2, SizeY=division, ExtentX=x_cells, ExtentY=y_cells)  # -> Cells, Points

# ---- group: one attractor
near_thres = Slider(0.542, range=0..50)
far_thres = Slider(10.472, range=0..50)
pt_2 = Point(<point referenced from the Rhino model>)
flip = FlipMatrix(Data=recgrid.Points)
cir = Circle(Plane=pt_2, Radius=[far_thres, near_thres])
vec2pt = Vector2Pt(PointA=flip, PointB=pt_2, Unitize=False)  # -> Vector, Length
larger = LargerThan(FirstNumber=vec2pt.Length, SecondNumber=far_thres)  # -> LargerThan, OrEqualTo
smaller = SmallerThan(FirstNumber=vec2pt.Length, SecondNumber=near_thres)  # -> SmallerThan, OrEqualTo
dispatch = Dispatch(List=vec2pt.Length, DispatchPattern=larger.LargerThan)  # -> ListA, ListB
dispatch_2 = Dispatch(List=flip, DispatchPattern=larger.LargerThan)  # -> ListA, ListB
eval = Evaluate(F="1-pow(d/th,2)", d=dispatch.ListB, th=far_thres)
pt_3 = Point(dispatch_2.ListA)
scale_nu = ScaleNU(Geometry=dispatch_2.ListB, Plane=pt_2, X=eval, Y=1, Z=1)  # -> Geometry, Transform
weave = Weave(Pattern=larger.LargerThan, Stream0=scale_nu.Geometry, Stream1=dispatch_2.ListA, NullGaps=False)
flip_2 = FlipMatrix(Data=weave)
intcrv = Interpolate(Vertices=flip_2, Degree=3, Periodic=False)  # -> Curve, Length, Domain

# ----
merge = Merge(Data1=_0_thres, Data2=_1_thres, Data3=_2_thres, Data4=_3_thres, Data5=_4_thres)
text_size = Slider(0.738, range=0..1)
graft = GraftTree(Tree=recgrid.Points, IncludeEmptyLists=True, IncludeNullItems=True)
xz = XZPlane(Origin=pt)
cir_2 = Circle(Plane=pt, Radius=merge)
swatch = ColourSwatch(SwatchColor=RGB(255, 255, 255))
vec2pt_2 = Vector2Pt(PointA=graft, PointB=pt, Unitize=False)  # -> Vector, Length
larger_2 = LargerThan(FirstNumber=vec2pt_2.Length, SecondNumber=merge)  # -> LargerThan, OrEqualTo
preview = CustomPreview(Geometry=[cir_2, pt], Shader=swatch)
tag = TextTag3D(Location=xz, Text=merge, Size=text_size, Colour=swatch, Justification=7)

# ---- group: initial curves
intcrv_2 = Interpolate(Vertices=recgrid.Points, Degree=3, Periodic=False, KnotStyle=1)  # -> Curve, Length, Domain

# ----
sort = SortList(Keys=vec2pt_2.Length, ValuesA=vec2pt_2.Vector, ValuesB=larger_2.LargerThan, ValuesC=merge, ValuesD=pt)  # -> Keys, ValuesA, ValuesB, ValuesC, ValuesD

# ---- group: Vector
item = ListItem(List=sort.ValuesA, Index=0, Wrap=True)

# ---- group: Pattern
item_2 = ListItem(List=sort.ValuesB, Index=0, Wrap=True)

# ---- group: Threshold
item_3 = ListItem(List=sort.ValuesC, Index=0, Wrap=True)

# ---- group: Attractor points
item_4 = ListItem(List=sort.ValuesD, Index=0, Wrap=True)

# ----
dispatch_3 = Dispatch(List=item_4, DispatchPattern=item_2)  # -> ListA, ListB

# ---- group: points
dispatch_4 = Dispatch(List=graft, DispatchPattern=item_2)  # -> ListA, ListB

# ---- group: vectors
dispatch_5 = Dispatch(List=item, DispatchPattern=item_2)  # -> ListA, ListB

# ---- group: Threshold
dispatch_6 = Dispatch(List=item_3, DispatchPattern=item_2)  # -> ListA, ListB

# ---- group: points affected magnitude
magnitude_text_size = Slider(0.33, range=0..1)
tag_2 = TextTag3D(
    Location=dispatch_4.ListB,
    Text=dispatch_6.ListB,
    Size=magnitude_text_size,
    Colour=ColourSwatch(SwatchColor=RGB(255, 255, 255)),
    Justification=7)

# ----
vlen = VectorLength(Vector=dispatch_5.ListB)
weird_formula = BooleanToggle(True)
eval_2 = Evaluate(F="1-pow(d/th,2)", d=vlen, th=dispatch_6.ListB)
subtraction = Subtraction(A="1", B=eval_2)
vcomp = Decompose(Vector=dispatch_5.ListB)  # -> XComponent, YComponent, ZComponent
filter = StreamFilter(Gate=weird_formula, Stream0=eval_2, Stream1=subtraction)
multiplication = Multiplication(A=vcomp.XComponent, B=filter)
z_amplifier = Slider(1, range=0..10)
multiplication_2 = Multiplication(A=dispatch_5.ListB, B=filter)
X = UnitX(Factor=multiplication)
abs = Absolute(Input=multiplication)
pt_4 = Point(dispatch_4.ListB)
move = Move(Geometry=dispatch_4.ListB, Translation=X)  # -> Geometry, Transform
multiplication_3 = Multiplication(A=abs, B=z_amplifier)
cir_3 = Circle(Plane=pt_4, Radius=0.5)
cir_4 = Circle(Plane=move.Geometry, Radius=0.3)
Z = UnitZ(Factor=multiplication_3)
preview_2 = CustomPreview(Geometry=cir_3, Shader=ColourSwatch(SwatchColor=RGB(176, 107, 167)))
preview_3 = CustomPreview(Geometry=cir_4, Shader=ColourSwatch(SwatchColor=RGB(242, 172, 233)))
vdis = VectorDisplay(Anchor=pt_4, Vector=dispatch_5.ListB, stops=[0: RGB(255, 0, 0), 0.5: RGB(255, 165, 0), 1: RGB(124, 252, 0)])
vdis_2 = VectorDisplay(Anchor=dispatch_4.ListB, Vector=multiplication_2, stops=[0: RGB(255, 0, 0), 0.5: RGB(255, 165, 0), 1: RGB(124, 252, 0)])
affect_z = BooleanToggle(True)
move_2 = Move(Geometry=move.Geometry, Translation=Z)  # -> Geometry, Transform
filter_2 = StreamFilter(Gate=affect_z, Stream0=move.Geometry, Stream1=move_2.Geometry)
weave_2 = Weave(Pattern=item_2, Stream0=filter_2, Stream1=dispatch_4.ListA, NullGaps=False)
pshift = ShiftPaths(Data=weave_2, Offset=-1)
flip_3 = FlipMatrix(Data=pshift)
pcomp = Decompose(Point=flip_3)  # -> XComponent, YComponent, ZComponent
sort_2 = SortList(Keys=pcomp.XComponent, ValuesA=flip_3)  # -> Keys, ValuesA
sort_points = BooleanToggle(False)
pt_5 = Point(pshift)
flip_4 = FlipMatrix(Data=sort_2.ValuesA)
filter_3 = StreamFilter(Gate=sort_points, Stream0=pshift, Stream1=flip_4)
intcrv_3 = Interpolate(Vertices=filter_3, Degree=3, Periodic=False, KnotStyle=1)  # -> Curve, Length, Domain
loft = Loft(
    Section=flatten(intcrv_3.Curve),
    Options={Adjust=False, Closed=False, LoftEnds=0, LoftSimp=0, LoftType=0, Rebuild=10, Refit=0.01})

# ---- group: Tagging
weave_3 = Weave(Pattern=item_2, Stream0=filter, Stream1="0", NullGaps=False)
pshift_2 = ShiftPaths(Data=weave_3, Offset=-1)
number_display_amplifier = Slider(100, range=0..100)
flip_5 = FlipMatrix(Data=pshift)
num = Number(pshift_2)
text_size_2 = Slider(0.184, range=0..1)
eval_3 = Evaluate(F="round((x*y),2)", x=num, y=number_display_amplifier)
y_shift = Slider(0.132, range=0..1)
flip_6 = FlipMatrix(Data=eval_3)
Y = UnitY(Factor=y_shift)
move_3 = Move(Geometry=flip_5, Translation=Y)  # -> Geometry, Transform
tag_3 = TextTag3D(
    Location=move_3.Geometry,
    Text=flip_6,
    Size=text_size_2,
    Colour=ColourSwatch(SwatchColor=RGB(255, 255, 255)),
    Justification=7)
points = PointList(Points=flip_5, Tags=True, Lines=True, Size=text_size_2)

# ----
previewmat = CustomPreviewMaterials(Geometry=loft, DiffuseColor=RGB(255, 255, 255))
previewlw = CustomPreviewLineweights(Geometry=intcrv_3.Curve, Shader=ColourSwatch(SwatchColor=RGB(0, 0, 0)), Absolute=False)
