# Grasshopper definition 20161027_a3_XX_fields basics.gh (Grasshopper 0.9.76)
# Copyright: Co-de-iT
# plug-ins: Human

curve_sample_density = Slider(30, range=10..50)
display_density = Slider(80, range=10..500)
grid_size = Slider(80, range=0..100)

display_density_2 = Slider(80, range=10..500)
# custom field
grid_size_2 = Slider(80, range=0..100)
# charges
pt = Point([<point referenced from the Rhino model> x3])

merge = Merge(Data1=Slider(10, range=0..10), Data2=Slider(10, range=0..10), Data3=Slider(10, range=0..10))
lng = ListLength(List=pt)
random = Random(Range="0 to 2*Pi", Number=lng, Seed=Slider(3, range=1..20))
# generate vectors
X = UnitX(Factor=merge)
Z = UnitZ(Factor=1)
vrot = Rotate(Vector=X, Axis=Z, Angle=random)

division = Division(A=grid_size_2, B=display_density_2)
# File template
# 
# © a3 2016 _ Creative Commons Attribution-NonCommercial-ShareAlike3.0 UnportedLicense.
pt_2 = Point(<point referenced from the Rhino model>)
pt_3 = Point(<point referenced from the Rhino model>)
pt_4 = Point([<point referenced from the Rhino model> x3])

# ----
# generated charges
number_slider = Slider(0.6, range=0..1)
rectangle = Rectangle(Plane=PlaneXY(0, 0, 0), XSize=grid_size, YSize=grid_size, Radius=0)  # -> Rectangle, Length
division_2 = Division(A=grid_size, B="2")
pt_5 = ConstructPoint(XCoordinate=division_2, YCoordinate=division_2, ZCoordinate=0)
scale = Scale(Geometry=rectangle.Rectangle, Center=pt_5, Factor=number_slider)  # -> Geometry, Transform
yz = YZPlane(Origin=pt_5)
pop2d = Populate2D(Region=scale.Geometry, Count=Slider(6, range=2..50), Seed=Slider(2, range=1..50))
lng_2 = ListLength(List=pop2d)
random_2 = Random(Range=Domain(0, 1), Number=lng_2, Seed=2)
int = Integer(random_2)
expression = Expression(x=int, Expression="x*2-1")
mirror = Mirror(Geometry=pop2d, Plane=yz)  # -> Geometry, Transform
merge_2 = Merge(Data1=pop2d, Data2=mirror.Geometry)
merge_3 = Merge(Data1=expression, Data2=expression)

pt_6 = Point(Point(100, 0, 0))

# ----
# sampling grid
sqgrid = Square(Plane=pt_6, Size=division, ExtentX=display_density_2, ExtentY=display_density_2)  # -> simplify(graft(Cells)), simplify(graft(Points))
explode = Explode(Curve=sqgrid.Cells, Recursive=True)  # -> Segments, Vertices
cull_i = CullIndex(List=explode.Vertices, Indices="-1", Wrap=True)
points = ValueList({"cell corners": 0, "cell centers": 1}, selected="cell centers")
avr = Average(Input=cull_i)  # -> simplify(ArithmeticMean)
filter = StreamFilter(Gate=points, Stream0=sqgrid.Points, Stream1=avr)

merge_4 = Merge(Data1=Slider(-1, range=-1..1), Data2=Slider(0.486, range=-1..1), Data3=Slider(-0.528, range=-1..1))
merge_5 = Merge(Data1=Slider(8.261, range=1..50), Data2=Slider(23.606, range=1..50), Data3=Slider(17.517, range=1..50))
merge_6 = Merge(Data1=Slider(1, range=-1..1), Data2=Slider(-1, range=-1..1), Data3=Slider(-0.873, range=-1..1))
ln = Line(StartPoint=pt_2, EndPoint=pt_3)
multiplication = Multiplication(A=merge_6, B=Slider(10, range=10..1000))

swatch = ColourSwatch(SwatchColor=RGB(255, 255, 255))
vdisex = VectorDisplayEx(Point=pt, Vector=vrot, Colour=swatch, Width=2)
# display charges
dots = DotDisplay(Point=pt, Colour=swatch, Size=0.5)

# ----
# “All grids are fields, but not all fields are grids. One of the potentials of the field is to redefine the relation between figure and ground. If we think of the figure not as a demarcated object read against a stable field, but as an effect emerging from the field itself – as moments of intensity, as peaks or valley within a continuous field – than it might be possible to imagine figure and field as more closely allied. (…)”
# Stan Allen
# point charge
pcharge = PointCharge(Point=pt_2, Charge=Slider(1, range=0..1), Decay=Slider(1.258, range=0..3))
# spin force
fspin = SpinForce(Plane=pt_3, Strength=Slider(1, range=0..1), Radius=Slider(27.26, range=1..50), Decay=2)
# line charge
lcharge = LineCharge(Line=ln, Charge=Slider(1, range=0..1))
# vector charge
fvector = VectorForce(Line=ln)
pcharge_2 = PointCharge(Point=pt_4, Charge=multiplication, Decay=2)
fspin_2 = SpinForce(Plane=pt_4, Strength=merge_4, Radius=merge_5, Decay=2)

# ----
# combining
# multiple fields
mergef = MergeFields(Fields=pcharge_2)
mergef_2 = MergeFields(Fields=[pcharge_2, fspin_2])

field_type = ValueList({"point charge": 0, "spin force": 1, "line charge": 2, "vector charge": 3, "composite": 4, "composite 2": 5, "symmetric": 6}, selected="composite 2")

# ----
# weighted average
cps = ClosestPoints(Point=filter, Cloud=pt, Count=lng)  # -> ClosestPoint, CPIndex, Distance
addition = Addition(A=cps.Distance, B=1)
one_over_x = OneOverX(Value=addition)
item = ListItem(List=vrot, Index=cps.CPIndex, Wrap=True)
pow = Power(A=one_over_x, B=Slider(2.618, range=0..3))
multiplication_2 = Multiplication(A=item, B=pow)
avr_2 = Average(Input=multiplication_2)
unit = UnitVector(Vector=avr_2)
vdisex_2 = VectorDisplayEx(Point=filter, Vector=unit, Colour=RGB(0, 0, 0), Width=2)

# ----
# closest charge
cp = ClosestPoint(Point=filter, Cloud=pt)  # -> ClosestPoint, CPIndex, Distance
addition_2 = Addition(A=cp.Distance, B=1)
item_2 = ListItem(List=vrot, Index=cp.CPIndex, Wrap=True)
one_over_x_2 = OneOverX(Value=addition_2)
multiplication_3 = Multiplication(A=item_2, B=one_over_x_2)
unit_2 = UnitVector(Vector=multiplication_3)
vdisex_3 = VectorDisplayEx(Point=filter, Vector=unit_2, Colour=RGB(0, 0, 0), Width=2)

pcharge_3 = PointCharge(Point=merge_2, Charge=merge_3, Decay=2)
mergef_3 = MergeFields(Fields=pcharge_3)
# stream filter
filter_2 = StreamFilter(
    Gate=field_type,
    Stream0=pcharge,
    Stream1=fspin,
    Stream2=lcharge,
    Stream3=fvector,
    Stream4=mergef,
    Stream5=mergef_2,
    Stream6=mergef_3)

# ----
# display charges
filter_3 = StreamFilter(Gate=field_type, Stream0=pt_2, Stream1=pt_3, Stream2=ln, Stream3=ln, Stream4=pt_4, Stream5=pt_4, Stream6=merge_2)
gate = StreamGate(Stream=filter_3, Gate=field_type)  # -> Target0, Target1, Target2, Target3, Target4, Target5, Target6
previewlw = CustomPreviewLineweights(Geometry=[gate.Target2, gate.Target3], Shader=ColourSwatch(SwatchColor=RGB(0, 0, 0)), Thickness=2, Absolute=False)
dots_2 = DotDisplay(Point=[gate.Target0, gate.Target1, gate.Target4, gate.Target5, gate.Target6], Colour=RGB(0, 0, 0), Size=0.5)

division_3 = Division(A=grid_size, B=display_density)
sqgrid_2 = Square(Plane=PlaneXY(0, 0, 0), Size=division_3, ExtentX=display_density, ExtentY=display_density)  # -> Cells, graft(Points)
explode_2 = Explode(Curve=sqgrid_2.Cells, Recursive=True)  # -> Segments, Vertices
cull_i_2 = CullIndex(List=explode_2.Vertices, Indices="-1", Wrap=True)
points_2 = ValueList({"cell corners": 0, "cell centers": 1}, selected="cell centers")
avr_3 = Average(Input=cull_i_2)  # -> simplify(graft(ArithmeticMean))
filter_4 = StreamFilter(Gate=points_2, Stream0=sqgrid_2.Points, Stream1=avr_3)
evf = EvaluateField(Field=filter_2, Point=filter_4)  # -> Tensor, Strength
pow_2 = Power(A=evf.Strength, B=Slider(0.002, range=0..1))
bnd = Bounds(Numbers=flatten(pow_2))
dom = ConstructDomain(DomainStart=Slider(0.128, range=0..2), DomainEnd=Slider(2, range=0..2))
remap = RemapNumbers(Value=pow_2, Source=bnd, Target=dom)  # -> Mapped, Clipped
amp = Amplitude(Vector=evf.Tensor, Amplitude=remap.Mapped)
# a better tensor display
vdisex_4 = VectorDisplayEx(Point=filter_4, Vector=amp, Colour=RGB(0, 0, 0), Width=2)

md_slider = MDSlider(
    slider_value=Point(0.4059463129, 0.2598322426, 0.5),
    SliderMode=0,
    x_domain=Domain(0, 1),
    y_domain=Domain(0, 1),
    z_domain=Domain(0, 1))

# ----
# sampling grid for field lines
division_4 = Division(A=grid_size, B=curve_sample_density)
sqgrid_3 = Square(Plane=PlaneXY(0, 0, 0), Size=division_4, ExtentX=curve_sample_density, ExtentY=curve_sample_density)  # -> Cells, Points

multiplication_4 = Multiplication(A=md_slider, B=grid_size)

evf_2 = EvaluateField(Field=filter_2, Point=multiplication_4)  # -> Tensor, Strength
Z_2 = UnitZ(Factor=1)
vrot_2 = Rotate(Vector=evf_2.Tensor, Axis=Z_2, Angle=3.141592654)
unit_3 = UnitVector(Vector=vrot_2)
addition_3 = Addition(A=multiplication_4, B=unit_3)
# evaluate field
swatch_2 = ColourSwatch(SwatchColor=RGB(255, 255, 255))
swatch_3 = ColourSwatch(SwatchColor=RGB(255, 255, 255))
dots_3 = DotDisplay(Point=multiplication_4, Colour=swatch_2, Size=Slider(0.25, range=0..1))
vdisex_5 = VectorDisplayEx(Point=multiplication_4, Vector=evf_2.Tensor, Colour=swatch_3, Width=2)
tag = TextTag3D(Location=addition_3, Text=evf_2.Strength, Size=1, Colour=swatch_3, Justification=7)

Z_3 = UnitZ(Factor=Slider(0, range=-10..10))
crv = Curve(rectangle.Rectangle)
move = Move(Geometry=crv, Motion=Z_3)  # -> Geometry, Transform

fline = FieldLine(Field=filter_2, Point=sqgrid_3.Points, Steps=Slider(200, range=100..1000), Accuracy=0.1, Method=1)
# field lines
previewlw_2 = CustomPreviewLineweights(Geometry=fline, Shader=ColourSwatch(SwatchColor=RGB(89, 112, 117)), Absolute=False)

# ----
# perpendicular display
fperp = PerpendicularDisplay(Field=filter_2, Section=move.Geometry, Samples=1000, PositiveColour=RGB(255, 255, 255), NegativeColour=RGB(0, 0, 0))
# display field
# direction display
fdir = DirectionDisplay(Field=filter_2, Section=crv, Samples=1000)
# scalar display
fscalar = ScalarDisplay(Field=filter_2, Section=crv, Samples=1000)
# tensor display
ftensor = TensorDisplay(Field=filter_2, Section=crv, Samples=1000)
