# Grasshopper definition 20161103_a3XX_Kangaroo advanced.gh (Grasshopper 0.9.76)
# Copyright: Co-de-iT
# plug-ins: Human, Weaverbird, Kangaroo2 Components

number_slider = Slider(3, range=1..3)
# base point
pt = Point(Point(0, 0, 0))

number_slider_2 = Slider(5, range=3..10)
# File template
# 
# © a3 2016 _ Creative Commons Attribution-NonCommercial-ShareAlike3.0 UnportedLicense.
# random lines generation
number_slider_3 = Slider(111.286, range=0..300)
height = Slider(300, range=0..300)
top_circle_scale = Slider(0.452, range=0.1..1)
Z = UnitZ(Factor=height)
random = Random(Range="0 to 2*PI", Number=number_slider_2, Seed=Slider(12, range=0..100))
random_2 = Random(Range=number_slider_3, Number=number_slider_2, Seed=2)
pt_2 = PointPolar(BasePlane=pt, XYAngle=random, ZAngle=0, Offset=random_2)
cir = Circle(Plane=pt, Radius=number_slider_3)
move = Move(Geometry=pt, Motion=Z)  # -> Geometry, Transform
move_2 = Move(Geometry=pt_2, Motion=Z)  # -> Geometry, Transform
scale = Scale(Geometry=move_2.Geometry, Center=move.Geometry, Factor=top_circle_scale)  # -> Geometry, Transform
jitter = Jitter(List=scale.Geometry, Jitter=1, Seed=2)  # -> Values, Indices
ln = Line(StartPoint=pt_2, EndPoint=jitter.Values)

mesh = Mesh(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)
wbtriangles = WeaverbirdsSplitTrianglesSubdivision(MeshCurves=mesh, Level=number_slider)
wbtriangles_2 = WeaverbirdsSplitTrianglesSubdivision(MeshCurves=wbtriangles, Level=number_slider)
wbsplitquads = WeaverbirdsConstantQuadsSplitSubdivision(MeshCurves=wbtriangles_2, Level=1, SmoothNakedEdges=0)
wbtriangles_3 = WeaverbirdsSplitTrianglesSubdivision(MeshCurves=wbtriangles_2, Level=Slider(2, range=1..3))
demesh = DeconstructMesh(Mesh=wbsplitquads)  # -> Vertices, Faces, Colours, Normals
deface = DeconstructFace(Face=graft(demesh.Faces))  # -> CornerA, CornerB, CornerC, CornerD
merge = Merge(Data1=deface.CornerA, Data2=deface.CornerB, Data3=deface.CornerC, Data4=deface.CornerD)
wbedges = WeaverbirdsMeshEdges(MeshOrPolylines=wbsplitquads)
number_slider_4 = Slider(10.5, range=0..20)
demesh_2 = DeconstructMesh(Mesh=mesh)  # -> Vertices, Faces, Colours, Normals
item = ListItem(List=demesh.Vertices, Index=merge, Wrap=True)  # -> simplify(Item)
item_2 = ListItem(List=item, Index=0, Wrap=True)  # -> Item, Item1, Item2, Item3
ln_2 = Line(StartPoint=item_2.Item, EndPoint=item_2.Item2)
anchor = Anchor(Point=demesh_2.Vertices, Strength=1000)
hinge = Hinge(
    FoldStart=item_2.Item,
    FoldEnd=item_2.Item2,
    Tip1=item_2.Item1,
    Tip2=item_2.Item3,
    RestAngle=Slider(0, range=0..1.571),
    Strength=Slider(0, range=0..500))
show = Show(G=wbsplitquads)
equallength = EqualLength(Line=wbedges, Strength=Slider(200, range=0..200))
length_line = LengthLine(Line=wbedges, Strength=Slider(200, range=0..200))
solver = Solver(
    GoalObjects=[hinge, show, length_line, anchor, equallength],
    Reset=Button(),
    Threshold=1e-15,
    Tolerance=0.01,
    On=Toggle(False))  # -> I, V, O
mesh_2 = Mesh(solver.O)
previewmat = CustomPreviewMaterials(Geometry=mesh_2, DiffuseColor=RGB(255, 255, 255))
Z_2 = UnitZ(Factor=Slider(0.25, range=-100..100))

# ----
# extra springs
number_slider_5 = Slider(25.25, range=0..50)
# kangaroo simulation
divide = DivideCurve(Curve=ln, Count=Slider(33, range=10..100), Kinks=False)  # -> Points, Tangents, Parameters
reset = Button()
kangaroo_on = BooleanToggle(False)
item_3 = ListItem(List=divide.Points, Index=0, Wrap=True)  # -> Item1, Item
Z_3 = UnitZ(Factor=number_slider_5)
rev = Reverse(Vector=Z_3)
panel = Panel("""1
-3""")
move_3 = Move(Geometry=item_3.Item, Motion=Z_3)  # -> Geometry, Transform
move_4 = Move(Geometry=item_3.Item1, Motion=rev)  # -> Geometry, Transform
replace = ReplaceItems(List=divide.Points, Item=[move_3.Geometry, move_4.Geometry], Indices=panel, Wrap=True)
toggle = BooleanToggle(False)
bishift = DoubleShift(list=replace, wrap=toggle)  # -> no_last, no_first
item_4 = ListItem(List=replace, Index=0, Wrap=True)  # -> Item2, Item1, Item, Item1_2
ln_3 = Line(StartPoint=bishift.no_last, EndPoint=bishift.no_first)
bishift_2 = DoubleShift(list=ln_3, wrap=toggle)  # -> no_last, no_first
angle = Angle(LineA=bishift_2.no_last, LineB=bishift_2.no_first, RestAngle="0", Strength=Slider(500, range=1..500))
anchor_2 = Anchor(Point=[item_4.Item2, item_4.Item1, item_4.Item, item_4.Item1_2], Strength=1000)
length_line_2 = LengthLine(Line=ln_3, Strength=10)
join = JoinCurves(Curves=ln_3, Preserve=False)
show_2 = Show(G=join)

avr = Average(Input=flatten(replace))
move_5 = Move(Geometry=avr, Motion=Z_2)  # -> Geometry, Transform

cp = ClosestPoint(Point=move_5.Geometry, Cloud=divide.Points)  # -> ClosestPoint, CPIndex, Distance
con = DelaunayEdges(Points=flatten(cp.ClosestPoint), Plane=PlaneXY(0, 0, 0))  # -> Connectivity, Edges
ln_4 = Line(StartPoint=move_5.Geometry, EndPoint=cp.ClosestPoint)  # -> flatten(Line)
length_line_3 = LengthLine(Line=[ln_4, con.Edges], Length=Slider(58.504, range=0..100), Strength=Slider(500, range=1..500))

solver_2 = Solver(
    GoalObjects=[show_2, anchor_2, length_line_2, length_line_3, angle],
    Reset=reset,
    Threshold=1e-15,
    Tolerance=0.01,
    On=kangaroo_on)  # -> I, V, O
clean = CleanTree(RemoveNulls=True, RemoveInvalid=True, RemoveEmpty=False, Tree=solver_2.O)

explode = Explode(Curve=clean, Recursive=True)  # -> Segments, Vertices
lng = ListLength(List=explode.Vertices)
larger = LargerThan(FirstNumber=lng, SecondNumber=2)  # -> LargerThan, OrEqualTo
dispatch = Dispatch(List=clean, DispatchPattern=flatten(larger.LargerThan))  # -> ListA, ListB
dispatch_2 = Dispatch(List=explode.Vertices, DispatchPattern=larger.LargerThan)  # -> ListA, ListB
clean_2 = CleanTree(RemoveNulls=True, RemoveInvalid=True, RemoveEmpty=True, Tree=dispatch_2.ListA)  # -> simplify(Tree)
clean_3 = CleanTree(RemoveNulls=True, RemoveInvalid=True, RemoveEmpty=True, Tree=dispatch.ListA)  # -> simplify(Tree)
pt_3 = Point(clean_2)
crv = Curve(graft(clean_3))
preview = CustomPreview(Geometry=crv, Shader=ColourSwatch(SwatchColor=RGB(46, 46, 46)))

# ==== cluster DoubleShift: Shifts a list +1 and -1, wrap option available
list = ClusterInput()
wrap = ClusterInput()
shift = ShiftList(List=list, Shift=1, Wrap=wrap)
shift_2 = ShiftList(List=list, Shift="-1", Wrap=wrap)
no_last = ClusterOutput(shift_2)
no_first = ClusterOutput(shift)
