# Grasshopper definition 20161103_a3XX_Kangaroo basics.gh (Grasshopper 0.9.76)
# Copyright: Co-de-iT
# plug-ins: MeshEdit Components, Kangaroo Components, Weaverbird, Kangaroo2 Components

pt = Point([<point referenced from the Rhino model> x4])

planarization_strength = Slider(10000, range=1..10000)
length = Slider(0.753, range=0..2)
gravity = Slider(0, range=0..10)
spring_stiffness = Slider(1.4, range=0..10)
anchor_height = Slider(0, range=0..50)

# ----
# kangaroo & weaverbird
mesh = Mesh(<mesh referenced from the Rhino model>)
# NOTE
# Kangaroo physics principles: the basic principle of Kangaroo Physics is Hooke's law: by translating geometries in networks of particles and springs it is possible to simulate a linear interpolation of energy distribution.
# 
# Therefore:
# 
# . any point (or vertex) is interpreted as a particle, which movement is determined by the interaction of forces acting upon it
# 
# . any line or segment is interpreted as a spring, with a rest length and stiffness value; springs exert their forces upon particles
# keep only one Kangaroo
# component active and
# running at a time!!!
# catenary
invert_gravity = BooleanToggle(True)
# dome
conmesh = ConstructMesh(Vertices=pt, Faces={A=0, B=1, C=2, D=3})
pt_2 = Point(Point(30, 0, 0))
wbtriangles = WeaverbirdsSplitTrianglesSubdivision(MeshCurves=mesh, Level=Slider(3, range=1..3))
wbsplitquads = WeaverbirdsConstantQuadsSplitSubdivision(MeshCurves=conmesh, Level="3", SmoothNakedEdges=0)
Y = UnitY(Factor=Slider(200, range=0.01..200))
wbsplitquads_2 = WeaverbirdsConstantQuadsSplitSubdivision(MeshCurves=wbsplitquads, Level="1", SmoothNakedEdges=0)
Z = UnitZ(Factor=anchor_height)
dispatch = Dispatch(List=pt, DispatchPattern=[True, False])  # -> ListA, ListB
move = Move(Geometry=pt_2, Motion=Y)  # -> Geometry, Transform
wbloop = WeaverbirdsLoopSubdivision(MeshCurves=wbtriangles, Level=Slider(1, range=1..3), SmoothNakedEdges=0)

rest_angle = Slider(0, range=-90..90)

range = Range(Domain=Domain(0, 1), Steps=10)
ln = Line(StartPoint=pt_2, EndPoint=move.Geometry)
demesh = DeconstructMesh(Mesh=wbsplitquads_2)  # -> Vertices, Faces, Colours, Normals
medges = MeshEdges(Mesh=wbsplitquads_2)  # -> NakedEdges, InteriorEdges, NonManifoldEdges
number_slider = Slider(0.126, range=0..2)
medges_2 = MeshEdges(Mesh=wbloop)  # -> NakedEdges, InteriorEdges, NonManifoldEdges
number_slider_2 = Slider(-0.39, range=-1..0)
divide = DivideCurve(Curve=ln, Count=Slider(20, range=5..100), Kinks=False)  # -> Points, Tangents, Parameters
nv = NakedVertices(Mesh=wbloop)  # -> ClothedIndex, NakedIndex, ClothedPts, NakedPts
crv = Curve([medges.NakedEdges, medges.InteriorEdges])
move_2 = Move(Geometry=dispatch.ListB, Motion=Z)  # -> Geometry, Transform
len = Length(Curve=medges_2.InteriorEdges)
line = LineSDL(Start=dispatch.ListB, Direction=Z, Length=anchor_height)
gravity_2 = Slider(-0.003, range=-1..0)
len_2 = Length(Curve=crv)
shatter = Shatter(Curve=ln, Parameters=divide.Parameters)
bishift = DoubleShift(list=shatter, wrap=Toggle(False))  # -> no_last, no_first
rad = Radians(Degrees=rest_angle)
variable_rest_angle = BooleanToggle(True)
multiplication = Multiplication(A=len, B=number_slider)
lng = ListLength(List=bishift.no_last)
multiplication_2 = Multiplication(A=len_2, B=length)
mesh_2 = Mesh(<mesh referenced from the Rhino model>)
Z_2 = UnitZ(Factor=gravity)
pt_3 = Point(nv.NakedPts)
range_2 = Range(Domain=rad, Steps=expr("x-1", lng))
length_line = LengthLine(Line=medges_2.InteriorEdges, Length=number_slider, Strength=10)
neg = Negative(Value=gravity_2)
# File template
# 
# © a3 2016 _ Creative Commons Attribution-NonCommercial-ShareAlike3.0 UnportedLicense.
# single spring
gravity_3 = Slider(-0.05, range=-1..0)
# anchor
pt_4 = Point(Point(0, 0, 0))
# free particle
pt_5 = Point(Point(0, 20, 0))
show = Show(G=wbloop)
wbtriangles_2 = WeaverbirdsSplitTrianglesSubdivision(MeshCurves=mesh_2, Level=Slider(2, range=1..3))
length_line_2 = LengthLine(Line=crv, Length=multiplication_2, Strength=spring_stiffness)
anchor = Anchor(Point=[dispatch.ListA, move_2.Geometry], Strength=1000)
planarize = Planarize(M=wbsplitquads_2, Strength=planarization_strength)
filter = StreamFilter(Gate=variable_rest_angle, Stream0=rad, Stream1=range_2)
load = Load(Point=demesh.Vertices, ForceVector=Z_2)
show_2 = Show(G=wbsplitquads_2)
anchor_2 = Anchor(Point=pt_3, Strength=Slider(10000, range=100..10000))
filter_2 = StreamFilter(Gate=invert_gravity, Stream0=gravity_2, Stream1=neg)
Z_3 = UnitZ(Factor=filter_2)
wbtriangles_3 = WeaverbirdsSplitTrianglesSubdivision(MeshCurves=wbtriangles_2, Level=Slider(3, range=1..3))
angle = Angle(LineA=bishift.no_last, LineB=bishift.no_first, RestAngle=filter, Strength=Slider(460.8, range=0..1000))
anchor_3 = Anchor(Point=[pt_2, move.Geometry], Strength=1000)
length_line_3 = LengthLine(Line=shatter, Length=Slider(20, range=0..20), Strength=Slider(1.296, range=0..10))
load_2 = Load(Point=divide.Points, ForceVector=Z_3)
solver = Solver(GoalObjects=[show, anchor_2, length_line], Reset=Button(), Threshold=1e-15, Tolerance=0.01, On=Toggle(False))  # -> I, V, O
ln_2 = Line(StartPoint=pt_5, EndPoint=pt_4)
Z_4 = UnitZ(Factor=gravity_3)
mesh_3 = Mesh(solver.O)
# springs
# anchors
# (fixed points)
anchor_4 = Anchor(Point=pt_4, Strength=1000)
length_line_4 = LengthLine(Line=ln_2, Length=Slider(7.68, range=0..20), Strength=Slider(0.1, range=0..10))
solver_2 = Solver(
    GoalObjects=[load, anchor, show_2, length_line_2, planarize],
    Reset=Button(),
    Threshold=1e-15,
    Tolerance=0.01,
    On=Toggle(False))  # -> I, V, O
solver_3 = Solver(GoalObjects=[length_line_3, anchor_3, load_2, angle], Reset=Button(), Threshold=1e-15, Tolerance=0.01, On=Toggle(False))  # -> I, V, O
# linear vector force
# (acts directly on particles)
load_3 = Load(Point=pt_5, ForceVector=Z_4)
mjoin = MeshJoin(Meshes=flatten([mesh_3, wbtriangles_3]))
button = Button()
toggle = BooleanToggle(False)
crv_2 = Curve(solver_3.O)
weldvertices = MeshWeldVertices(Mesh=mjoin, Tolerance=Slider(0.131, range=0..1))  # -> RuntimeMessage, Mesh

# ----
# components as filters: Sometimes red is ok.
# 
# These components turn red because they fail to convert data into anything that is not what they should contain (curves, meshes). In doing so, they filter through only the appropriate type.
crv_3 = Curve(solver_2.O)
mesh_4 = Mesh(solver_2.O)

preview = CustomPreview(Geometry=crv_2, Shader=ColourSwatch(SwatchColor=RGB(255, 255, 255)))
cloud = CloudDisplay(Points=solver_3.V, Colours=ColourSwatch(SwatchColor=RGB(0, 0, 0)), Size=1, SpriteType=0)
unifynormals = MeshUnifyNormals(Mesh=weldvertices.Mesh)
explode = MeshExplode(Mesh=mesh_4, Interpolate=False)
panel = Panel(weldvertices.RuntimeMessage)

# ----
# regular
solver_4 = Solver(Reset=button, Threshold=1e-15, Tolerance=0.01, On=toggle)  # -> I, V, O
# (keep active just one of the two)
# bouncy
solver_bouncy = SolverBouncy(
    GoalObjects=[length_line_4, anchor_4, load_3],
    Reset=button,
    Threshold=1e-15,
    Tolerance=0.01,
    Damping=Slider(0.96, range=0..1),
    Iterations=10,
    On=toggle)  # -> I, V, O; disabled

# ----
# verify planarity
clean = CleanTree(RemoveNulls=True, RemoveInvalid=True, RemoveEmpty=True, Tree=explode)  # -> graft(Tree)
wbloop_2 = WeaverbirdsLoopSubdivision(MeshCurves=unifynormals, Level=Slider(2, range=1..3), SmoothNakedEdges="1")  # disabled

wbfacepolys = WeaverbirdsFacePolylines(Mesh=clean)
planar = Planar(Curve=wbfacepolys)  # -> Planar, Plane, Deviation
dispatch_2 = Dispatch(List=clean, DispatchPattern=planar.Planar)  # -> ListA, ListB
mcol = MeshColours(Mesh=dispatch_2.ListA, Colours=ColourSwatch(SwatchColor=RGB(255, 255, 255)))
mcol_2 = MeshColours(Mesh=dispatch_2.ListB, Colours=ColourSwatch(SwatchColor=RGB(0, 0, 0)))
explode_2 = MeshExplode(Mesh=dispatch_2.ListA, Interpolate=False)
demesh_2 = DeconstructMesh(Mesh=explode_2)  # -> Vertices, Faces, Colours, Normals
item = ListItem(List=demesh_2.Vertices, Index=0, Wrap=True)  # -> Item, Item1, Item2, Item3
avr = Average(Input=demesh_2.Normals)
ln_3 = Line(StartPoint=item.Item, EndPoint=item.Item2)
ln_4 = Line(StartPoint=item.Item1, EndPoint=item.Item3)
multiplication_3 = Multiplication(A=avr, B=Slider(3, range=1..3))
llx = LineLine(Line1=ln_3, Line2=ln_4)  # -> ParamA, ParamB, PointA, PointB
move_3 = Move(Geometry=llx.PointA, Motion=multiplication_3)  # -> Geometry, Transform
dist = Distance(PointA=llx.PointA, PointB=llx.PointB)
bnd = Bounds(Numbers=flatten(dist))
remap = RemapNumbers(Value=dist, Source="0 to 0.1", Target=Domain(0, 1))  # -> Mapped, Clipped
gradient = Gradient(LowerLimit=0, UpperLimit=1, Parameter=remap.Mapped, stops=[0: RGB(0, 128, 0), 0.5: RGB(255, 255, 0), 1: RGB(255, 0, 0)])
cloud_2 = CloudDisplay(Points=move_3.Geometry, Colours=gradient, Size=Slider(4.003, range=1..10), SpriteType=0)

X = UnitX(Factor="20")
# composite catenary
pt_6 = Point(Point(30, 0, 0))
move_4 = Move(Geometry=pt_6, Motion=X)  # -> Geometry, Transform
Y_2 = UnitY(Factor=Slider(200, range=0.01..200))
move_5 = Move(Geometry=move_4.Geometry, Motion=Y_2)  # -> Geometry, Transform
invert_gravity_2 = BooleanToggle(True)
range_3 = Range(Domain=Domain(0, 1), Steps=10)
ln_5 = Line(StartPoint=move_4.Geometry, EndPoint=move_5.Geometry)
divide_2 = DivideCurve(Curve=ln_5, Count=Slider(20, range=5..100), Kinks=False)  # -> Points, Tangents, Parameters

dom = ConstructDomain(DomainStart=Slider(4, range=1..18), DomainEnd=Slider(16, range=1..18))
subset = SubList(List=divide_2.Points, Domain=dom, Wrap=True)  # -> List, Index
item_2 = ListItem(List=subset.List, Index=0, Wrap=True)  # -> Item1, Item
ln_6 = Line(StartPoint=item_2.Item, EndPoint=item_2.Item1)
divide_3 = DivideCurve(Curve=ln_6, Count=Slider(20, range=5..100), Kinks=False)  # -> Points, Tangents, Parameters
move_6 = Move(Geometry=divide_3.Points, Motion=Vector(0, 0, 10))  # -> Geometry, Transform
merge = Merge(Data1=flatten(item_2.Item), Data2=flatten(move_6.Geometry), Data3=flatten(item_2.Item1))
pline = PolyLine(Vertices=merge, Closed=False)
explode_3 = Explode(Curve=pline, Recursive=True)  # -> Segments, Vertices

gravity_4 = Slider(-0.003, range=-1..0)
lng_2 = ListLength(List=divide_3.Points)
shatter_2 = Shatter(Curve=ln_5, Parameters=divide_2.Parameters)
neg_2 = Negative(Value=gravity_4)
multiplication_4 = Multiplication(A=lng_2, B=Slider(0.5, range=0..1))
filter_3 = StreamFilter(Gate=invert_gravity_2, Stream0=gravity_4, Stream1=neg_2)
item_3 = ListItem(List=move_6.Geometry, Index=multiplication_4, Wrap=True)
cp = ClosestPoint(Point=item_3, Cloud=divide_2.Points)  # -> ClosestPoint, CPIndex, Distance
Z_5 = UnitZ(Factor=filter_3)
ln_7 = Line(StartPoint=item_3, EndPoint=cp.ClosestPoint)
length_line_5 = LengthLine(Line=[shatter_2, explode_3.Segments], Length=Slider(15, range=0..20), Strength=Slider(1, range=0..10))
anchor_5 = Anchor(Point=[move_4.Geometry, move_5.Geometry], Strength=1000)
length_line_6 = LengthLine(Line=ln_7, Length=Slider(50, range=0..50), Strength=Slider(6.5, range=0..10))
load_4 = Load(Point=[divide_2.Points, merge], ForceVector=Z_5)
solver_5 = Solver(
    GoalObjects=[length_line_5, anchor_5, load_4, length_line_6],
    Reset=Button(),
    Threshold=1e-15,
    Tolerance=0.01,
    On=Toggle(False))  # -> I, V, O
crv_4 = Curve(solver_5.O)
preview_2 = CustomPreview(Geometry=crv_4, Shader=ColourSwatch(SwatchColor=RGB(255, 255, 255)))
cloud_3 = CloudDisplay(Points=solver_5.V, Colours=ColourSwatch(SwatchColor=RGB(0, 0, 0)), Size=1, SpriteType=0)

# ==== cluster DoubleShift: Shifts a list +1 and -1, wrap option available
list = ClusterInput()
wrap = ClusterInput()
shift = ShiftList(List=list, Shift=1, Wrap=wrap)
shift_2 = ShiftList(List=list, Shift="-1", Wrap=wrap)
no_last = ClusterOutput(shift_2)
no_first = ClusterOutput(shift)
