# Grasshopper definition 20161103_a3XX_Kangaroo sculpt_example.gh (Grasshopper 0.9.76)
# plug-ins: Human, MeshDual, Kangaroo2 Components

mesh = Mesh(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)
mesh_2 = Mesh(mesh)
# Mesh sculpt with Kangaroo
# 
# from: http://www.grasshopper3d.com/group/kangaroo/page/kangaroo2-additional-examples
# 
# © a3 2016 _ Creative Commons Attribution-NonCommercial-ShareAlike3.0 UnportedLicense.
medges = MeshEdges(Mesh=mesh)  # -> NakedEdges, InteriorEdges, NonManifoldEdges
join = JoinCurves(Curves=medges.NakedEdges, Preserve=False)
faceb = FaceBoundaries(Mesh=mesh_2)
demesh = DeconstructMesh(Mesh=mesh_2)  # -> Vertices, Faces, Colours, Normals
medges_2 = MeshEdges(Mesh=mesh_2)  # -> NakedEdges, InteriorEdges, NonManifoldEdges
explode = Explode(Curve=join, Recursive=True)  # -> Segments, Vertices
explode_2 = Explode(Curve=faceb, Recursive=True)  # -> Segments, Vertices
shift = ShiftList(List=explode.Segments, Shift=1, Wrap=True)
clamplength = ClampLength(Line=medges_2.InteriorEdges, LowerLimit=1, UpperLimit=4, Strength=5)
angle = Angle(LineA=explode.Segments, LineB=shift, RestAngle=0, Strength=5)
# Plastic anchors have a memory. If you need to reset this, one easy way is to select your entire Grasshopper definition using Ctrl-A, then cut and paste it back with Ctrl-X, Ctrl-V
plasticanchor = PlasticAnchor(Point=demesh.Vertices, Limit=0.05, Strength=3)
equallength = EqualLength(Line=explode.Segments, Strength=3)
equallength_2 = EqualLength(Line=explode_2.Segments, Strength=2)
smooth = Smooth(M=mesh_2, Strength=8)
grab = Grab(On=True, Strength=500, Range=3)  # -> Grab, Anchors
show = Show(G=mesh_2)
reset = Button()
on = BooleanToggle(False)
solver = Solver(
    GoalObjects=[plasticanchor, smooth, show, grab.Grab, equallength_2, clamplength, equallength, angle],
    Reset=reset,
    Threshold=1e-15,
    Tolerance=0.01,
    On=on)  # -> I, V, O
clean = CleanTree(RemoveNulls=True, RemoveInvalid=True, RemoveEmpty=False, Tree=solver.O)
meshdual = MeshDual(Mesh=clean, Center=0)
mesh_3 = Mesh(clean)
previewmat = CustomPreviewMaterials(Geometry=mesh_3, DiffuseColor=RGB(255, 255, 255))
previewlw = CustomPreviewLineweights(Geometry=mesh_3, Shader=ColourSwatch(SwatchColor=RGBA(0, 0, 0, 0)), Absolute=False)
previewlw_2 = CustomPreviewLineweights(Geometry=meshdual, Shader=ColourSwatch(SwatchColor=RGBA(255, 0, 0, 0)), Absolute=False)
