# Grasshopper definition 20161103_a3XX_Mesh to structure_cytoskeleton.gh (Grasshopper 0.9.76)
# Copyright: Co-de-iT
# plug-ins: Exoskeleton2, Human, PlanktonGh, Weaverbird

mesh = Mesh(<mesh referenced from the Rhino model>)
# Mesh to structure via Cytoskeleton
# 
# Base mesh done with the Kangaroo sculpt_example.gh from here: http://www.grasshopper3d.com/group/kangaroo/page/kangaroo2-additional-examples
# 
# © a3 2016 _ Creative Commons Attribution-NonCommercial-ShareAlike3.0 UnportedLicense.
wbcatmullclark = WeaverbirdsCatmullClarkSubdivision(MeshCurves=mesh, Level=1, SmoothNakedEdges=1)
wbloop = WeaverbirdsLoopSubdivision(MeshCurves=mesh, Level=1, SmoothNakedEdges=1)
X = UnitX(Factor="100")
# convert to Plankton mesh
pmesh = PlanktonMesh(wbloop)
move = Move(Geometry=pmesh, Motion=X)  # -> Geometry, Transform
deconstructplankton = DeconstructPlankton(PMesh=move.Geometry)  # -> Vertex_Points, Vertex_Outgoing_Halfedge, Halfedge_StartVertex, Halfedge_AdjacentFace, Halfedge_NextHalfedge, Halfedge_PrevHalfedge, Halfedge_Pair, Face_Halfedge
# use Plankton mesh
# deconstruct component
# (not the usual one for meshes)
number_slider = Slider(0.628, range=0..1)
pdecon = Deconstruct(Point=deconstructplankton.Vertex_Points)  # -> XComponent, YComponent, ZComponent
bnd = Bounds(Numbers=pdecon.ZComponent)
dom = ConstructDomain(DomainStart=number_slider, DomainEnd=Slider(0.041, range=0..1))
remap = RemapNumbers(Value=pdecon.ZComponent, Source=bnd, Target=dom)  # -> Mapped, Clipped
cyto = Cytoskeleton(PlanktonMesh=pmesh, Radius=Slider(0.417, range=0..1), Dual=False)
cyto_2 = Cytoskeleton(PlanktonMesh=move.Geometry, Radius=remap.Mapped, Dual=False)
Y = UnitY(Factor="80")
move_2 = Move(Geometry=cyto_2, Motion=Y)  # -> Geometry, Transform
previewmat = CustomPreviewMaterials(Geometry=cyto, DiffuseColor=RGB(255, 255, 255))
previewmat_2 = CustomPreviewMaterials(Geometry=cyto_2, DiffuseColor=RGB(255, 255, 255))
wbloop_2 = WeaverbirdsLoopSubdivision(MeshCurves=move_2.Geometry, Level=2, SmoothNakedEdges=2)
previewmat_3 = CustomPreviewMaterials(Geometry=wbloop_2, DiffuseColor=RGB(255, 255, 255))
