# Grasshopper definition 20161103_a3XX_NURBS_component-geometry.gh (Grasshopper 0.9.76)
# Copyright: Co-de-iT
# plug-ins: Human

number_slider = Slider(22, range=2..200)
frequency = Slider(0.266, range=0..1)
amplitude = Slider(7.08, range=1..20)
number_slider_2 = Slider(22, range=2..50)
crv = Curve([<curve referenced from the Rhino model> x5])
u_steps = Slider(12, range=1..50)
v_steps = Slider(24, range=1..50)
srf = Surface(reparameterize(<surface referenced from the Rhino model>))
loft_opt = LoftOptions(Closed=Toggle(True), Adjust=False, Rebuild=0, Refit=0, Type=2)
# File template
# 
# © a3 2016 _ Creative Commons Attribution-NonCommercial-ShareAlike3.0 UnportedLicense.
range = Range(Domain=Slider(50, range=0..50), Steps=number_slider)
# regular domain subdivision
range_2 = Range(Domain=Domain(0, 1), Steps=number_slider)  # -> reverse(Range)

# ----
# uneven domain subdivision
range_3 = Range(Domain=Domain(0, 1), Steps=u_steps)
range_4 = Range(Domain=Domain(0, 1), Steps=v_steps)
graph = GraphMapper(range_3, x0=0, x1=1, y0=0, y1=1, container_name="Bezier", cpx=[0, 0.9057971239, 0.1304347813, 1], cpy=[0, 0, 1, 1])
graph_2 = GraphMapper(range_4, x0=0, x1=1, y0=0, y1=1, container_name="Bezier", cpx=[0, 0, 1, 1], cpy=[0, 0.7608695626, 0.2318840623, 1])
toggle = BooleanToggle(False)
bishift = DoubleShift(list=graph, wrap=toggle)  # -> no_last, no_first
bishift_2 = DoubleShift(list=graph_2, wrap=toggle)  # -> no_last, no_first
Y = UnitY(Factor="150")
dom = ConstructDomain(DomainStart=bishift.no_last, DomainEnd=bishift.no_first)
dom_2 = ConstructDomain(DomainStart=bishift_2.no_last, DomainEnd=bishift_2.no_first)
move = Move(Geometry=srf, Motion=Y)  # -> Geometry, Transform
dom² = ConstructDomain²(DomainU=graft(dom), DomainV=dom_2)  # -> flatten(_2DDomain)
subsrf = Isotrim(Surface=move.Geometry, Domain=dom²)

range_5 = Range(Domain=Domain(0, 1), Steps=number_slider_2)
loft = Loft(Curves=crv, Options=loft_opt)
multiplication = Multiplication(A=range, B=frequency)
multiplication_2 = Multiplication(A=amplitude, B=range_2)
sin = Sine(Value=multiplication)
cos = Cosine(Value=multiplication)
divide = DivideDomain²(Domain=srf, UCount=u_steps, VCount=v_steps)
srf_2 = Surface(reparameterize(loft))
multiplication_3 = Multiplication(A=sin, B=multiplication_2)
multiplication_4 = Multiplication(A=cos, B=multiplication_2)
pt = ConstructPoint(XCoordinate=multiplication_4, YCoordinate=range, ZCoordinate=multiplication_3)
subdivision = ValueList({"regular": 0, "uneven": 1, "random": 2}, selected="regular")
random = Random(Range=Domain(0, 1), Number=number_slider_2, Seed=2)

series = Series(Start=0, Step=1, Count=10)
# double shift lists cluster
toggle_2 = BooleanToggle(False)
# NoF (No First)
shift = ShiftList(List=series, Shift="1", Wrap=toggle_2)
# NoL (No Last)
shift_2 = ShiftList(List=series, Shift="-1", Wrap=toggle_2)

graph_3 = GraphMapper(
    range_5,
    x0=0,
    x1=1,
    y0=0,
    y1=1,
    container_name="Bezier",
    cpx=[0, 0.1033972055, 0.4476986229, 1],
    cpy=[0, 0.7115000486, 0.9442014694, 1])
wrap_list = BooleanToggle(False)
sort = SortList(Keys=random)  # -> Keys, ValuesA
num = Number(range_5)
bishift_3 = DoubleShift(list=pt, wrap=wrap_list)  # -> no_last, no_first
# icon problem on user objects: if you see a yellow triangle just right click over the component and choose "internalise" to make the icon appear
# -
# sorry about this, I couldn't figure a way of making the icon appear automatically
bishift_4 = DoubleShift()  # -> no_last, no_first

pt_2 = ConstructPoint(XCoordinate=0, YCoordinate=range_5, ZCoordinate=0)
wrap = BooleanToggle(False)
iso = IsoCurve(Surface=srf_2, UVPoint=pt_2)  # -> UIsocurve, VIsocurve
bishift_5 = DoubleShift(list=flatten(iso.UIsocurve), wrap=wrap)  # -> no_last, no_first
end = EndPoints(Curve=bishift_5.no_last)  # -> Start, End
end_2 = EndPoints(Curve=bishift_5.no_first)  # -> Start, End
dist = Distance(PointA=end.End, PointB=end_2.End)
cull_i = CullIndex(List=flatten(iso.UIsocurve), Indices="-1", Wrap=True)
Z = UnitZ(Factor=dist)
extr = Extrude(Base=cull_i, Direction=Z)
Y_2 = UnitY(Factor="150")
# extruded floors
move_2 = Move(Geometry=extr, Motion=Y_2)  # -> Geometry, Transform
previewmat = CustomPreviewMaterials(Geometry=move_2.Geometry, DiffuseColor=RGB(255, 255, 255))

filter = StreamFilter(Gate=subdivision, Stream0=num, Stream1=graph_3, Stream2=sort.Keys)
vec2pt = Vector2Pt(PointA=bishift_3.no_last, PointB=bishift_3.no_first, Unitize=False)  # -> Vector, Length
subsrf_2 = Isotrim(Surface=srf, Domain=divide)
pt_3 = ConstructPoint(XCoordinate=0, YCoordinate=filter, ZCoordinate=0)
vdisex = VectorDisplayEx(Point=bishift_3.no_last, Vector=vec2pt.Vector, Colour=RGB(0, 0, 0), Width=2)
no_last = Panel(shift_2)

wrap_2 = BooleanToggle(False)
# get isocurves
iso_2 = IsoCurve(Surface=srf_2, UVPoint=pt_3)  # -> UIsocurve, VIsocurve
bishift_6 = DoubleShift(list=flatten(iso_2.UIsocurve), wrap=wrap_2)  # -> simplify(graft(no_last)), simplify(graft(no_first))

previewlw = CustomPreviewLineweights(Geometry=subsrf, Shader=ColourSwatch(SwatchColor=RGBA(120, 183, 194, 0)), Absolute=False)
previewlw_2 = CustomPreviewLineweights(Geometry=subsrf_2, Shader=ColourSwatch(SwatchColor=RGBA(255, 255, 255, 0)), Absolute=False)
# to compare/process any element of a list with its following one we need to create a new list that is the "shifted" version of the original (moving elements up or down the list order)
no_first = Panel(shift)
resolution = Slider(150, range=5..200)
# attractor curve
crv_2 = Curve(<curve referenced from the Rhino model>)
# lowest curve
divide_2 = DivideCurve(Curve=bishift_6.no_last, Count=resolution, Kinks=False)  # -> Points, Tangents, Parameters
# highest curve
divide_3 = DivideCurve(Curve=bishift_6.no_first, Count=resolution, Kinks=False)  # -> Points, Tangents, Parameters

max_range = Slider(31.706, range=0..100)
min_range = Slider(22.49, range=0..100)
# attractor effect with min & max range
crv_cp = CurveClosestPoint(Point=divide_3.Points, Curve=crv_2)  # -> Point, Parameter, Distance
min = Minimum(A=crv_cp.Distance, B=max_range)
max = Maximum(A=min, B=min_range)

srf_cp = SurfaceClosestPoint(Point=divide_3.Points, Surface=srf_2)  # -> Point, UVPoint, Distance
# calculate parametric distance
# what's going on here? (1 of 2): We use the (u,v) implicit coordinates system of the surface:
# 
# 1. each point sampled on the curves is projected on the surface to obtain its (u,v) coordinates (uvP output)
# 
# 2. using deconstruct point we access such coordinates (X corresponds to u, Y to v, Z to n which in case of points on the surface is always 0)
# 
# 3. we take the first point for each curve in order to calculate the relative "parametric distance" of each curve to the next
srf_cp_2 = SurfaceClosestPoint(Point=divide_2.Points, Surface=srf_2)  # -> Point, UVPoint, Distance
pdecon = Deconstruct(Point=srf_cp.UVPoint)  # -> XComponent, YComponent, ZComponent
pdecon_2 = Deconstruct(Point=srf_cp_2.UVPoint)  # -> XComponent, YComponent, ZComponent
item = ListItem(List=pdecon.YComponent, Index=0, Wrap=True)
item_2 = ListItem(List=pdecon_2.YComponent, Index=0, Wrap=True)
subtraction = Subtraction(A=item_2, B=item)

# ----
# normalize to (0-1) domain
bnd = Bounds(Numbers=flatten(max))
remap = RemapNumbers(Value=max, Source=bnd, Target=Domain(0, 1))  # -> Mapped, Clipped

# ----
# a
near_behavior = Slider(0.5, range=0..1)
# c
# what's going on here? (2 of 2): 4. we determine the behavior near to and far from the attractor curve by setting a percentage of the calculated distance (x * 0.5 is 50% of x)
# 
# 5. we build a domain of distances that will be the ones we use to move each sampled point on the curves
far_behavior = Slider(0.05, range=0..1)
multiplication_5 = Multiplication(A=subtraction, B=near_behavior)
multiplication_6 = Multiplication(A=subtraction, B=far_behavior)
# values above
# max range
dom_3 = ConstructDomain(DomainStart=multiplication_5, DomainEnd=multiplication_6)

# ----
# b
graph_4 = GraphMapper(remap.Clipped, x0=0, x1=1, y0=0, y1=1, container_name="Sine", Equation_px=[0, 1], Equation_py=[0, 1])
remap_2 = RemapNumbers(Value=graph_4, Source=Domain(0, 1), Target=dom_3)  # -> Mapped, Clipped
# c
# values in range
addition = Addition(A=pdecon.YComponent, B=remap_2.Mapped)
# b
# a
pt_4 = ConstructPoint(XCoordinate=pdecon.XComponent, YCoordinate=addition, ZCoordinate=pdecon.ZComponent)
periodic = BooleanToggle(True)

# ----
# get (X,Y,Z) coordinates
# of new points and
# build new curves
evalsrf = EvaluateSurface(Surface=srf_2, Point=pt_4)  # -> Point, Normal, Frame
nurbs = NurbsCurve(Vertices=evalsrf.Point, Degree=3, Periodic=periodic)  # -> Curve, Length, Domain

nurbs_2 = NurbsCurve(Vertices=divide_2.Points, Degree=3, Periodic=periodic)  # -> Curve, Length, Domain
gradient = Gradient(LowerLimit=0, UpperLimit=1, Parameter=graph_4, stops=[0: RGB(255, 255, 255), 1: RGB(0, 0, 0)])
# values below
# min range
panel = Panel("300")
Y_3 = UnitY(Factor=panel)
merge = Merge(Data1=simplify(nurbs_2.Curve), Data2=simplify(nurbs.Curve))
move_3 = Move(Geometry=divide_3.Points, Motion=Y_3)  # -> Geometry, Transform
# heavy operation
# keep false when changing
# parameters
solidify = BooleanToggle(False)
vec2pt_2 = Vector2Pt(PointA=divide_3.Points, PointB=evalsrf.Point, Unitize=False)  # -> Vector, Length
# solidify
gate = StreamGate(Stream=merge, Gate=solidify)  # -> Target0, Target1

Z_2 = UnitZ(Factor=1)
divide_4 = DivideCurve(Curve=gate.Target1, Count=resolution, Kinks=False)  # -> Points, Tangents, Parameters
xprod = CrossProduct(VectorA=divide_4.Tangents, VectorB=Z_2, Unitize=False)  # -> Vector, Length
amp = Amplitude(Vector=xprod.Vector, Amplitude=Slider(1, range=0..1))
rev = Reverse(Vector=amp)
periodic_2 = BooleanToggle(True)
move_4 = Move(Geometry=divide_4.Points, Motion=rev)  # -> Geometry, Transform
nurbs_3 = NurbsCurve(Vertices=move_4.Geometry, Degree=3, Periodic=periodic_2)  # -> Curve, Length, Domain
pshift = ShiftPaths(Data=nurbs_3.Curve, Offset=-1)
item_3 = ListItem(List=gate.Target1, Index=0, Wrap=True)  # -> Item, Item1
item_4 = ListItem(List=pshift, Index=0, Wrap=True)  # -> Item, Item1
loft_opt_2 = LoftOptions(Closed=False, Adjust=True, Rebuild=resolution, Refit=0, Type=2)
loft_2 = Loft(Curves=[item_3.Item, item_4.Item], Options=loft_opt_2)
loft_3 = Loft(Curves=[item_3.Item1, item_4.Item1], Options=loft_opt_2)
loft_4 = Loft(Curves=pshift, Options={Adjust=False, Closed=False, LoftEnds=0, LoftSimp=0, LoftType=0, Rebuild=10, Refit=0.01})

line = LineSDL(Start=move_3.Geometry, Direction=vec2pt_2.Vector, Length=vec2pt_2.Length)
vdisex_2 = VectorDisplayEx(Point=move_3.Geometry, Vector=vec2pt_2.Vector, Colour=gradient, Width=2)
loft_5 = Loft(
    Curves=[gate.Target0, gate.Target1],
    Options={Adjust=False, Closed=False, LoftEnds=0, LoftSimp=0, LoftType=0, Rebuild=10, Refit=0.01})
merge_2 = Merge(Data1=loft_5, Data2=loft_2, Data3=loft_3, Data4=loft_4)
join = BrepJoin(Breps=merge_2)  # -> Breps, Closed

# ----
# visual order: Everything is still happening where the initial curves are, we move away the result only for visualization
panel_2 = Panel("300")
Y_4 = UnitY(Factor=panel_2)

move_5 = Move(Geometry=join.Breps, Motion=Y_4)  # -> Geometry, Transform
swatch = ColourSwatch(SwatchColor=RGB(250, 208, 0))
loft_6 = Loft(Curves=line, Options={Adjust=False, Closed=True, LoftEnds=0, LoftSimp=0, LoftType=0, Rebuild=10, Refit=0.01})
previewmat_2 = CustomPreviewMaterials(Geometry=move_5.Geometry, DiffuseColor=RGB(255, 255, 255))
previewmat_3 = CustomPreviewMaterials(Geometry=loft_6, DiffuseColor=ColourSwatch(SwatchColor=RGB(0, 0, 0)))

# ----
# Depending on the initial geometry, the longest curves might not always be in the same indexes. To find them, we sum the end points to sort curves by height: the highest and lowest curves have both end points coincident and will be sorted as first and last, so it's easy to extract them
# correct direction: curve direction on a NURBS surface. In the case of our strip, we need to flip of one of the curves in the same direction to obtain a non-crossing loft later
# find highest curve
# lowest curve
# highest curve
panel_3 = Panel("1")
divide_5 = DivideDomain²(Domain=srf_2, UCount=panel_3, VCount=number_slider_2)
subsrf_3 = Isotrim(Surface=srf_2, Domain=divide_5)
debrep = DeconstructBrep(Brep=subsrf_3)  # -> Faces, Edges, Vertices

end_3 = EndPoints(Curve=debrep.Edges)  # -> Start, End
addition_2 = Addition(A=end_3.Start, B=end_3.End)
pdecon_3 = Deconstruct(Point=addition_2)  # -> XComponent, YComponent, ZComponent
sort_2 = SortList(Keys=pdecon_3.ZComponent, ValuesA=debrep.Edges)  # -> Keys, ValuesA
item_5 = ListItem(List=sort_2.ValuesA, Index=0, Wrap=True)  # -> Item1, Item
flip = FlipCurve(Curve=item_5.Item1)  # -> Curve, Flag

crv_3 = Curve(flip.Curve)
# ^
# a much more complicated
# way to get isocurves
crv_4 = Curve(item_5.Item)

# ==== cluster DoubleShift: Shifts a list +1 and -1, wrap option available
list = ClusterInput()
wrap = ClusterInput()
shift = ShiftList(List=list, Shift=1, Wrap=wrap)
shift_2 = ShiftList(List=list, Shift="-1", Wrap=wrap)
no_last = ClusterOutput(shift_2)
no_first = ClusterOutput(shift)
