# Grasshopper definition 20161106_a3XX_NURBS_component-geometry_2.gh (Grasshopper 0.9.76)
# Copyright: Co-de-iT
# plug-ins: Human

number_slider = Slider(50, range=2..200)
# check under Solution > restore state to see different configurations & results
crv = Curve([<curve referenced from the Rhino model> x5])
crv_2 = Curve([<curve referenced from the Rhino model> x5])
loft_opt = LoftOptions(Closed=Toggle(True), Adjust=False, Rebuild=0, Refit=0, Type=2)
loft_opt_2 = LoftOptions(Closed=Toggle(True), Adjust=False, Rebuild=0, Refit=0, Type=2)
range = Range(Domain=Domain(0, 1), Steps=Slider(50, range=2..200))
range_2 = Range(Domain=Domain(0, 1), Steps=number_slider)
# File template
# 
# © a3 2016 _ Creative Commons Attribution-NonCommercial-ShareAlike3.0 UnportedLicense.
loft = Loft(Curves=crv, Options=loft_opt)
loft_2 = Loft(Curves=crv_2, Options=loft_opt_2)
# attractor curve
pt = ConstructPoint(XCoordinate=0, YCoordinate=range, ZCoordinate=0)
pt_2 = ConstructPoint(XCoordinate=0, YCoordinate=range_2, ZCoordinate=0)
srf = Surface(reparameterize(loft))
srf_2 = Surface(reparameterize(loft_2))
# get isocurves
iso = IsoCurve(Surface=srf, UVPoint=pt)  # -> UIsocurve, VIsocurve
# get isocurves
iso_2 = IsoCurve(Surface=srf_2, UVPoint=pt_2)  # -> UIsocurve, VIsocurve
crv_3 = Curve(<curve referenced from the Rhino model>)
number_slider_2 = Slider(20, range=2..200)
range_3 = Range(Domain=Slider(1, range=0..2), Steps=number_slider)
divide = DivideCurve(Curve=iso.UIsocurve, Count=Slider(100, range=2..200), Kinks=False)  # -> Points, Tangents, Parameters

max_range = Slider(20.874, range=0..100)
min_range = Slider(0, range=0..100)
# attractor effect with min & max range
crv_cp = CurveClosestPoint(Point=divide.Points, Curve=crv_3)  # -> Point, Parameter, Distance
min = Minimum(A=crv_cp.Distance, B=max_range)
max = Maximum(A=min, B=min_range)

seam = Seam(Curve=reparameterize(flatten(iso_2.UIsocurve)), Seam=range_3)
subtraction = Subtraction(A=number_slider_2, B=1)
range_4 = Range(Domain=subtraction, Steps=Slider(1, range=1..5))
wrap = BooleanToggle(False)
item = ListItem(List=divide.Points, Index=0, Wrap=True)
divide_2 = DivideCurve(Curve=seam, Count=number_slider_2, Kinks=False)  # -> Points, Tangents, Parameters
graph = GraphMapper(range_2, x0=0, x1=1, y0=0, y1=1, container_name="Sine", Equation_px=[0, 0.5106382966], Equation_py=[0, 1])
int = Integer(range_4)
Z = UnitZ(Factor=1)
bishift = DoubleShift(list=flatten(item), wrap=wrap)  # -> simplify(graft(no_last)), simplify(graft(no_first))
xprod = CrossProduct(VectorA=divide_2.Tangents, VectorB=Z, Unitize=False)  # -> Vector, Length
cull_i = CullIndex(List=int, Indices="-1", Wrap=True)
panel = Panel("""0
5
10
15""")
end = EndPoints(Curve=iso_2.UIsocurve)  # -> Start, End
dist = Distance(PointA=bishift.no_last, PointB=bishift.no_first)
wrap_2 = BooleanToggle(False)
item_2 = ListItem(List=divide_2.Points, Index=cull_i, Wrap=True)

# ----
# normalize to (0-1) domain
bnd = Bounds(Numbers=flatten(max))
remap = RemapNumbers(Value=max, Source=bnd, Target=Domain(0, 1))  # -> Mapped, Clipped

item_3 = ListItem(List=xprod.Vector, Index=cull_i, Wrap=True)
multiplication = Multiplication(A=graft(graph), B=Slider(20, range=0..20))
bishift_2 = DoubleShift(list=flatten(end.Start), wrap=wrap_2)  # -> simplify(graft(no_last)), simplify(graft(no_first))
amp = Amplitude(Vector=item_3, Amplitude=multiplication)
graph_2 = GraphMapper(
    remap.Clipped,
    x0=0,
    x1=1,
    y0=0,
    y1=1,
    amplitude=0.5318863988,
    container_name="Perlin",
    decay=0.7012546062,
    frequency=0.3138402104,
    x_offset=0.5028554201,
    y_offset=0.5295308828)
graph_3 = GraphMapper(remap.Clipped, x0=0, x1=1, y0=0, y1=1, container_name="Bezier", cpx=[0, 1, 0, 1], cpy=[0, 0, 1, 1])
graph_4 = GraphMapper(remap.Clipped, x0=0, x1=1, y0=0, y1=1, container_name="Sine", Equation_px=[0, 1], Equation_py=[0, 1])
graph_5 = GraphMapper(remap.Clipped, x0=0, x1=1, y0=0, y1=1, container_name="Sine", Equation_px=[0, 0.1398601383], Equation_py=[0, 1])
divide_3 = DivideCurve(Curve=seam, Count=Slider(10, range=2..20), Kinks=False)  # -> Points, Tangents, Parameters
Z_2 = UnitZ(Factor=1)
move = Move(Geometry=item_2, Motion=amp)  # -> Geometry, Transform
xprod_2 = CrossProduct(VectorA=divide.Tangents, VectorB=Z_2, Unitize=False)  # -> Vector, Length
dist_2 = Distance(PointA=bishift_2.no_last, PointB=bishift_2.no_first)
replace = ReplaceItems(List=divide_2.Points, Item=move.Geometry, Indices=cull_i, Wrap=False)
toggle = BooleanToggle(True)
flip = FlipMatrix(Data=divide_3.Points)
graph_6 = ValueList({"One": 0, "Two": 1, "Three": 2, "Four": 3}, selected="One")
nurbs = NurbsCurve(Vertices=replace, Degree=3, Periodic=toggle)  # -> Curve, Length, Domain
intcrv = Interpolate(Vertices=replace, Degree=3, Periodic=toggle, KnotStyle=1)  # -> Curve, Length, Domain
intcrv_2 = Interpolate(Vertices=flip, Degree=3, Periodic=False, KnotStyle=1)  # -> Curve, Length, Domain
Z_3 = UnitZ(Factor=dist_2)
loft_3 = Loft(
    Curves=flatten(intcrv_2.Curve),
    Options={Adjust=False, Closed=True, LoftEnds=0, LoftSimp=0, LoftType=3, Rebuild=10, Refit=0.01})
extr = Extrude(Base=flatten(nurbs.Curve), Direction=flatten(Z_3))
filter = StreamFilter(Gate=graph_6, Stream0=graph_4, Stream1=graph_5, Stream2=graph_3, Stream3=graph_2)
dom = ConstructDomain(DomainStart=Slider(0, range=0..20), DomainEnd=Slider(12.288, range=0..20))
previewmat = CustomPreviewMaterials(Geometry=loft_3, DiffuseColor=RGB(255, 255, 255))
previewmat_2 = CustomPreviewMaterials(Geometry=extr, DiffuseColor=RGB(255, 255, 255))
remap_2 = RemapNumbers(Value=filter, Source=Domain(0, 1), Target=dom)  # -> Mapped, Clipped
amp_2 = Amplitude(Vector=xprod_2.Vector, Amplitude=remap_2.Mapped)
move_2 = Move(Geometry=divide.Points, Motion=amp_2)  # -> Geometry, Transform
Z_4 = UnitZ(Factor=dist)
nurbs_2 = NurbsCurve(Vertices=move_2.Geometry, Degree=3, Periodic=Toggle(True))  # -> Curve, Length, Domain
extr_2 = Extrude(Base=flatten(nurbs_2.Curve), Direction=flatten(Z_4))
previewmat_3 = CustomPreviewMaterials(Geometry=extr_2, DiffuseColor=RGB(255, 255, 255))

# ==== cluster DoubleShift: Shifts a list +1 and -1, wrap option available
list = ClusterInput()
wrap = ClusterInput()
shift = ShiftList(List=list, Shift=1, Wrap=wrap)
shift_2 = ShiftList(List=list, Shift="-1", Wrap=wrap)
no_last = ClusterOutput(shift_2)
no_first = ClusterOutput(shift)
