# Grasshopper definition 20161117_growth.gh (Grasshopper 0.9.76)
# Copyright: Co-de-iT
# plug-ins: Anemone, Human, Weaverbird

symmetry = Slider(0.8, range=0..1)
height = Slider(0.5, range=0..1)
# iterative (using Anemone)
number_slider = Slider(4, range=1..4)
pt = Point(Point(350, 50, 0))
# growth algorithm examples
# 
# Some iterative/recursive algorithm. Process is shown first brute-force, then with Anemone.
# 
# © a3 2016 _ Creative Commons Attribution-NonCommercial-ShareAlike3.0 UnportedLicense.
# Koch curve
# brute force (copy-paste components)
pt_2 = Point(Point(10, 10, 0))
# iterative (using Anemone)
panel = Panel("-20 to 20")
# Pitagorean trees (branching algorithm)
# brute force (copy-paste components)
pt_3 = Point(Point(300, 50, 0))
Y = UnitY(Factor="30")
polygon = Polygon(Plane=pt_2, Radius="10", Segments=Slider(5, range=4..10), FilletRadius=0)  # -> Polygon, Length
rectangle = Rectangle(Plane=pt_3, XSize="-20 to 20", YSize="-20 to 20", Radius=0)  # -> Rectangle, Length
move = Move(Geometry=polygon.Polygon, Motion=Y)  # -> Geometry, Transform
rectangle_2 = Rectangle(Plane=pt, XSize=panel, YSize=panel, Radius=0)  # -> Rectangle, Length
polygon_2 = Polygon(Plane=pt, Radius=Slider(25.36, range=10..50), Segments=Slider(4, range=3..6), FilletRadius=0)  # -> Polygon, Length
explode = Explode(Curve=rectangle.Rectangle, Recursive=True)  # -> Segments, Vertices

# ---- group: enable this component to start looping
loop_start = LoopStart(Repeat=number_slider, Trigger=Button(), Data=move.Geometry)  # -> port, Counter, Data; disabled

# ----
# basic Koch curve process
explode_2 = Explode(Curve=polygon.Polygon, Recursive=True)  # -> Segments, Vertices
divide = DivideCurve(Curve=explode_2.Segments, Count="3", Kinks=False)  # -> Points, Tangents, Parameters
item = ListItem(List=divide.Points, Index=0, Wrap=True)  # -> Item, Item1, Item2
avr = Average(Input=[item.Item1, item.Item2])
vec2pt = Vector2Pt(PointA=item.Item1, PointB=item.Item2, Unitize=False)  # -> Vector, Length
Z = UnitZ(Factor=1)
xprod = CrossProduct(VectorA=vec2pt.Vector, VectorB=Z, Unitize=False)  # -> Vector, Length
multiplication = Multiplication(A=xprod.Vector, B=Slider(1, range=0..1))
move_2 = Move(Geometry=avr, Motion=multiplication)  # -> Geometry, Transform
ins = InsertItems(List=divide.Points, Item=move_2.Geometry, Indices="2", Wrap=True)
pline = PolyLine(Vertices=ins, Closed=False)
# iteration 1
join = JoinCurves(Curves=flatten(pline), Preserve=False)

scale_nu = ScaleNU(Geometry=polygon_2.Polygon, Plane=pt, ScaleX=1, ScaleY=Slider(0.25, range=0.1..1), ScaleZ=1)  # -> Geometry, Transform
item_2 = ListItem(List=explode.Segments, Index=0, Wrap=True)  # -> Item, Item1, Item2, Item3

# ----
# basic Koch curve process
explode_3 = Explode(Curve=loop_start.Data, Recursive=True)  # -> Segments, Vertices
divide_2 = DivideCurve(Curve=explode_3.Segments, Count="3", Kinks=False)  # -> Points, Tangents, Parameters
item_3 = ListItem(List=divide_2.Points, Index=0, Wrap=True)  # -> Item, Item1, Item2
avr_2 = Average(Input=[item_3.Item1, item_3.Item2])
vec2pt_2 = Vector2Pt(PointA=item_3.Item1, PointB=item_3.Item2, Unitize=False)  # -> Vector, Length
Z_2 = UnitZ(Factor=1)
xprod_2 = CrossProduct(VectorA=vec2pt_2.Vector, VectorB=Z_2, Unitize=False)  # -> Vector, Length
multiplication_2 = Multiplication(A=xprod_2.Vector, B=Slider(1, range=0..1))
move_3 = Move(Geometry=avr_2, Motion=multiplication_2)  # -> Geometry, Transform
ins_2 = InsertItems(List=divide_2.Points, Item=move_3.Geometry, Indices="2", Wrap=True)
pline_2 = PolyLine(Vertices=ins_2, Closed=False)
# iteration
join_2 = JoinCurves(Curves=flatten(pline_2), Preserve=False)

# ---- group: change source polyline/polygon here
crv = Curve(scale_nu.Geometry)

# ----
merge = Merge(Data1=item_2.Item, Data2=item_2.Item2)  # -> graft(Result)
explode_4 = Explode(Curve=crv, Recursive=True)  # -> Segments, Vertices

# ---- group: change growth segments here
item_4 = ListItem(List=explode_4.Segments, Index=0, Wrap=True)  # -> Item, Item1, Item2, Item3
merge_2 = Merge(Data1=item_4.Item, Data2=item_4.Item2)  # -> graft(Result)

# ----
end = EndPoints(Curve=merge)  # -> Start, End
Z_3 = UnitZ(Factor=1)
vec2pt_3 = Vector2Pt(PointA=end.Start, PointB=end.End, Unitize=False)  # -> Vector, Length
xprod_3 = CrossProduct(VectorA=vec2pt_3.Vector, VectorB=Z_3, Unitize=True)  # -> Vector, Length
multiplication_3 = Multiplication(A=vec2pt_3.Vector, B="0.5")
amp = Amplitude(Vector=xprod_3.Vector, Amplitude=multiplication_3)
addition = Addition(A=multiplication_3, B=amp)
move_4 = Move(Geometry=end.Start, Motion=addition)  # -> Geometry, Transform
Z_4 = UnitZ(Factor=1)
vec2pt_4 = Vector2Pt(PointA=move_4.Geometry, PointB=end.End, Unitize=False)  # -> Vector, Length
vec2pt_5 = Vector2Pt(PointA=end.Start, PointB=move_4.Geometry, Unitize=False)  # -> Vector, Length
xprod_4 = CrossProduct(VectorA=vec2pt_5.Vector, VectorB=Z_4, Unitize=False)  # -> Vector, Length
xprod_5 = CrossProduct(VectorA=vec2pt_4.Vector, VectorB=Z_4, Unitize=False)  # -> Vector, Length
amp_2 = Amplitude(Vector=xprod_4.Vector, Amplitude=vec2pt_5.Length)
amp_3 = Amplitude(Vector=xprod_5.Vector, Amplitude=xprod_5.Length)
move_5 = Move(Geometry=move_4.Geometry, Motion=amp_2)  # -> Geometry, Transform
move_6 = Move(Geometry=end.Start, Motion=amp_2)  # -> Geometry, Transform
pt_4 = Point(end.Start)
move_7 = Move(Geometry=move_4.Geometry, Motion=amp_3)  # -> Geometry, Transform
move_8 = Move(Geometry=end.End, Motion=amp_3)  # -> Geometry, Transform
merge_3 = Merge(Data1=move_4.Geometry, Data2=pt_4, Data3=move_6.Geometry, Data4=move_5.Geometry)
merge_4 = Merge(Data1=end.End, Data2=move_4.Geometry, Data3=move_7.Geometry, Data4=move_8.Geometry)
pline_3 = PolyLine(Vertices=merge_3, Closed=True)
pline_4 = PolyLine(Vertices=merge_4, Closed=True)
merge_5 = Merge(Data1=pline_3, Data2=pline_4)  # -> simplify(Result)
explode_5 = Explode(Curve=merge_5, Recursive=True)  # -> Segments, Vertices
item_5 = ListItem(List=explode_5.Segments, Index=0, Wrap=True)  # -> Item, Item1, Item2, Item3
crv_2 = Curve(item_5.Item2)

previewlw = CustomPreviewLineweights(Geometry=merge_2, Shader=ColourSwatch(SwatchColor=RGB(255, 255, 255)), Thickness="2", Absolute=False)

# ---- group: activate this component to start the loops
loop_start_2 = LoopStart(N=Slider(6, range=0..8), T=Button(), D0=merge_2, D1=crv)  # -> port, Counter, Data, Data_2; disabled

# ----
explode_6 = Explode(Curve=join, Recursive=True)  # -> Segments, Vertices
divide_3 = DivideCurve(Curve=explode_6.Segments, Count="3", Kinks=False)  # -> Points, Tangents, Parameters
item_6 = ListItem(List=divide_3.Points, Index=0, Wrap=True)  # -> Item, Item1, Item2
avr_3 = Average(Input=[item_6.Item1, item_6.Item2])
vec2pt_6 = Vector2Pt(PointA=item_6.Item1, PointB=item_6.Item2, Unitize=False)  # -> Vector, Length
Z_5 = UnitZ(Factor=1)
xprod_6 = CrossProduct(VectorA=vec2pt_6.Vector, VectorB=Z_5, Unitize=False)  # -> Vector, Length
multiplication_4 = Multiplication(A=xprod_6.Vector, B=Slider(1, range=0..1))
move_9 = Move(Geometry=avr_3, Motion=multiplication_4)  # -> Geometry, Transform
ins_3 = InsertItems(List=divide_3.Points, Item=move_9.Geometry, Indices="2", Wrap=True)
# iteration 2
pline_5 = PolyLine(Vertices=ins_3, Closed=False)
join_3 = JoinCurves(Curves=flatten(pline_5), Preserve=False)

loop_end = LoopEnd(port=loop_start.port, Exit=False, Data=join_2, pausedState=False, state="Constant output", TimeOutVal=0)
scale_nu_2 = ScaleNU(Geometry=loop_end, Plane=PlaneXY(0, 0, 0), ScaleX=Slider(3, range=0.5..3), ScaleY=Slider(2.3, range=0.5..3), ScaleZ=1)  # -> Geometry, Transform

end_2 = EndPoints(Curve=crv_2)  # -> Start, End
Z_6 = UnitZ(Factor=1)
vec2pt_7 = Vector2Pt(PointA=end_2.Start, PointB=end_2.End, Unitize=False)  # -> Vector, Length
xprod_7 = CrossProduct(VectorA=vec2pt_7.Vector, VectorB=Z_6, Unitize=True)  # -> Vector, Length
multiplication_5 = Multiplication(A=vec2pt_7.Vector, B="0.5")
amp_4 = Amplitude(Vector=xprod_7.Vector, Amplitude=multiplication_5)
addition_2 = Addition(A=multiplication_5, B=amp_4)
move_10 = Move(Geometry=end_2.Start, Motion=addition_2)  # -> Geometry, Transform
Z_7 = UnitZ(Factor=1)
vec2pt_8 = Vector2Pt(PointA=move_10.Geometry, PointB=end_2.End, Unitize=False)  # -> Vector, Length
vec2pt_9 = Vector2Pt(PointA=end_2.Start, PointB=move_10.Geometry, Unitize=False)  # -> Vector, Length
xprod_8 = CrossProduct(VectorA=vec2pt_9.Vector, VectorB=Z_7, Unitize=False)  # -> Vector, Length
xprod_9 = CrossProduct(VectorA=vec2pt_8.Vector, VectorB=Z_7, Unitize=False)  # -> Vector, Length
amp_5 = Amplitude(Vector=xprod_8.Vector, Amplitude=vec2pt_9.Length)
amp_6 = Amplitude(Vector=xprod_9.Vector, Amplitude=xprod_9.Length)
move_11 = Move(Geometry=move_10.Geometry, Motion=amp_5)  # -> Geometry, Transform
move_12 = Move(Geometry=end_2.Start, Motion=amp_5)  # -> Geometry, Transform
pt_5 = Point(end_2.Start)
move_13 = Move(Geometry=move_10.Geometry, Motion=amp_6)  # -> Geometry, Transform
move_14 = Move(Geometry=end_2.End, Motion=amp_6)  # -> Geometry, Transform
merge_6 = Merge(Data1=move_10.Geometry, Data2=pt_5, Data3=move_12.Geometry, Data4=move_11.Geometry)
merge_7 = Merge(Data1=end_2.End, Data2=move_10.Geometry, Data3=move_13.Geometry, Data4=move_14.Geometry)
pline_6 = PolyLine(Vertices=merge_6, Closed=True)
pline_7 = PolyLine(Vertices=merge_7, Closed=True)
merge_8 = Merge(Data1=pline_6, Data2=pline_7)  # -> simplify(Result)
explode_7 = Explode(Curve=merge_8, Recursive=True)  # -> Segments, Vertices
item_7 = ListItem(List=explode_7.Segments, Index=0, Wrap=True)  # -> Item, Item1, Item2, Item3
crv_3 = Curve(item_7.Item2)

previewlw_2 = CustomPreviewLineweights(Geometry=scale_nu_2.Geometry, Shader=ColourSwatch(SwatchColor=RGB(255, 255, 255)), Absolute=False)
crv_4 = Curve(loop_start_2.Data_2)

explode_8 = Explode(Curve=join_3, Recursive=True)  # -> Segments, Vertices
divide_4 = DivideCurve(Curve=explode_8.Segments, Count="3", Kinks=False)  # -> Points, Tangents, Parameters
item_8 = ListItem(List=divide_4.Points, Index=0, Wrap=True)  # -> Item, Item1, Item2
avr_4 = Average(Input=[item_8.Item1, item_8.Item2])
vec2pt_10 = Vector2Pt(PointA=item_8.Item1, PointB=item_8.Item2, Unitize=False)  # -> Vector, Length
Z_8 = UnitZ(Factor=1)
xprod_10 = CrossProduct(VectorA=vec2pt_10.Vector, VectorB=Z_8, Unitize=False)  # -> Vector, Length
multiplication_6 = Multiplication(A=xprod_10.Vector, B=Slider(1, range=0..1))
move_15 = Move(Geometry=avr_4, Motion=multiplication_6)  # -> Geometry, Transform
ins_4 = InsertItems(List=divide_4.Points, Item=move_15.Geometry, Indices="2", Wrap=True)
pline_8 = PolyLine(Vertices=ins_4, Closed=False)
# iteration 3
join_4 = JoinCurves(Curves=flatten(pline_8), Preserve=False)

fillet = Fillet(Curve=join_4, Radius=Slider(0.15, range=0..1))
scale_nu_3 = ScaleNU(Geometry=fillet, Plane=PlaneXY(0, 0, 0), ScaleX=Slider(3, range=0.5..3), ScaleY=Slider(2.3, range=0.5..3), ScaleZ=1)  # -> Geometry, Transform
previewlw_3 = CustomPreviewLineweights(Geometry=scale_nu_3.Geometry, Shader=ColourSwatch(SwatchColor=RGB(255, 255, 255)), Absolute=False)

end_3 = EndPoints(Curve=loop_start_2.Data)  # -> Start, End
Z_9 = UnitZ(Factor=1)
vec2pt_11 = Vector2Pt(PointA=end_3.Start, PointB=end_3.End, Unitize=False)  # -> Vector, Length
xprod_11 = CrossProduct(VectorA=vec2pt_11.Vector, VectorB=Z_9, Unitize=True)  # -> Vector, Length
multiplication_7 = Multiplication(A=vec2pt_11.Vector, B=symmetry)
Z_10 = UnitZ(Factor=1)
pt_6 = Point(end_3.Start)

multiplication_8 = Multiplication(A=vec2pt_11.Vector, B=height)

amp_7 = Amplitude(Vector=xprod_11.Vector, Amplitude=multiplication_8)
addition_3 = Addition(A=multiplication_7, B=amp_7)
move_16 = Move(Geometry=end_3.Start, Motion=addition_3)  # -> Geometry, Transform
vec2pt_12 = Vector2Pt(PointA=move_16.Geometry, PointB=end_3.End, Unitize=False)  # -> Vector, Length
vec2pt_13 = Vector2Pt(PointA=end_3.Start, PointB=move_16.Geometry, Unitize=False)  # -> Vector, Length
xprod_12 = CrossProduct(VectorA=vec2pt_13.Vector, VectorB=Z_10, Unitize=False)  # -> Vector, Length
xprod_13 = CrossProduct(VectorA=vec2pt_12.Vector, VectorB=Z_10, Unitize=False)  # -> Vector, Length
amp_8 = Amplitude(Vector=xprod_12.Vector, Amplitude=vec2pt_13.Length)
amp_9 = Amplitude(Vector=xprod_13.Vector, Amplitude=xprod_13.Length)
move_17 = Move(Geometry=move_16.Geometry, Motion=amp_8)  # -> Geometry, Transform
move_18 = Move(Geometry=end_3.Start, Motion=amp_8)  # -> Geometry, Transform
move_19 = Move(Geometry=move_16.Geometry, Motion=amp_9)  # -> Geometry, Transform
move_20 = Move(Geometry=end_3.End, Motion=amp_9)  # -> Geometry, Transform
merge_9 = Merge(Data1=move_16.Geometry, Data2=pt_6, Data3=move_18.Geometry, Data4=move_17.Geometry)
merge_10 = Merge(Data1=end_3.End, Data2=move_16.Geometry, Data3=move_19.Geometry, Data4=move_20.Geometry)
merge_11 = Merge(Data1=end_3.Start, Data2=move_16.Geometry, Data3=end_3.End)
pline_9 = PolyLine(Vertices=merge_9, Closed=True)
pline_10 = PolyLine(Vertices=merge_10, Closed=True)
pline_11 = PolyLine(Vertices=merge_11, Closed=True)
# growth
merge_12 = Merge(Data1=pline_9, Data2=pline_10, Data3=pline_11)  # -> simplify(Result)

pcen = PolygonCenter(Polyline=merge_12)  # -> CenterV, CenterE, CenterA
scale = Scale(Geometry=merge_12, Center=pcen.CenterV, Factor="0.99")  # -> graft(Geometry), Transform
# collision check: 3 conditions are verified:
# 
# . collision with the older generation (one-to-many)
# . collision among same generation (many-to-many)
# . center point of polygon inside other polygon (if a shape is completely enclosed in another collision check alone fails)
# 
# If at least one of these 3 conditions is true (OR operator) then the polygon is not allowed into the next iteration.
pcen_2 = PolygonCenter(Polyline=scale.Geometry)  # -> CenterV, CenterE, CenterA
colom = CollisionOneMany(Collider=scale.Geometry, Obstacles=crv_4)  # -> Collision, Index
colmm = CollisionManyMany(Colliders=flatten(scale.Geometry))  # -> Collision, Indices
incurves = PointInCurves(Point=pcen_2.CenterV, Curves=crv_4)  # -> Relationship, Index, Point
pshift = ShiftPaths(Data=colom.Collision, Offset=-1)
larger = LargerThan(FirstNumber=incurves.Relationship, SecondNumber="0")  # -> LargerThan, OrEqualTo
pshift_2 = ShiftPaths(Data=larger.LargerThan, Offset=-1)
unflatten = UnflattenTree(Tree=colmm.Collision, Guide=pshift)
or = GateOr(A=unflatten, B=pshift, C=pshift_2)

# ----
# triangle preservation: if one of the two squares is passing through, then let also the triangle go through
item_9 = ListItem(List=or, Index=0, Wrap=True)  # -> Item, Item1, Item2
and = GateAnd(A=item_9.Item, B=item_9.Item1)
and_2 = GateAnd(A=and, B=item_9.Item2)
replace = ReplaceItems(List=or, Item=and_2, Indices="-1", Wrap=True)

# ----
# avoid collision
dispatch = Dispatch(List=merge_12, DispatchPattern=replace)  # -> ListA, ListB

explode_9 = Explode(Curve=dispatch.ListB, Recursive=True)  # -> Segments, Vertices
merge_13 = Merge(Data1=crv_4, Data2=dispatch.ListB)  # -> simplify(flatten(Result))
lng = ListLength(List=explode_9.Segments)
equals = Equality(FirstNumber=lng, SecondNumber="4")  # -> Equality, Inequality
dispatch_2 = Dispatch(List=explode_9.Segments, DispatchPattern=equals.Equality)  # -> ListA, ListB
clean = CleanTree(RemoveNulls=True, RemoveInvalid=True, RemoveEmpty=False, Tree=merge_13)
item_10 = ListItem(List=dispatch_2.ListA, Index=0, Wrap=True)  # -> Item, Item1, Item2, Item3
loop_end_2 = LoopEnd(
    port=loop_start_2.port,
    Exit=False,
    Data=simplify(item_10.Item2),
    Data_2=clean,
    pausedState=False,
    state="Constant output",
    TimeOutVal=0)  # -> D0, D1
explode_10 = Explode(Curve=loop_end_2.D1, Recursive=True)  # -> Segments, Vertices
cull_i = CullIndex(List=explode_10.Vertices, Indices="-1", Wrap=True)
lng_2 = ListLength(List=cull_i)
equals_2 = Equality(FirstNumber=lng_2, SecondNumber="4")  # -> Equality, Inequality
dispatch_3 = Dispatch(List=cull_i, DispatchPattern=equals_2.Equality)  # -> ListA, ListB
conmesh = ConstructMesh(Vertices=dispatch_3.ListA, Faces="Q{0;1;2;3}")
conmesh_2 = ConstructMesh(Vertices=dispatch_3.ListB, Faces="T{0;1;2}")
wbjoin = WeaverbirdsJoinMeshesAndWeld(Mesh=flatten([conmesh, conmesh_2]), Weld=False)
medges = MeshEdges(Mesh=wbjoin)  # -> NakedEdges, InteriorEdges, NonManifoldEdges
join_5 = JoinCurves(Curves=medges.NakedEdges, Preserve=False)
disc = Discontinuity(Curve=join_5, Level=1)  # -> Points, Parameters
# NURBS contour
nurbs = NurbsCurve(Vertices=disc.Points, Degree=3, Periodic=True)  # -> Curve, Length, Domain
# fillet contour
fillet_2 = Fillet(Curve=join_5, Radius=Slider(5.61, range=0..10))
# mesh
previewlw_4 = CustomPreviewLineweights(Geometry=wbjoin, Shader=ColourSwatch(SwatchColor=RGBA(85, 112, 120, 69)), Absolute=False)
