# Grasshopper definition 20161122_a3XX_simple attractor logic on hex grid.gh (Grasshopper 0.9.76)
# Copyright: Co-de-iT

# File template
# 
# © a3 2016 _ Creative Commons Attribution-NonCommercial-ShareAlike3.0 UnportedLicense.
number_slider = Slider(1.03, range=0..5)
hexgrid = Hexagonal(Plane=PlaneXY(0, 0, 0), Size=number_slider, ExtentX=Slider(30, range=5..50), ExtentY=Slider(41, range=5..50))  # -> Cells, graft(Points)
pt = Point([Point(36.70392354, 14.88900373, 2.521649094), Point(10.14786828, 39.63197814, 3.419652497), Point(32.57126236, 61.3991604, 4.567744286), Point(13.93626243, 13.34688952, -3.097875463), Point(11.7643733, 57.48623097, 1.500871213), Point(39.08946048, 38.5146144, -0.4926665398)])
crv = Curve(hexgrid.Cells)
vec2pt = Vector2Pt(PointA=hexgrid.Points, PointB=pt, Unitize=False)  # -> Vector, Length
one_over_x = OneOverX(Value=vec2pt.Length)
amp = Amplitude(Vector=vec2pt.Vector, Amplitude=one_over_x)
avr = Average(Input=amp)
circle = CircleCNR(Center=hexgrid.Points, Normal=avr, Radius=Slider(0.8, range=0..1))
project = Project(Geometry=circle, Plane=PlaneXY(0, 0, 0))  # -> Geometry, Transform
boundary = BoundarySurfaces(Edges=project.Geometry)
preview = CustomPreview(Geometry=boundary, Shader=ColourSwatch(SwatchColor=RGB(0, 0, 0)))
