# Grasshopper definition 20161130_a3XX_WarpWeft-3way node.gh (Grasshopper 0.9.76)
# Copyright: Co-de-iT
# plug-ins: Human, Kangaroo Components, Weaverbird

# modified topology 2
mesh = Mesh(<mesh referenced from the Rhino model>)
# modified topology
mesh_2 = Mesh(<mesh referenced from the Rhino model>)
# File template
# 
# © a3 2016 _ Creative Commons Attribution-NonCommercial-ShareAlike3.0 UnportedLicense.
# regular 3-way node
mesh_3 = Mesh(<mesh referenced from the Rhino model>)
mesh_4 = Mesh(<mesh referenced from the Rhino model>)
mesh_5 = Mesh(<mesh referenced from the Rhino model>)
wbsplitquads = WeaverbirdsConstantQuadsSplitSubdivision(MeshCurves=mesh_3, Level=1, SmoothNakedEdges=0)
Y = UnitY(Factor=Slider(77.016, range=1..100))
Y_2 = UnitY(Factor=Slider(77.016, range=1..100))
Y_3 = UnitY(Factor=Slider(60, range=1..100))
move = Move(Geometry=mesh_5, Motion=Y)  # -> Geometry, Transform
move_2 = Move(Geometry=mesh_4, Motion=Y_2)  # -> Geometry, Transform
move_3 = Move(Geometry=mesh, Motion=Y_3)  # -> Geometry, Transform
move_4 = Move(Geometry=mesh_2, Motion=Y_3)  # -> Geometry, Transform
move_5 = Move(Geometry=wbsplitquads, Motion=Y_3)  # -> Geometry, Transform
medges = MeshEdges(Mesh=move_3.Geometry)  # -> NakedEdges, InteriorEdges, NonManifoldEdges
demesh = DeconstructMesh(Mesh=move_3.Geometry)  # -> Vertices, Faces, Colours, Normals
medges_2 = MeshEdges(Mesh=move_5.Geometry)  # -> NakedEdges, InteriorEdges, NonManifoldEdges
medges_3 = MeshEdges(Mesh=move_4.Geometry)  # -> NakedEdges, InteriorEdges, NonManifoldEdges
demesh_2 = DeconstructMesh(Mesh=move_5.Geometry)  # -> Vertices, Faces, Colours, Normals
demesh_3 = DeconstructMesh(Mesh=move_4.Geometry)  # -> Vertices, Faces, Colours, Normals
number_slider = Slider(2, range=1..3)
wbcatmullclark = WeaverbirdsCatmullClarkSubdivision(MeshCurves=move.Geometry, Level=Slider(3, range=1..3), SmoothNakedEdges=1)
move_6 = Move(Geometry=move_5.Geometry, Motion=Y_3)  # -> Geometry, Transform
move_7 = Move(Geometry=move_3.Geometry, Motion=Y_3)  # -> Geometry, Transform
move_8 = Move(Geometry=move_4.Geometry, Motion=Y_3)  # -> Geometry, Transform
previewmat = CustomPreviewMaterials(Geometry=move_3.Geometry, DiffuseColor=RGB(255, 255, 255))
previewmat_2 = CustomPreviewMaterials(Geometry=move_5.Geometry, DiffuseColor=RGB(255, 255, 255))
previewmat_3 = CustomPreviewMaterials(Geometry=move_4.Geometry, DiffuseColor=RGB(255, 255, 255))
number_slider_2 = Slider(2, range=1..3)
# orients mesh faces direction
# cleans mesh
clean = CombineClean(Meshes=wbcatmullclark)
wbcatmullclark_2 = WeaverbirdsCatmullClarkSubdivision(MeshCurves=move_7.Geometry, Level=number_slider, SmoothNakedEdges=1)
wbcatmullclark_3 = WeaverbirdsCatmullClarkSubdivision(MeshCurves=move_2.Geometry, Level=number_slider_2, SmoothNakedEdges=1)
wbcatmullclark_4 = WeaverbirdsCatmullClarkSubdivision(MeshCurves=move_8.Geometry, Level=number_slider, SmoothNakedEdges=1)
# Warp-Weft: Warp-Weft works properly only in case all mesh vertices have an even valence (that's to say the must have an even number of edges  - 2, 4, 6, ertc. - arriving at that vertex)
wbcatmullclark_5 = WeaverbirdsCatmullClarkSubdivision(MeshCurves=move_6.Geometry, Level=number_slider, SmoothNakedEdges=1)
# rotate vertex orders for a face
# (the equivalent of flipping warp-weft direction)
flip_strip_direction = BooleanToggle(False)
md = MeshDirection(Mesh=clean)
warp_color = ColourSwatch(SwatchColor=RGB(209, 209, 209))
weft_color = ColourSwatch(SwatchColor=RGB(0, 0, 0))
warpweft = WarpWeft(Mesh=wbcatmullclark_2)  # -> Warp, Weft, NakedA, NakedB
warpweft_2 = WarpWeft(Mesh=wbcatmullclark_3)  # -> Warp, Weft, NakedA, NakedB
warpweft_3 = WarpWeft(Mesh=wbcatmullclark_4)  # -> Warp, Weft, NakedA, NakedB
warpweft_4 = WarpWeft(Mesh=wbcatmullclark_5)  # -> Warp, Weft, NakedA, NakedB
turn = MeshTurn(Mesh=md)
previewmat_4 = CustomPreviewMaterials(Geometry=wbcatmullclark_3, DiffuseColor=RGB(255, 255, 255))
filter = StreamFilter(Gate=flip_strip_direction, Stream0=md, Stream1=turn)
crv = Curve(warpweft_4.Weft)
crv_2 = Curve(warpweft_4.Warp)
crv_3 = Curve(warpweft.Weft)
crv_4 = Curve(warpweft_2.Weft)
crv_5 = Curve(warpweft.Warp)
crv_6 = Curve(warpweft_2.Warp)
crv_7 = Curve(warpweft_3.Weft)
crv_8 = Curve(warpweft_3.Warp)
previewlw = CustomPreviewLineweights(Geometry=crv_2, Shader=warp_color, Absolute=False)
# uneven warp-weft
# (could also return an error)
previewlw_2 = CustomPreviewLineweights(Geometry=crv, Shader=weft_color, Absolute=False)
previewlw_3 = CustomPreviewLineweights(Geometry=crv_5, Shader=warp_color, Absolute=False)
previewlw_4 = CustomPreviewLineweights(Geometry=crv_6, Shader=warp_color, Absolute=False)
# even warp-weft
previewlw_5 = CustomPreviewLineweights(Geometry=crv_3, Shader=weft_color, Absolute=False)
previewlw_6 = CustomPreviewLineweights(Geometry=crv_4, Shader=weft_color, Absolute=False)

# ---- group: by Giulio Piacentino
c_script = CSharpScript(M=move_2.Geometry, S=wbcatmullclark_3, L=number_slider_2)  # -> out, A; inputs M: Mesh, S: Mesh, L: Int32
# ---------- c_script: C# ----------
    if (M == null || S == null)return;
    if (L <= 0) { A = S; return; }

    List<Mesh> result = new List<Mesh>();
    int faceCount = S.Faces.Count;

    Mesh n = new Mesh();
    n.Vertices.AddVertices(S.Vertices);

    int originalIndex = 0;
    int lastFaceIndex = M.Faces.Count - 1;
    int TL = Predict(FaceLength(M.Faces[0]), L) - 1;

    for (int i = 0; i < faceCount; i++)
    {
      n.Faces.AddFace(S.Faces[i]);

      if (i == TL)
      {
        n.Compact();
        n.Normals.ComputeNormals();
        result.Add(n);

        if (originalIndex != lastFaceIndex)
        {
          n = new Mesh();
          n.Vertices.AddVertices(S.Vertices);
          int fl = FaceLength(M.Faces[++originalIndex]);
          TL += Predict(fl, L);
        }
      }
    }

    A = result;
# ---------- c_script: C# additional code ----------
  static int FaceLength(MeshFace mf){ return mf.IsQuad ? 4 : 3; }
  static int Predict(int faceLength, int L){ return (faceLength << ((L - 1) << 1)); }
# ---------- end c_script ----------

# ----
previewlw_7 = CustomPreviewLineweights(Geometry=crv_8, Shader=warp_color, Absolute=False)
# even warp-weft
previewlw_8 = CustomPreviewLineweights(Geometry=crv_7, Shader=weft_color, Absolute=False)
# refine resolution of the strips
strips = RefineStrips(Mesh=filter, Level=Slider(0, range=0..3))
# stripper
stripper = Stripper(Mesh=strips)
join = JoinCurves(Curves=crv_4, Preserve=False)
# unroll quad mesh
# or tri-mesh stripes
unroller = Unroller(Strip=stripper, Unroll=Slider(0, range=0..1))
curvepoint = PointOnCurve(join, parameter=0.5)
lng = ListLength(List=join)
series = Series(Start=0, Step=1, Count=lng)
mesh_6 = Mesh(unroller)
lng_2 = ListLength(List=mesh_6)
int = Integer(series)
wheel = ColourWheel(
    lng_2,
    ColourGrips_Style=10,
    ColourGrips_Grip=[0, 2.094395102, 4.188790205, 3.141592654],
    ColourGrips_Lum=[0.1, 0.7225692612],
    ColourGrips_Range=[0.118677989, 0.118677989, 0.118677989, 0.118677989],
    ColourGrips_Sat=[0.2, 0.9575393383])
medges_4 = MeshEdges(Mesh=mesh_6)  # -> NakedEdges, InteriorEdges, NonManifoldEdges
tag = TextTag3D(Location=curvepoint, Text=int, Size=1, Justification=8)
mcol = MeshColours(Mesh=graft(mesh_6), Colours=graft(wheel))
previewlw_9 = CustomPreviewLineweights(Geometry=medges_4.InteriorEdges, Shader=ColourSwatch(SwatchColor=RGB(94, 94, 94)), Absolute=False)
previewlw_10 = CustomPreviewLineweights(Geometry=medges_4.NakedEdges, Shader=ColourSwatch(SwatchColor=RGB(0, 0, 0)), Absolute=False)
