# Grasshopper definition 20170220_a3XX_Calatrava high-speed.gh (Grasshopper 0.9.76)
# Copyright: Co-de-iT
# plug-ins: Human

# High-Speed Trigonometry Station
# 
# Calatrava "Mediopadana" station in Reggio Emilia as an exercise to learn sine function and sweep 1 rail
# 
# © a3 2016 _ Creative Commons Attribution-NonCommercial-ShareAlike3.0 UnportedLicense.
phase = Slider(1, range=0..1)
series = Series(Start=0, Step=Slider(0.7, range=0..3), Count=Slider(150, range=1..200))
frequency = Slider(0.6, range=0..1)
amplitude = Slider(1, range=1..10)
pi = Pi(Factor=phase)
height = Slider(8, range=0..20)
width = Slider(25, range=0..30)
multiplication = Multiplication(A=series, B=frequency)
addition = Addition(A=multiplication, B=pi)
sin = Sine(Value=addition)
sin_2 = Sine(Value=multiplication)
multiplication_2 = Multiplication(A=sin, B=amplitude)
multiplication_3 = Multiplication(A=sin_2, B=amplitude)
Z = UnitZ(Factor=height)
Y = UnitY(Factor=width)
neg = Negative(Value=multiplication_2)
neg_2 = Negative(Value=multiplication_3)
pt = ConstructPoint(XCoordinate=series, YCoordinate=neg_2, ZCoordinate=multiplication_3)
pt_2 = ConstructPoint(XCoordinate=series, YCoordinate=neg, ZCoordinate=multiplication_2)
pt_3 = ConstructPoint(XCoordinate=series, YCoordinate=multiplication_3, ZCoordinate=multiplication_3)
move = Move(Geometry=pt_2, Motion=Z)  # -> Geometry, Transform
pt_4 = ConstructPoint(XCoordinate=series, YCoordinate=multiplication_2, ZCoordinate=multiplication_2)
move_2 = Move(Geometry=pt_3, Motion=Z)  # -> Geometry, Transform
move_3 = Move(Geometry=move.Geometry, Motion=Y)  # -> Geometry, Transform
move_4 = Move(Geometry=pt, Motion=Y)  # -> Geometry, Transform
number_slider = Slider(0.1, range=0..1)
number_slider_2 = Slider(0.3, range=0..1)
merge = Merge(Data1=graft(pt_4), Data2=graft(move_2.Geometry), Data3=graft(move_3.Geometry), Data4=graft(move_4.Geometry))
neg_3 = Negative(Value=number_slider)
neg_4 = Negative(Value=number_slider_2)
pline = PolyLine(Vertices=merge, Closed=False)

merge_2 = Merge(Data1=number_slider_2, Data2=neg_4)
planar = Planar(Curve=pline)  # -> Planar, Plane, Deviation
offset_l = OffsetLoose(Curve=pline, Distance=merge_2, Plane=planar.Plane)  # -> simplify(Curve)
deplane = DeconstructPlane(Plane=planar.Plane)  # -> Origin, XAxis, YAxis, ZAxis
lng = ListLength(List=offset_l)
dup = DuplicateData(Data=deplane.ZAxis, Number=lng, Order=True)  # -> simplify(graft(Data))
merge_3 = Merge(Data1=neg_3, Data2=number_slider)
multiplication_4 = Multiplication(A=dup, B=merge_3)
move_5 = Move(Geometry=graft(offset_l), Motion=multiplication_4)  # -> Geometry, Transform
pshift = ShiftPaths(Data=move_5.Geometry, Offset=-1)  # -> simplify(Data)
item = ListItem(List=pshift, Index=0, Wrap=True)  # -> Item, Item1, Item2, Item3
merge_4 = Merge(Data1=item.Item, Data2=item.Item1, Data3=item.Item3, Data4=item.Item2)
# cluster
# (double click to see inside)
polyline_mesh_loft = PolyMeshLoft(polylines=merge_4, closed_loft=Toggle(True))
previewmat = CustomPreviewMaterials(Geometry=polyline_mesh_loft, DiffuseColor=RGB(255, 255, 255))
# Meshes from polylines (fast)
previewlw = CustomPreviewLineweights(Geometry=pshift, Shader=ColourSwatch(SwatchColor=RGB(0, 0, 0)), Absolute=False)

graft = GraftTree(Tree=pt_4, IncludeEmptyLists=True, IncludeNullItems=True)
dom = ConstructDomain(DomainStart=neg_3, DomainEnd=number_slider)
dom_2 = ConstructDomain(DomainStart=neg_4, DomainEnd=number_slider_2)
rectangle = Rectangle(Plane=graft, XSize=dom, YSize=dom_2, Radius=0)  # -> Rectangle, Length
swp1 = Sweep1(Rail=pline, Sections=rectangle.Rectangle, Miter=1)  # disabled
# BReps by sweep (slow)
edges = BrepEdges(Brep=swp1)  # -> Naked, Interior, NonManifold

# ==== cluster PolyMeshLoft: Lofts polylines with the same number of vertices into a mesh
closed_loft = ClusterInput()  # Boolean toggle (true for closed loft)
polylines = ClusterInput()  # Polylines to loft (all polylines must have same number of points)
explode = Explode(Curve=polylines, Recursive=True)  # -> Segments, simplify(Vertices)
viewer = ParamViewer(explode.Vertices)
item = ListItem(List=viewer, Index=0, Wrap=True)
dpath = DeconstructPath(Branch=item)
lng = ListLength(List=dpath)
addition = Addition(A=lng, B=1)
subtraction = Subtraction(A=lng, B=1)
dup = DuplicateData(Data="0;", Number=subtraction, Order=True)
join = TextJoin(Text=dup)
expression = Expression(x="{", y=join, u="0", z="}", v="+1", Expression="Format(\"{0}{1}{2}{3}({4})\", x, y, u, z, v)")
expression_2 = Expression(x="{", y=join, u="+1", z="}", v="+1", Expression="Format(\"{0}{1}{2}{3}({4})\", x, y, u, z, v)")
expression_3 = Expression(x="{", y=join, u="+1", z="}", v="0", Expression="Format(\"{0}{1}{2}{3}({4})\", x, y, u, z, v)")
relitem = RelativeItem(Tree=explode.Vertices, Offset=expression, WrapPaths=closed_loft, WrapItems=False)  # -> ItemA, ItemB
relitem_2 = RelativeItem(Tree=explode.Vertices, Offset=expression_3, WrapPaths=closed_loft, WrapItems=False)  # -> ItemA, ItemB
relitem_3 = RelativeItem(Tree=explode.Vertices, Offset=expression_2, WrapPaths=closed_loft, WrapItems=False)  # -> ItemA, ItemB
merge = Merge(Data1=graft(explode.Vertices), Data2=graft(relitem_2.ItemB), Data3=graft(relitem_3.ItemB), Data4=graft(relitem.ItemB))
viewer_2 = ParamViewer(polylines)
conmesh = ConstructMesh(Vertices=merge, Faces={A=0, B=1, C=2, D=3})
neg = Negative(Value=lng)
lng_2 = ListLength(List=flatten(viewer_2))
pshift = ShiftPaths(Data=conmesh, Offset=neg)
equals = Equality(FirstNumber=lng_2, SecondNumber="1")  # -> Equality, Inequality
gate = StreamGate(Stream=pshift, Gate=equals.Equality)  # -> Target0, Target1
flatten = FlattenTree(Tree=gate.Target1, Path="{0}")
mjoin = MeshJoin(Meshes=[gate.Target0, flatten])
weldvertices = MeshWeldVertices(Mesh=mjoin, Tolerance="0.01")  # -> RuntimeMessage, Mesh
unifynormals = MeshUnifyNormals(Mesh=weldvertices.Mesh)
mesh = ClusterOutput(unifynormals)
