# Grasshopper definition 20170306_a3XX_ExoWire_polyhedra.gh (Grasshopper 0.9.76)
# Copyright: Co-de-iT
# plug-ins: Exoskeleton2, Weaverbird, Starling, Kangaroo2 Components

number_slider = Slider(100, range=0..100)
number_slider_2 = Slider(100, range=0..100)
# ExoWire
# 
# esempio d'uso di exo wire per generare una struttura tridimensionale sulla bas edi un network di linee
# 
# © a3 2017 _ Creative Commons Attribution-NonCommercial-ShareAlike3.0 UnportedLicense.
# leggere le info a questa pagina! >>> http://www.grasshopper3d.com/group/exoskeleton
# BRep to lines network: Estrarre le linee di contorno delle polisuprfici - exoWire lavora con network di linee
crv = Curve([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])
pt = Point(Point(223.6723588, 245.6242036, -128.6633146))
box = CenterBox(Base=PlaneXY(0, 0, 0), X=number_slider, Y=number_slider, Z=Slider(43, range=0..100))
box_2 = CenterBox(Base=PlaneXY(0, 0, 0), X=number_slider_2, Y=number_slider_2, Z=Slider(184, range=0..200))
pt_2 = Point(Point(120, 1200, 0))
pt_3 = Point(Point(120, 800, 0))
# remove duplicate lines: Usare questo componente di Kangaroo per rimuovere le linee doppie sovrapposte
dupln = RemoveDuplicateLines(Lines=crv, Tolerance=0.01)
# questi valori dipendono dalla scala del modello e dalle unità di misura che state usando
curvepoint = PointOnCurve(dupln, parameter=0.5)

far_thickness = Slider(10, range=0..10)
close_thickness = Slider(0.5, range=0.1..5)

# ----
# Voronoi 3D - caso problematico
# il Voronoi 3D tende a creare nodi molto densi e con angoli stretti tra le linee - due condizioni che risultano a volte impossibili da risolvere per ExoWire
move = Move(Geometry=box, Motion=pt_2)  # -> Geometry, Transform
# convex hull
move_2 = Move(Geometry=box_2, Motion=pt_3)  # -> Geometry, Transform
dist = Distance(PointA=curvepoint, PointB=pt)
pop3d = Populate3D(Region=move.Geometry, Count=Slider(16, range=1..20), Seed=Slider(14, range=1..20))
pop3d_2 = Populate3D(Region=move_2.Geometry, Count=Slider(19, range=1..20), Seed=Slider(12, range=1..20))
thickness = ValueList({"fixed": 0, "by attractor": 1}, selected="by attractor")
thickness_2 = Slider(1.952, range=0..5)
bnd = Bounds(Numbers=dist)
dom = ConstructDomain(DomainStart=close_thickness, DomainEnd=far_thickness)
# convex hull 3D
# 
# Plugin: Starling
slhull3d = SlHull3D(Point3d=pop3d_2)
voronoi³ = Voronoi3D(Points=pop3d, Box=move.Geometry)  # -> Cells, Boundary
remap = RemapNumbers(Value=dist, Source=bnd, Target=dom)  # -> Mapped, Clipped
wires = BrepWireframe(Brep=voronoi³.Cells, Density=-1)  # -> flatten(Wireframe)
medges = MeshEdges(Mesh=slhull3d)  # -> NakedEdges, InteriorEdges, NonManifoldEdges
filter = StreamFilter(Gate=thickness, Stream0=thickness_2, Stream1=remap.Mapped)
crv_2 = Curve(wires)
pt_4 = Point(Point(37.7785197, 1284.651567, -23.13276881))
curvepoint_2 = PointOnCurve(medges.InteriorEdges, parameter=0.5)
dupln_2 = RemoveDuplicateLines(Lines=crv_2, Tolerance=0.01)

far_thickness_2 = Slider(5.145, range=0..10)
close_thickness_2 = Slider(1, range=0.1..5)

# ----
# NOTA BENE
# in alcuni casi Exo Wire non può generare geometrie valide (es: troppa differenza tra Rs ed Re). Se il componente genera errori aggiustare i parametri
# . il numero di linee che convergono in ciascun nodo e il loro angolo e lunghezza determinano sia lo spessore massimo possibile del nodo che l'eventuale errore nel componente
# 
# . è quindi possibile che alcune configurazioni non siano risolvibili dal componente ExoWire
# 
# . vedi il caso del Voronoi 3D qui sotto (provare a cambiare i parametri di n. di punti, seed e spessore - o altro - e vedere quante danno un esito positivo)
exow = ExoWireframe(
    Lines=dupln,
    Sides=Slider(5, range=3..10),
    StartRadius=filter,
    EndRadius=filter,
    NodeDepth=Slider(0, range=0..50),
    Division=Slider(200, range=10..200),
    Open=False)
curvepoint_3 = PointOnCurve(dupln_2, parameter=0.5)
dist_2 = Distance(PointA=curvepoint_2, PointB=pt_3)

far_thickness_3 = Slider(2, range=0..10)
close_thickness_3 = Slider(0.1, range=0.1..5)

thickness_3 = ValueList({"fixed": 0, "by attractor": 1}, selected="by attractor")
thickness_4 = Slider(0.65, range=0..5)
bnd_2 = Bounds(Numbers=dist_2)
dom_2 = ConstructDomain(DomainStart=close_thickness_2, DomainEnd=far_thickness_2)
dist_3 = Distance(PointA=curvepoint_3, PointB=pt_4)
thickness_5 = ValueList({"fixed": 0, "by attractor": 1}, selected="by attractor")
remap_2 = RemapNumbers(Value=dist_2, Source=bnd_2, Target=dom_2)  # -> Mapped, Clipped
thickness_6 = Slider(0.65, range=0..5)
bnd_3 = Bounds(Numbers=dist_3)
dom_3 = ConstructDomain(DomainStart=close_thickness_3, DomainEnd=far_thickness_3)
remap_3 = RemapNumbers(Value=dist_3, Source=bnd_3, Target=dom_3)  # -> Mapped, Clipped
filter_2 = StreamFilter(Gate=thickness_3, Stream0=thickness_4, Stream1=remap_2.Mapped)
filter_3 = StreamFilter(Gate=thickness_5, Stream0=thickness_6, Stream1=remap_3.Mapped)
exow_2 = ExoWireframe(
    Lines=dupln_2,
    Sides=Slider(3, range=3..10),
    StartRadius=filter_3,
    EndRadius=filter_3,
    NodeDepth=Slider(0, range=0..50),
    Division=Slider(196.96, range=10..200),
    Open=False)
exow_3 = ExoWireframe(
    Lines=medges.InteriorEdges,
    Sides=Slider(7, range=3..10),
    StartRadius=filter_2,
    EndRadius=filter_2,
    NodeDepth=Slider(0, range=0..50),
    Division=Slider(200, range=10..200),
    Open=False)

iterations = Slider(10, range=1..10)
wbloop = WeaverbirdsLoopSubdivision(MeshCurves=exow_3, Level=Slider(2, range=1..3), SmoothNakedEdges=1)
wblaplace = WeaverbirdsLaplacianSmoothing(MeshCurves=wbloop, Level=iterations, SmoothNakedEdges=1, Thin=1)
# rifinitura delle geometrie
X = UnitX(Factor="500")
preview = CustomPreview(
    Geometry=wbloop,
    Shader={ambient=RGB(128, 128, 128), diffuse=RGB(0, 0, 0), emission=RGB(51, 111, 111), shine=0.25, specular=RGB(255, 255, 255), transparency=0})
move_3 = Move(Geometry=wblaplace, Motion=X)  # -> Geometry, Transform
preview_2 = CustomPreview(
    Geometry=move_3.Geometry,
    Shader={ambient=RGB(128, 128, 128), diffuse=RGB(0, 0, 0), emission=RGB(119, 136, 153), shine=0.25, specular=RGB(255, 255, 255), transparency=0})

iterations_2 = Slider(10, range=1..10)
wbloop_2 = WeaverbirdsLoopSubdivision(MeshCurves=exow, Level=Slider(2, range=1..3), SmoothNakedEdges=1)
wblaplace_2 = WeaverbirdsLaplacianSmoothing(MeshCurves=wbloop_2, Level=iterations_2, SmoothNakedEdges=1, Thin=1)
# rifinitura delle geometrie
X_2 = UnitX(Factor="500")
preview_3 = CustomPreview(
    Geometry=wbloop_2,
    Shader={ambient=RGB(128, 128, 128), diffuse=RGB(0, 0, 0), emission=RGB(51, 111, 111), shine=0.25, specular=RGB(255, 255, 255), transparency=0})
move_4 = Move(Geometry=wblaplace_2, Motion=X_2)  # -> Geometry, Transform
preview_4 = CustomPreview(
    Geometry=move_4.Geometry,
    Shader={ambient=RGB(128, 128, 128), diffuse=RGB(0, 0, 0), emission=RGB(119, 136, 153), shine=0.25, specular=RGB(255, 255, 255), transparency=0})

iterations_3 = Slider(10, range=1..10)
wbloop_3 = WeaverbirdsLoopSubdivision(MeshCurves=exow_2, Level=Slider(2, range=1..3), SmoothNakedEdges=1)
wblaplace_3 = WeaverbirdsLaplacianSmoothing(MeshCurves=wbloop_3, Level=iterations_3, SmoothNakedEdges=1, Thin=1)
# rifinitura delle geometrie
X_3 = UnitX(Factor="500")
# rifinitura delle geometrie
preview_5 = CustomPreview(
    Geometry=wbloop_3,
    Shader={ambient=RGB(128, 128, 128), diffuse=RGB(0, 0, 0), emission=RGB(51, 111, 111), shine=0.25, specular=RGB(255, 255, 255), transparency=0})
move_5 = Move(Geometry=wblaplace_3, Motion=X_3)  # -> Geometry, Transform
preview_6 = CustomPreview(
    Geometry=move_5.Geometry,
    Shader={ambient=RGB(128, 128, 128), diffuse=RGB(0, 0, 0), emission=RGB(119, 136, 153), shine=0.25, specular=RGB(255, 255, 255), transparency=0})
